# Grasshopper definition skyglazer panelling.gh (Grasshopper 1.0.7)
# plug-ins: LunchBox, Pufferfish

point = Point([Point(9.499237575, -1.290493457, 0), Point(4.092377375, 11.4555269, 0), Point(14.12634915, 4.358281188, 0), Point(4.443649177, -10.60830835, 0)])

# ---- group: RH_IN:showPath
boolean_toggle = BooleanToggle(True)

# ----
# CONTROL POINTS
rh_in_points = GetPoint(point, AtLeast=1, AtMost=2147483647, Realtime=True)

rh_in_panelgroupingtype = GetInteger(Slider(1, range=0..2), AtLeast=1, AtMost=1, Maximum=2147483647, Minimum=-2147483648)
# GROUPING
rh_in_showgroupnumbers = GetBoolean(Toggle(False), AtLeast=1, AtMost=1, FalseValue="False", TrueValue="True")
# COLOURING
rh_in_paneltypenumber = GetInteger(Slider(14, range=0..100), AtLeast=1, AtMost=1, Maximum=2147483647, Minimum=-2147483648)

rh_in_udivisions = GetNumber(Slider(19, range=0..100), AtLeast=1, AtMost=1, Maximum=1.797693135e+308, Minimum=-1.797693135e+308)
# PANELIZATION
rh_in_paneltype = GetInteger(Slider(0, range=0..2), AtLeast=1, AtMost=1, Maximum=2147483647, Minimum=-2147483648)
rh_in_vdivisions = GetNumber(Slider(12, range=0..100), AtLeast=1, AtMost=1, Maximum=1.797693135e+308, Minimum=-1.797693135e+308)

# ---- group: RH_IN:showArcs
boolean_toggle_2 = BooleanToggle(True)

# ---- group: RH_IN:showWireframe
# LAYER OPTIONS
boolean_toggle_3 = BooleanToggle(True)

# ----
# ARCS
rh_in_arcradius1 = GetNumber(Slider(4, range=0..10), AtLeast=1, AtMost=1, Maximum=1.797693135e+308, Minimum=-1.797693135e+308)
rh_in_arcradius2 = GetNumber(Slider(3, range=0..10), AtLeast=1, AtMost=1, Maximum=1.797693135e+308, Minimum=-1.797693135e+308)
rh_in_arcradius3 = GetNumber(Slider(2, range=0..10), AtLeast=1, AtMost=1, Maximum=1.797693135e+308, Minimum=-1.797693135e+308)
rh_in_arcradius4 = GetNumber(Slider(2, range=0..10), AtLeast=1, AtMost=1, Maximum=1.797693135e+308, Minimum=-1.797693135e+308)

rh_in_showcolour = GetBoolean(Toggle(True), AtLeast=1, AtMost=1, FalseValue="False", TrueValue="True")
rh_in_colourtype = GetNumber(Slider(1, range=0..2), AtLeast=1, AtMost=1, Maximum=1.797693135e+308, Minimum=-1.797693135e+308)

merge = Merge(Data1=rh_in_arcradius1, Data2=rh_in_arcradius2, Data3=rh_in_arcradius3, Data4=rh_in_arcradius4)
site_length = Slider(82, range=0..100)
site_width = Slider(15, range=0..20)
rectangle = Rectangle(Plane=PlaneXY(0, 0, 0), XSize=site_width, YSize=site_length, Radius=0)  # -> Rectangle, Length
explode = Explode(Curve=rectangle.Rectangle, Recursive=True)  # -> Segments, Vertices
list_item = ListItem(List=explode.Segments, Index=1, Wrap=True)
sort_along_curve = SortAlongCurve(Points=rh_in_points, Curve=list_item)  # -> Points, Indices
panel = Panel(sort_along_curve.Points)
interpolate = Interpolate(Vertices=sort_along_curve.Points, Degree=3, Periodic=False, KnotStyle=1)  # -> Curve, Length, Domain
curve_closest_point = CurveClosestPoint(Point=rh_in_points, Curve=interpolate.Curve)  # -> Point, Parameter, Distance
perp_frame = PerpFrame(Curve=interpolate.Curve, Parameter=curve_closest_point.Parameter)
sort_along_curve_2 = SortAlongCurve(Points=perp_frame, Curve=interpolate.Curve)  # -> Points, Indices
panel_2 = Panel(merge)
deconstruct_plane = DeconstructPlane(Plane=sort_along_curve_2.Points)  # -> Origin, XAxis, YAxis, ZAxis
data = Data(panel_2)
negative = Negative(Value=data)
line_sdl = LineSDL(Start=sort_along_curve_2.Points, Direction=deconstruct_plane.XAxis, Length=negative)  # -> flatten(Line)
line_sdl_2 = LineSDL(Start=sort_along_curve_2.Points, Direction=deconstruct_plane.XAxis, Length=data)  # -> flatten(Line)
xz_plane = XZPlane(Origin=Point(0, 0, 0))
join_curves = JoinCurves(Curves=[line_sdl, line_sdl_2], Preserve=False)
end_points = EndPoints(Curve=join_curves)  # -> Start, End
c_script = CSharpScript(plane=xz_plane, start=end_points.Start, end=end_points.End, radius=data)  # -> out, A, B, C, D; inputs plane: Plane, start: Point3d, end: Point3d, radius: Double
# ---------- c_script: C# ----------
    var line = new Line(start, end);
    var vec = Vector3d.CrossProduct(line.Direction, plane.ZAxis);
    vec.Unitize();
    var d = Math.Sqrt(Math.Pow(radius, 2.0) - Math.Pow(line.Length, 2.0) / 4.0);
    A = new Arc(start, line.PointAt(0.5) + vec * (radius - d), end);
    B = new Arc(start, line.PointAt(0.5) - vec * (radius - d), end);
    C = new Arc(start, line.PointAt(0.5) + vec * (radius + d), end);
    D = new Arc(start, line.PointAt(0.5) - vec * (radius + d), end);
# ---------- end c_script ----------
loft = Loft(Curves=c_script.B, Options={Adjust=False, Closed=False, LoftEnds=0, LoftSimp=0, LoftType=0, Rebuild=10, Refit=0.01})
stream_gate = StreamGate(Stream=loft, Gate=rh_in_paneltype)  # -> Target0, Target1, Target2
quad_panels = QuadPanels(Surface=stream_gate.Target0, UDivisions=rh_in_udivisions, VDivisions=rh_in_vdivisions)
triangular_panels_a = TriangularPanelsA(Surface=stream_gate.Target1, UDivisions=rh_in_udivisions, VDivisions=rh_in_vdivisions)
diamond_panels = DiamondPanels(Surface=stream_gate.Target2, UDivisions=rh_in_udivisions, VDivisions=rh_in_vdivisions)  # -> DiamondPanels, TriPanels
surface = Surface([triangular_panels_a, quad_panels, diamond_panels.DiamondPanels, diamond_panels.TriPanels])
mesh = Mesh([quad_panels, triangular_panels_a, diamond_panels.DiamondPanels, diamond_panels.TriPanels])
graft_tree = GraftTree(Tree=mesh, IncludeEmptyLists=True, IncludeNullItems=True)
graft_tree_2 = GraftTree(Tree=surface, IncludeEmptyLists=True, IncludeNullItems=True)
no_of_divisions = Panel(rh_in_paneltypenumber)
construct_domain = ConstructDomain(DomainStart=0, DomainEnd=1)
area = Area(Geometry=graft_tree)  # -> Area, Centroid
surface_closest_point = SurfaceClosestPoint(Point=area.Centroid, Surface=graft_tree_2)  # -> Point, UVPoint, Distance
principal_curvature = PrincipalCurvature(Surface=loft, Point=surface_closest_point.UVPoint)  # -> Frame, Maximum, Minimum, MaxDirection, MinDirection
range = Range(Domain=construct_domain, Steps=no_of_divisions)
divide_domain = DivideDomain(Domain=construct_domain, Count=no_of_divisions)
deconstruct = Deconstruct(Point=area.Centroid)  # -> XComponent, YComponent, ZComponent
list_item_2 = ListItem(List=range, Index=0, Wrap=True)  # -> Item, Item1
multiplication = Multiplication(A=principal_curvature.Maximum, B=principal_curvature.Minimum)
deconstruct_domain = DeconstructDomain(Domain=construct_domain)  # -> Start, End
list_length = ListLength(List=flatten(area.Centroid))
bounds = Bounds(Numbers=flatten(multiplication))
subtraction = Subtraction(A=list_item_2.Item1, B=list_item_2.Item)
bounds_2 = Bounds(Numbers=flatten(deconstruct.YComponent))
division = Division(A=subtraction, B="2")
remap_numbers = RemapNumbers(Value=multiplication, Source=bounds, Target=Domain(0, 1))  # -> Mapped, Clipped
construct_domain_2 = ConstructDomain(DomainStart=0, DomainEnd=1)
addition = Addition(A=range, B=division)
remap_numbers_2 = RemapNumbers(Value=deconstruct.YComponent, Source=bounds_2, Target=construct_domain)  # -> Mapped, Clipped
last_index = LastIndex(List=addition)
random = Random(Range=construct_domain_2, Number=list_length, Seed=2)  # -> graft(Random)
cull_index = CullIndex(List=addition, Indices=last_index, Wrap=True)
gradient = Gradient(
    LowerLimit=deconstruct_domain.Start,
    UpperLimit=deconstruct_domain.End,
    Parameter=cull_index,
    stops=[0.15: RGB(255, 130, 160), 0.85: RGB(220, 0, 40)])
gradient_2 = Gradient(
    LowerLimit=deconstruct_domain.Start,
    UpperLimit=deconstruct_domain.End,
    Parameter=cull_index,
    stops=[0: RGB(243, 57, 0), 0.1: RGB(236, 27, 60), 0.2: RGB(210, 0, 118), 0.3: RGB(103, 0, 120), 0.4: RGB(39, 72, 161), 0.5: RGB(1, 192, 229), 0.6: RGB(18, 178, 90), 0.7: RGB(79, 186, 8), 0.8: RGB(220, 237, 32), 0.9: RGB(247, 159, 20), 1: RGB(243, 57, 0)])
gradient_3 = Gradient(
    LowerLimit=deconstruct_domain.Start,
    UpperLimit=deconstruct_domain.End,
    Parameter=cull_index,
    stops=[0: RGB(234, 38, 0), 0.25: RGB(234, 126, 0), 0.5: RGB(254, 244, 84), 0.75: RGB(173, 203, 249), 1: RGB(75, 107, 169)])
stream_filter = StreamFilter(Gate=rh_in_panelgroupingtype, Stream0=remap_numbers.Mapped, Stream1=remap_numbers_2.Mapped, Stream2=random)
includes = Includes(Value=stream_filter, Domain=divide_domain)  # -> Includes, Deviation
stream_filter_2 = StreamFilter(Gate=rh_in_colourtype, Stream0=gradient_3, Stream1=gradient_2, Stream2=gradient)
member_index = MemberIndex(Set=includes.Includes, Member=Toggle(True))  # -> Index, Count
list_item_3 = ListItem(List=stream_filter_2, Index=member_index.Index, Wrap=True)  # -> simplify(Item)
member_index_2 = MemberIndex(Set=flatten(list_item_3), Member=stream_filter_2)  # -> Index, Count
colours = Data(flatten(list_item_3))
create_set = CreateSet(List=colours)  # -> Set, Map
mesh_2 = Data(simplify(flatten(graft_tree)))
member_index_3 = MemberIndex(Set=colours, Member=create_set.Set)  # -> Index, Count
mesh_colours = MeshColours(Mesh=graft_tree, Colours=list_item_3)
list_item_organised_meshes = ListItem(List=mesh_2, Index=member_index_3.Index, Wrap=True)
list_indices = ListIndices(List=create_set.Set)
graft_tree_3 = GraftTree(Tree=list_indices, IncludeEmptyLists=True, IncludeNullItems=True)
area_2 = Area(Geometry=list_item_organised_meshes)  # -> Area, Centroid
stream_filter_3 = StreamFilter(Gate=boolean_toggle_3, Stream1=surface)
curve = Curve(interpolate.Curve)
curve_2 = Curve(c_script.B)
stream_filter_4 = StreamFilter(Gate=boolean_toggle, Stream1=curve)
x_plus_one = XPlusOne(NumberX=graft_tree_3)
deconstruct_brep = DeconstructBrep(Brep=stream_filter_3)  # -> Faces, Edges, Vertices
stream_filter_5 = StreamFilter(Gate=boolean_toggle_2, Stream1=curve_2)
stream_filter_6 = StreamFilter(Gate=rh_in_paneltype, Stream0="Quad Panels", Stream1="Triangular Panels", Stream2="Diamond Panels")
c_script_2 = CSharpScript(face="Arial", bold=Toggle(False), size=Slider(0.781, range=0..11), content=x_plus_one, pl=area_2.Centroid)  # -> out, A; inputs face: String, bold: Boolean, italics: Boolean, size: Double, content: String, pl: Plane
# ---------- c_script_2: C# usings ----------
using System.IO;
using System.Linq;
using System.Data;
using System.Drawing;
using System.Reflection;
using System.Windows.Forms;
using System.Xml;
using System.Xml.Linq;
using System.Runtime.InteropServices;

using Rhino.DocObjects;
using Rhino.Collections;
using GH_IO;
using GH_IO.Serialization;
# ---------- c_script_2: C# ----------
    if(size == 0)
      size = 1;

    if(!string.IsNullOrEmpty(face) && size > 0 && !string.IsNullOrEmpty(content) &&
      pl.IsValid)
    {
      using (var doc = Rhino.RhinoDoc.CreateHeadless(null))
      {
        var te = doc.Objects.AddText(content, pl, size, face, bold, italics);
        var txt = doc.Objects.Find(te) as Rhino.DocObjects.TextObject;

        if(txt != null)
        {
          var tt = txt.Geometry as Rhino.Geometry.TextEntity;
          A = tt.Explode();
        }
      }
    }
# ---------- end c_script_2 ----------

# ---- group: RH_OUT:edge_curves
curve_3 = Curve(deconstruct_brep.Edges)

# ----
stream_filter_7 = StreamFilter(Gate=rh_in_colourtype, Stream0="heat", Stream1="rainbow", Stream2="red")
stream_filter_8 = StreamFilter(Gate=rh_in_colourtype, Stream0="curvature", Stream1="x-axis", Stream2="scattered")

# ---- group: RH_OUT:curve_path
curve_path = Curve(stream_filter_4)

# ---- group: RH_OUT:curve_arcs
curve_arcs = Curve(stream_filter_5)

# ----
area_3 = Area(Geometry=loft)  # -> Area, Centroid
offset_mesh = OffsetMesh(Mesh=graft_tree, Distance=Slider(0.2, range=0..1), BothSides=0, CreateSolid=True)
length = Length(Curve=interpolate.Curve)
list_length_2 = ListLength(List=flatten(list_item_3))
stream_filter_9 = StreamFilter(Gate=rh_in_showgroupnumbers, Stream1=c_script_2.A)
c_script_3 = CSharpScript(mesh=simplify(offset_mesh), color=list_item_3)  # -> out, A; inputs mesh: Mesh, color: Color
# ---------- c_script_3: C# ----------
    var c = color.R + "," + color.G + "," + color.B;
    mesh.SetUserString("color", c);
    A = mesh;
# ---------- end c_script_3 ----------
integer = Integer(area_3.Area)
integer_2 = Integer(flatten(length))

# ---- group: RH_OUT:colour_gradient
data_2 = Data(flatten(stream_filter_7))

# ---- group: RH_OUT:panel_type
data_3 = Data(flatten(stream_filter_6))

# ---- group: RH_OUT:grouping_type
data_4 = Data(flatten(stream_filter_8))

# ----
integer_3 = Integer(rh_in_paneltypenumber)
integer_4 = Integer(list_length_2)
mesh_colours_2 = MeshColours(Mesh=graft_tree, Colours=list_item_3)

# ---- group: RH_OUT:sky_visibility_area
data_5 = Data(flatten(integer))

# ----
colour_gradient = Panel(data_2)

# ---- group: RH_OUT:central_path_length
data_6 = Data(flatten(integer_2))

# ----
panel_type = Panel(data_3)

# ---- group: RH_OUT:panel_group_numbers
curve_4 = Curve(stream_filter_9)

# ----
grouping_type = Panel(data_4)

# ---- group: RH_OUT:panel_type_number
data_7 = Data(flatten(integer_3))

# ---- group: RH_OUT:panel_number
data_8 = Data(flatten(integer_4))

# ----
sky_visibility_area = Panel(data_5)
stream_filter_10 = StreamFilter(Gate=rh_in_showcolour, Stream1=c_script_3.A)
central_path_length = Panel(data_6)
panel_type_number = Panel(data_7)
panel_number = Panel(data_8)

# ---- group: RH_OUT:colour
# DATA
mesh_3 = Mesh(stream_filter_10)
