# Grasshopper definition skyglazer prototype.gh (Grasshopper 1.0.7)
# plug-ins: LunchBox, Pufferfish

# 10% increments
# 10% increments
panel = Panel("""heat
rainbow
red""")
# 5% increments
panel_2 = Panel("""Curvature
X axis
Scattered""")

# ---- group: RH_IN:panelGroupingType
number_slider = Slider(2, range=0..2)

# ---- group: RH_IN:siteWidth
# SITE
site_width = Slider(10, range=0..20)

# ---- group: RH_IN:randomSeed
# FEELING LUCKY!
# Design Randomizer (if points are controlled, set-up of points would need to change)
number_slider_2 = Slider(49, range=0..100)

# ---- group: RH_IN:siteLength
# Site boundaries for design (conflict with manual point control?)
site_length = Slider(58, range=0..100)

# ---- group: RH_IN:panelTypeNumber
# COLOURING
number_slider_3 = Slider(14, range=0..100)

# ---- group: RH_IN:uDivisions
number_slider_4 = Slider(91, range=0..100)

# ---- group: RH_IN:vDivisions
# GROUPING
number_slider_5 = Slider(7, range=0..100)

# ---- group: RH_IN:arcRadius1
# Arcs for roof form loft
# ARCS
number_slider_6 = Slider(4, range=0..10)

# ---- group: RH_IN:arcRadius2
number_slider_7 = Slider(3, range=0..10)

# ---- group: RH_IN:RH_IN:arcRadius3
number_slider_8 = Slider(1, range=0..10)

# ---- group: RH_IN:RH_IN:arcRadius4
# Various panelization options for roof
number_slider_9 = Slider(10, range=0..10)

# ---- group: RH_IN:panelColour
number_slider_10 = Slider(1, range=0..2)

# ---- group: RH_IN:panelType
# PANELIZATION
# Quad Panels
# Triangular Panels
# Diamond Panels
number_slider_11 = Slider(2, range=0..2)

# ---- group: RH_IN:showColour
# Colouring of panel types
boolean_toggle = BooleanToggle(True)

# ---- group: RH_IN:showGroupNumbers
# Grouping of panel types
boolean_toggle_2 = BooleanToggle(False)

# ----
rectangle = Rectangle(Plane=PlaneXY(0, 0, 0), XSize=site_width, YSize=site_length, Radius=0)  # -> Rectangle, Length
stream_filter = StreamFilter(Gate=number_slider_10, Stream0="heat", Stream1="rainbow", Stream2="red")
stream_filter_2 = StreamFilter(Gate=number_slider_11, Stream0="Quad Panels", Stream1="Triangular Panels", Stream2="Diamond Panels")
explode = Explode(Curve=rectangle.Rectangle, Recursive=True)  # -> Segments, Vertices
populate_2d = Populate2D(Region=rectangle.Rectangle, Count=Slider(4, range=0..10), Seed=number_slider_2)
# Points for manual transformation (may overrive other controls so will be omitted)
curve_control_points = Point(populate_2d)
points = GetPoint(curve_control_points, AtLeast=1, AtMost=2147483647, Realtime=True)
list_item = ListItem(List=explode.Segments, Index=1, Wrap=True)
sort_along_curve = SortAlongCurve(Points=points, Curve=list_item)  # -> Points, Indices
interpolate = Interpolate(Vertices=sort_along_curve.Points, Degree=3, Periodic=False, KnotStyle=1)  # -> Curve, Length, Domain
curve_closest_point = CurveClosestPoint(Point=points, Curve=interpolate.Curve)  # -> Point, Parameter, Distance
curve = Curve(interpolate.Curve)
divide_curve = DivideCurve(Curve=curve, Count=10, Kinks=False)  # -> Points, Tangents, Parameters
length = Length(Curve=interpolate.Curve)
perp_frame = PerpFrame(Curve=interpolate.Curve, Parameter=curve_closest_point.Parameter)
sort_along_curve_2 = SortAlongCurve(Points=perp_frame, Curve=interpolate.Curve)  # -> Points, Indices
merge = Merge(Data1=number_slider_6, Data2=number_slider_7, Data3=number_slider_8, Data4=number_slider_9)
number_slider_12 = Slider(4, range=0..10)
deconstruct_plane = DeconstructPlane(Plane=sort_along_curve_2.Points)  # -> Origin, XAxis, YAxis, ZAxis
panel_3 = Panel(merge)
data = Data(panel_3)
negative = Negative(Value=data)
line_sdl = LineSDL(Start=sort_along_curve_2.Points, Direction=deconstruct_plane.XAxis, Length=data)  # -> flatten(Line)
line_sdl_2 = LineSDL(Start=sort_along_curve_2.Points, Direction=deconstruct_plane.XAxis, Length=negative)  # -> flatten(Line)
end_points = EndPoints(Curve=line_sdl)  # -> Start, End
end_points_2 = EndPoints(Curve=line_sdl_2)  # -> Start, End
join_curves = JoinCurves(Curves=[line_sdl_2, line_sdl], Preserve=False)
interpolate_2 = Interpolate(Vertices=end_points_2.End, Degree=3, Periodic=False, KnotStyle=1)  # -> Curve, Length, Domain
interpolate_3 = Interpolate(Vertices=end_points.End, Degree=3, Periodic=False, KnotStyle=1)  # -> Curve, Length, Domain
end_points_3 = EndPoints(Curve=interpolate_2.Curve)  # -> Start, End
end_points_4 = EndPoints(Curve=interpolate_3.Curve)  # -> Start, End
bounding_box = BoundingBox(Content=[interpolate_3.Curve, interpolate_2.Curve], Plane=PlaneXY(0, 0, 0), UnionBox=True)  # -> Box, Box_2
area = Area(Geometry=bounding_box.Box)  # -> Area, Centroid
scale_nu = ScaleNU(Geometry=bounding_box.Box, Plane=area.Centroid, ScaleX=Slider(1.5, range=0..10), ScaleY=1, ScaleZ=1)  # -> Geometry, Transform
line = Line(StartPoint=end_points_4.End, EndPoint=end_points_3.End)
line_2 = Line(StartPoint=end_points_4.Start, EndPoint=end_points_3.Start)
deconstruct_brep = DeconstructBrep(Brep=scale_nu.Geometry)  # -> Faces, Edges, Vertices
join_curves_2 = JoinCurves(Curves=[interpolate_3.Curve, interpolate_2.Curve, line_2, line], Preserve=False)
list_item_2 = ListItem(List=deconstruct_brep.Faces, Index=0, Wrap=True)
split_brep = SplitBrep(Brep=list_item_2, Cutter=join_curves_2)
list_item_3 = ListItem(List=split_brep, Index=0, Wrap=True)  # -> Item, Item1, Item2
end_points_5 = EndPoints(Curve=join_curves)  # -> Start, End
xz_plane = XZPlane(Origin=Point(0, 0, 0))
c_script = CSharpScript(plane=xz_plane, start=end_points_5.Start, end=end_points_5.End, radius=data)  # -> out, A, B, C, D; inputs plane: Plane, start: Point3d, end: Point3d, radius: Double
# ---------- c_script: C# ----------
    var line = new Line(start, end);
    var vec = Vector3d.CrossProduct(line.Direction, plane.ZAxis);
    vec.Unitize();
    var d = Math.Sqrt(Math.Pow(radius, 2.0) - Math.Pow(line.Length, 2.0) / 4.0);
    A = new Arc(start, line.PointAt(0.5) + vec * (radius - d), end);
    B = new Arc(start, line.PointAt(0.5) - vec * (radius - d), end);
    C = new Arc(start, line.PointAt(0.5) + vec * (radius + d), end);
    D = new Arc(start, line.PointAt(0.5) - vec * (radius + d), end);
# ---------- end c_script ----------
end_points_6 = EndPoints(Curve=c_script.B)  # -> Start, End
custom_preview = CustomPreview(
    Geometry=c_script.B,
    Material=[{diffuse=RGB(0, 128, 0), emission=RGB(0, 38, 0), shine=0.5, specular=RGB(255, 255, 255), transparency=0}, {diffuse=RGB(191, 223, 0), emission=RGB(57, 67, 0), shine=0.5, specular=RGB(255, 255, 255), transparency=0}, {diffuse=RGB(255, 191, 0), emission=RGB(76, 57, 0), shine=0.5, specular=RGB(255, 255, 255), transparency=0}, {diffuse=RGB(255, 0, 0), emission=RGB(76, 0, 0), shine=0.5, specular=RGB(255, 255, 255), transparency=0}])
plane = Plane(perp_frame)
line_3 = Line(StartPoint=end_points_6.Start, EndPoint=end_points_6.End)
yz_plane = YZPlane(Origin=c_script.B)
curve_middle = CurveMiddle(Curve=line_3)
rotate_3d = Rotate3D(Geometry=c_script.B, Angle=expr("-x", degrees(Slider(0, range=0..100))), Center=curve_middle, Axis=plane)  # -> flatten(Geometry), Transform
custom_preview_2 = CustomPreview(
    Geometry=rotate_3d.Geometry,
    Material={diffuse=RGB(221, 160, 221), emission=RGB(66, 48, 66), shine=0.5, specular=RGB(255, 255, 255), transparency=0})
clean_tree = CleanTree(RemoveNulls=True, RemoveInvalid=True, RemoveEmpty=False, Tree=rotate_3d.Geometry)
cull_index = CullIndex(List=clean_tree, Indices="0", Wrap=True)
sweep2 = Sweep2(Rail1=interpolate_3.Curve, Rail2=interpolate_2.Curve, Sections=clean_tree, SameHeight=False)
area_2 = Area(Geometry=sweep2)  # -> Area, Centroid
stream_gate = StreamGate(Stream=sweep2, Gate=number_slider_11)  # -> Target0, Target1, Target2
quad_panels = QuadPanels(Surface=stream_gate.Target0, UDivisions=number_slider_4, VDivisions=number_slider_5)
diamond_panels = DiamondPanels(Surface=stream_gate.Target2, UDivisions=number_slider_4, VDivisions=number_slider_5)  # -> DiamondPanels, TriPanels
triangular_panels_a = TriangularPanelsA(Surface=stream_gate.Target1, UDivisions=number_slider_4, VDivisions=number_slider_5)
surface = Surface(graft([triangular_panels_a, quad_panels, diamond_panels.DiamondPanels, diamond_panels.TriPanels]))
mesh = Mesh(graft([quad_panels, triangular_panels_a, diamond_panels.DiamondPanels, diamond_panels.TriPanels]))
mesh_2 = Mesh(mesh)
graft_tree = GraftTree(Tree=mesh_2, IncludeEmptyLists=True, IncludeNullItems=True)
area_3 = Area(Geometry=graft_tree)  # -> Area, Centroid
surface_closest_point = SurfaceClosestPoint(Point=area_3.Centroid, Surface=surface)  # -> Point, UVPoint, Distance
construct_domain = ConstructDomain(DomainStart=0, DomainEnd=1)
no_of_divisions = Panel(number_slider_3)
principal_curvature = PrincipalCurvature(Surface=sweep2, Point=surface_closest_point.UVPoint)  # -> Frame, Maximum, Minimum, MaxDirection, MinDirection
deconstruct = Deconstruct(Point=area_3.Centroid)  # -> XComponent, YComponent, ZComponent
range = Range(Domain=construct_domain, Steps=no_of_divisions)
divide_domain = DivideDomain(Domain=construct_domain, Count=no_of_divisions)
bounds = Bounds(Numbers=flatten(deconstruct.YComponent))
list_length = ListLength(List=flatten(area_3.Centroid))
multiplication = Multiplication(A=principal_curvature.Maximum, B=principal_curvature.Minimum)
bounds_2 = Bounds(Numbers=flatten(multiplication))
deconstruct_domain = DeconstructDomain(Domain=construct_domain)  # -> Start, End
list_item_4 = ListItem(List=range, Index=0, Wrap=True)  # -> Item, Item1
construct_domain_2 = ConstructDomain(DomainStart=0, DomainEnd=1)
subtraction = Subtraction(A=list_item_4.Item1, B=list_item_4.Item)
remap_numbers = RemapNumbers(Value=multiplication, Source=bounds_2, Target=Domain(0, 1))  # -> Mapped, Clipped
random = Random(Range=construct_domain_2, Number=list_length, Seed=2)  # -> graft(Random)
remap_numbers_2 = RemapNumbers(Value=deconstruct.YComponent, Source=bounds, Target=construct_domain)  # -> Mapped, Clipped
division = Division(A=subtraction, B="2")
addition = Addition(A=range, B=division)
last_index = LastIndex(List=addition)
stream_filter_3 = StreamFilter(Gate=number_slider, Stream0=remap_numbers.Mapped, Stream1=remap_numbers_2.Mapped, Stream2=random)
includes = Includes(Value=stream_filter_3, Domain=divide_domain)  # -> Includes, Deviation
cull_index_2 = CullIndex(List=addition, Indices=last_index, Wrap=True)
gradient = Gradient(
    LowerLimit=deconstruct_domain.Start,
    UpperLimit=deconstruct_domain.End,
    Parameter=cull_index_2,
    stops=[0.15: RGB(255, 130, 160), 0.85: RGB(220, 0, 40)])
gradient_2 = Gradient(
    LowerLimit=deconstruct_domain.Start,
    UpperLimit=deconstruct_domain.End,
    Parameter=cull_index_2,
    stops=[0: RGB(243, 57, 0), 0.1: RGB(236, 27, 60), 0.2: RGB(210, 0, 118), 0.3: RGB(103, 0, 120), 0.4: RGB(39, 72, 161), 0.5: RGB(1, 192, 229), 0.6: RGB(18, 178, 90), 0.7: RGB(79, 186, 8), 0.8: RGB(220, 237, 32), 0.9: RGB(247, 159, 20), 1: RGB(243, 57, 0)])
gradient_3 = Gradient(
    LowerLimit=deconstruct_domain.Start,
    UpperLimit=deconstruct_domain.End,
    Parameter=cull_index_2,
    stops=[0: RGB(234, 38, 0), 0.25: RGB(234, 126, 0), 0.5: RGB(254, 244, 84), 0.75: RGB(173, 203, 249), 1: RGB(75, 107, 169)])
member_index = MemberIndex(Set=includes.Includes, Member=Toggle(True))  # -> Index, Count
stream_filter_4 = StreamFilter(Gate=number_slider_10, Stream0=gradient_3, Stream1=gradient_2, Stream2=gradient)
mesh_3 = Data(simplify(flatten(graft_tree)))
list_item_5 = ListItem(List=stream_filter_4, Index=member_index.Index, Wrap=True)  # -> simplify(Item)
colours = Data(flatten(list_item_5))
member_index_2 = MemberIndex(Set=flatten(list_item_5), Member=stream_filter_4)  # -> Index, Count
create_set = CreateSet(List=colours)  # -> Set, Map
member_index_3 = MemberIndex(Set=colours, Member=create_set.Set)  # -> Index, Count
panel_4 = Panel(member_index_3.Index)
panel_5 = Panel(create_set.Set)
list_item_organised_colours = ListItem(List=colours, Index=member_index_3.Index, Wrap=True)
list_item_organised_meshes = ListItem(List=mesh_3, Index=member_index_3.Index, Wrap=True)
list_indices = ListIndices(List=create_set.Set)
graft_tree_2 = GraftTree(Tree=list_indices, IncludeEmptyLists=True, IncludeNullItems=True)
area_4 = Area(Geometry=list_item_organised_meshes)  # -> Area, Centroid
x_plus_one = XPlusOne(NumberX=graft_tree_2)
param_viewer = ParamViewer(area_4.Centroid)
param_viewer_2 = ParamViewer(x_plus_one)
list_length_2 = ListLength(List=flatten(list_item_5))
mesh_edges = MeshEdges(Mesh=graft_tree)  # -> NakedEdges, InteriorEdges, NonManifoldEdges
mesh_colours = MeshColours(Mesh=graft_tree, Colours=list_item_5)
integer = Integer(area_2.Area)
integer_2 = Integer(flatten(length))
integer_3 = Integer(number_slider_3)
integer_4 = Integer(list_length_2)
stream_filter_5 = StreamFilter(Gate=boolean_toggle, Stream1=mesh_colours)
central_path_length = Panel(integer_2)
panel_number = Panel(integer_4)
# DATA OUTPUT
sky_visibility_area = Panel(integer)
panel_type_number = Panel(integer_3)
panel_type = Panel(stream_filter_2)
colour_gradient = Panel(stream_filter)
c_script_2 = CSharpScript(face="Arial", bold=Toggle(False), size=Slider(0.781, range=0..11), content=x_plus_one, pl=area_4.Centroid)  # -> out, A; inputs face: String, bold: Boolean, italics: Boolean, size: Double, content: String, pl: Plane
# ---------- c_script_2: C# usings ----------
using System.IO;
using System.Linq;
using System.Data;
using System.Drawing;
using System.Reflection;
using System.Windows.Forms;
using System.Xml;
using System.Xml.Linq;
using System.Runtime.InteropServices;

using Rhino.DocObjects;
using Rhino.Collections;
using GH_IO;
using GH_IO.Serialization;
# ---------- c_script_2: C# ----------
    if(size == 0)
      size = 1;

    if(!string.IsNullOrEmpty(face) && size > 0 && !string.IsNullOrEmpty(content) &&
      pl.IsValid)
    {
      using (var doc = Rhino.RhinoDoc.CreateHeadless(null))
      {
        var te = doc.Objects.AddText(content, pl, size, face, bold, italics);
        var txt = doc.Objects.Find(te) as Rhino.DocObjects.TextObject;

        if(txt != null)
        {
          var tt = txt.Geometry as Rhino.Geometry.TextEntity;
          A = tt.Explode();
        }
      }
    }
# ---------- end c_script_2 ----------
stream_filter_6 = StreamFilter(Gate=boolean_toggle_2, Stream1=c_script_2.A)

# ---- group: RH_OUT:edge_curves
# GEOMETRY OUTPUT
curve_2 = Curve(mesh_edges.NakedEdges)

# ----
custom_preview_3 = CustomPreview(Geometry=curve_2, Material=ColourSwatch(SwatchColor=RGB(0, 187, 255)))

# ---- group: RH_OUT:curvature_analysis
mesh_4 = Mesh(stream_filter_5)

# ---- group: RH_OUT:panel_group_numbers
curve_3 = Curve(stream_filter_6)
