# Grasshopper definition workstationv5.gh (Grasshopper 1.0.7)
# plug-ins: Pufferfish, EleFront

hexagonal = Hexagonal(
    Plane=PlaneXY(0, 0, 0),
    Size=Slider(2000, range=0..2000),
    ExtentX=Slider(1, range=0..100),
    ExtentY=Slider(1, range=0..10))  # -> Cells, Points
point = Point(hexagonal.Points)
explode = Explode(Curve=hexagonal.Cells, Recursive=True)  # -> Segments, Vertices

# ---- group: RH_IN:level
number_slider = Slider(0, range=0..3)

# ----
dispatch = Dispatch(List=explode.Segments, DispatchPattern=[True, False])  # -> ListA, ListB
curve = Curve(reparameterize(dispatch.ListA))
perp_frame = PerpFrame(Curve=curve, Parameter=".5")
curve_2 = Curve(reparameterize(dispatch.ListB))
deconstruct_plane = DeconstructPlane(Plane=perp_frame)  # -> Origin, XAxis, YAxis, ZAxis
perp_frame_2 = PerpFrame(Curve=curve_2, Parameter=".5")
construct_plane = ConstructPlane(Origin=deconstruct_plane.Origin, XAxis=deconstruct_plane.ZAxis, YAxis=deconstruct_plane.XAxis)
mirror = Mirror(Geometry=hexagonal.Cells, Plane=construct_plane)  # -> Geometry, Transform
deconstruct_plane_2 = DeconstructPlane(Plane=perp_frame_2)  # -> Origin, XAxis, YAxis, ZAxis
stream_filter = StreamFilter(Gate=number_slider, Stream1=mirror.Geometry, Stream2=mirror.Geometry, Stream3=mirror.Geometry)
flip_curve = FlipCurve(Curve=hexagonal.Cells)  # -> Curve, Flag
construct_plane_2 = ConstructPlane(Origin=deconstruct_plane_2.Origin, XAxis=deconstruct_plane_2.ZAxis, YAxis=deconstruct_plane_2.XAxis)
merge = Merge(Data1=hexagonal.Cells, Data2=stream_filter)  # -> flatten(Result)
explode_2 = Explode(Curve=merge, Recursive=True)  # -> simplify(Segments), Vertices
mirror_2 = Mirror(Geometry=hexagonal.Cells, Plane=construct_plane_2)  # -> Geometry, Transform
curve_3 = Curve([mirror.Geometry, mirror_2.Geometry, flip_curve.Curve])
split_tree = SplitTree(Data=explode_2.Segments, Masks=flatten("{0}"))  # -> Positive, Negative
join_curves = JoinCurves(Curves=split_tree.Negative, Preserve=False)
curve_middle = CurveMiddle(Curve=split_tree.Negative)
explode_3 = Explode(Curve=[mirror_2.Geometry, mirror.Geometry], Recursive=True)  # -> Segments, Vertices
join_curves_2 = JoinCurves(Curves=split_tree.Positive, Preserve=False)
curve_middle_2 = CurveMiddle(Curve=split_tree.Positive)
polygon_center = PolygonCenter(Polyline=join_curves)  # -> CenterV, CenterE, CenterA
shift_list = ShiftList(List=curve_middle, Shift=1, Wrap=True)
curve_middle_3 = CurveMiddle(Curve=explode_3.Segments)
distance = Distance(PointA=point, PointB=curve_middle_3)
dispatch_2 = Dispatch(List=shift_list, DispatchPattern=invert([True, False]))  # -> ListA, ListB
polygon_center_2 = PolygonCenter(Polyline=join_curves_2)  # -> CenterV, CenterE, CenterA
dispatch_3 = Dispatch(List=curve_middle_2, DispatchPattern=[True, False])  # -> ListA, ListB
sort_list = SortList(Keys=distance, ValuesValuesA=explode_3.Segments)  # -> Keys, ValuesValuesA
line = Line(StartPoint=dispatch_2.ListA, EndPoint=polygon_center.CenterV)
curve_4 = Curve(sort_list.ValuesValuesA)
number_slider_2 = Slider(500, range=0..500)
line_2 = Line(StartPoint=dispatch_3.ListA, EndPoint=polygon_center_2.CenterV)
merge_2 = Merge(Data1=line_2, Data2=line)
list_item = ListItem(List=curve_4, Index=[Slider(10, range=0..10), Slider(9, range=0..10)], Wrap=True)  # -> flatten(Item)
negative = Negative(Value=number_slider_2)
offset_curve = OffsetCurve(Curve=merge_2, Plane=PlaneXY(0, 0, 0), Distance=number_slider_2, BothSides=negative, Kinks=0, CapType=1)
join_curves_3 = JoinCurves(Curves=list_item, Preserve=False)
close_curve = CloseCurve(Curve=join_curves_3, CloseType=0, Bulge=0.5, Tolerance=0)  # -> Closed, ResultBoolean
flip_curve_2 = FlipCurve(Curve=close_curve.Closed)  # -> Curve, Flag
unflatten_tree = UnflattenTree(Tree=offset_curve, Guide=merge_2)
merge_3 = Merge(Data1=flip_curve_2.Curve, Data2=curve_3)  # -> flatten(Result)
region_union = RegionUnion(Curves=unflatten_tree)
number_slider_3 = Slider(50, range=0..300)
fillet = Fillet(Curve=region_union, Radius=Slider(1000, range=0..1000))
number_slider_4 = Slider(50, range=0..300)
unit_z = UnitZ(Factor=number_slider_3)
# FLOOR HEIGHT
number_slider_5 = Slider(2500, range=0..3000)
negative_2 = Negative(Value=number_slider_4)
offset_curve_2 = OffsetCurve(Curve=fillet, Distance=negative_2, Corners=1)
series = Series(Start=0, Step=number_slider_5, Count=Slider(1, range=0..10))
move = Move(Geometry=fillet, Motion=unit_z)  # -> Geometry, Transform
unit_z_2 = UnitZ(Factor=series)
move_2 = Move(Geometry=move.Geometry, Motion=unit_z_2)  # -> Geometry, Transform
unit_z_3 = UnitZ(Factor=number_slider_5)
curve_5 = Curve(move.Geometry)
move_3 = Move(Geometry=curve_5, Motion=unit_z_3)  # -> Geometry, Transform
first_floor_workstation_top = Data(move_3.Geometry)
unit_z_4 = UnitZ(Factor=number_slider_3)
move_4 = Move(Geometry=first_floor_workstation_top, Motion=unit_z_4)  # -> Geometry, Transform
addition = Addition(A=number_slider_4, B=number_slider_5)
curve_6 = Curve(move.Geometry)
# move up floors!
unit_z_5 = UnitZ(Factor=addition)
extrude = Extrude(Base=move_2.Geometry, Direction=unit_z_3)
divide_curve = DivideCurve(Curve=curve_6, Count=Slider(12, range=0..100), Kinks=False)  # -> Points, Tangents, Parameters
dispatch_4 = Dispatch(List=divide_curve.Points, DispatchPattern=[True, False])  # -> ListA, ListB
move_5 = Move(Geometry=extrude, Motion=Vector(0, 0, 10))  # -> Geometry, Transform
point_2 = Point(dispatch_4.ListB)
curve_closest_point = CurveClosestPoint(Point=point_2, Curve=curve_6)  # -> Point, Parameter, Distance
explode_4 = Explode(Curve=mirror_2.Geometry, Recursive=True)  # -> Segments, Vertices
shatter = Shatter(Curve=curve_6, Parameters=curve_closest_point.Parameter)
first_floor_level = Data(move_4.Geometry)
curve_middle_4 = CurveMiddle(Curve=explode_4.Segments)
unit_z_6 = UnitZ(Factor=Slider(1000, range=0..1000))
dispatch_5 = Dispatch(List=shatter, DispatchPattern=[True, False])  # -> ListA, ListB
curve_7 = Curve(dispatch_5.ListA)
circle_fit = CircleFit(Points=curve_middle_4)  # -> Circle, Radius, Deviation
number_slider_6 = Slider(5, range=0..150)
negative_3 = Negative(Value=Slider(500, range=0..1000))
move_6 = Move(Geometry=curve_7, Motion=unit_z_6)  # -> Geometry, Transform
offset_curve_3 = OffsetCurve(Curve=circle_fit.Circle, Distance=negative_3, Corners=1)
ground_central_zone = Data(graft(merge_3))
extend_curve = ExtendCurve(Curve=move_6.Geometry, Type=0, Start=number_slider_6, End=number_slider_6)
unit_z_7 = UnitZ(Factor=Slider(1, range=0..1))
close_curve_2 = CloseCurve(Curve=extend_curve, CloseType=0, Bulge=0.5, Tolerance=0)  # -> Closed, ResultBoolean
move_7 = Move(Geometry=offset_curve_3, Motion=unit_z_7)  # -> Geometry, Transform
first_floor_level_2 = Data(first_floor_level)
# GROUND FLOOR
explode_5 = Explode(Curve=ground_central_zone, Recursive=True)  # -> Segments, Vertices
ground_workstation = Data(offset_curve_2)
addition_2 = Addition(A=number_slider_5, B=number_slider_4, C=number_slider_4)
desk_curves = Data(close_curve_2.Closed)
panel = Panel(addition_2)
first_floor_level_3 = Data(addition_2)
crv = Curve(flatten(explode_5.Segments))
discontinuity = Discontinuity(Curve=crv, Level=1)  # -> Points, Parameters
panel_2 = Panel("First Floor")
join_curves_4 = JoinCurves(Curves=crv, Preserve=False)
offset_curve_4 = OffsetCurve(Curve=join_curves_4, Plane=PlaneXY(0, 0, 0), Distance=Slider(24, range=0..100), BothSides=0, Kinks=0, CapType="0")
unit_z_8 = UnitZ(Factor=first_floor_level_3)
divide_domain² = DivideDomain²(Domain=move_5.Geometry, UCount="4", VCount="12")
cap_holes = CapHoles(Brep=move_5.Geometry)
isotrim = Isotrim(Surface=move_5.Geometry, Domain=divide_domain²)
panel_3 = Panel("""True
False
False
True""")
dispatch_6 = Dispatch(List=isotrim, DispatchPattern=panel_3)  # -> ListA, ListB
divide_domain²_2 = DivideDomain²(Domain=move_5.Geometry, UCount="10", VCount="24")
isotrim_2 = Isotrim(Surface=move_5.Geometry, Domain=divide_domain²_2)
panel_4 = Panel("""True
True
False
False
False
False
True
True""")
dispatch_7 = Dispatch(List=isotrim_2, DispatchPattern=panel_4)  # -> ListA, ListB
panel_5 = Panel("""True
False
False
True""")
dispatch_8 = Dispatch(List=dispatch_7.ListB, DispatchPattern=panel_5)  # -> ListA, ListB
curved_mdle = Surface(dispatch_8.ListB)
straight_mdle = Surface(dispatch_8.ListA)
surface = Surface(simplify(dispatch_7.ListB))
series_2 = Series(Start="48", Step=1, Count="12")
series_3 = Series(Start="48", Step=1, Count="36")
list_item_2 = ListItem(List=surface, Index=series_2, Wrap=True)
cull_index = CullIndex(List=surface, Indices=series_3, Wrap=True)
surface_2 = Surface(cull_index)
surface_3 = Surface(list_item_2)
surface_4 = Surface(reparameterize(surface_3))
construct_domain² = ConstructDomain²(
    UMin=Slider(0.03, range=0..1),
    UMax=Slider(0.97, range=0..1),
    VMin=Slider(0.03, range=0..1),
    VMax=Slider(0.97, range=0..1))
number_slider_7 = Slider(10, range=0..100)
number_slider_8 = Slider(70, range=0..100)
isotrim_3 = Isotrim(Surface=surface_4, Domain=construct_domain²)
construct_domain²_2 = ConstructDomain²(
    UMin=Slider(0.03, range=0..1),
    UMax=Slider(0.97, range=0..1),
    VMin=Slider(0.03, range=0..1),
    VMax=Slider(0.97, range=0..1))
surface_5 = Surface(reparameterize(surface_2))
boolean_toggle = BooleanToggle(True)
negative_4 = Negative(Value=number_slider_7)
negative_5 = Negative(Value=number_slider_8)
isotrim_4 = Isotrim(Surface=surface_5, Domain=construct_domain²_2)
panel_6 = Panel("""30
31
32
33
34
35
36
37
38
39
40
41""")
offset_surface = OffsetSurface(Surface=surface_4, Distance=number_slider_7, BothSides=boolean_toggle, CreateSolid=True)
offset_surface_2 = OffsetSurface(Surface=isotrim_3, Distance=number_slider_8, BothSides=boolean_toggle, CreateSolid=True)
# SCREEN
list_item_3 = ListItem(List=curved_mdle, Index=panel_6, Wrap=True)
list_item_4 = ListItem(List=straight_mdle, Index=panel_6, Wrap=True)
merge_4 = Merge(Data1=list_item_3, Data2=list_item_4)
deconstruct_brep = DeconstructBrep(Brep=merge_4)  # -> Faces, Edges, simplify(Vertices)
solid_difference = SolidDifference(BrepsA=offset_surface, BrepsB=offset_surface_2)
unit_z_9 = UnitZ(Factor="1000")
mesh_colours = MeshColours(Mesh=solid_difference, Colours=ColourSwatch(SwatchColor=RGB(0, 255, 25)))
surface_6 = Surface(first_floor_level_2)
surface_7 = Surface(move_7.Geometry)
offset_surface_3 = OffsetSurface(Surface=isotrim_4, Distance=Slider(11, range=0..100), BothSides=0, CreateSolid=True)
negative_6 = Negative(Value=number_slider_3)
move_8 = Move(Geometry=surface_7, Motion=unit_z_9)  # -> Geometry, Transform
curve_8 = Curve(move.Geometry)
offset_surface_4 = OffsetSurface(Surface=surface_6, Distance=negative_6, BothSides=0, CreateSolid=True)
offset_surface_5 = OffsetSurface(Surface=move_8.Geometry, Distance="25", BothSides=0, CreateSolid=True)
extrude_2 = Extrude(Base=offset_curve_2, Direction=unit_z_8)
brep_join = BrepJoin(Breps=merge_4)  # -> Breps, Closed
unit_z_10 = UnitZ(Factor=number_slider_5)
extrude_3 = Extrude(Base=curve_8, Direction=unit_z_10)
concatenate = Concatenate(Fragment_A="Workstation", Fragment_B="::", A="central table")
offset_surface_6 = OffsetSurface(Surface=brep_join.Breps, Distance=Slider(20, range=0..100), BothSides=0, CreateSolid=True)
negative_7 = Negative(Value=Slider(100, range=0..100))
surface_8 = Surface(ground_workstation)
negative_8 = Negative(Value=number_slider_3)
define_object_attributes = DefineObjectAttributes(Layer=concatenate, Color=ColourSwatch(SwatchColor=RGB(151, 222, 240)))
mesh_colours_2 = MeshColours(Mesh=offset_surface_3, Colours=ColourSwatch(SwatchColor=RGB(104, 176, 204)))
cap_holes_2 = CapHoles(Brep=extrude_2)
surface_9 = Surface(offset_curve_4)
offset_surface_7 = OffsetSurface(Surface=extrude_3, Distance=negative_7, BothSides=0, CreateSolid=True)
concatenate_2 = Concatenate(Fragment_A="Workstation", Fragment_B="::", A="first floor")
surface_10 = Surface(ground_central_zone)
offset_surface_8 = OffsetSurface(Surface=surface_8, Distance=negative_8, BothSides=0, CreateSolid=True)
mesh_colours_3 = MeshColours(Mesh=offset_surface_6, Colours=ColourSwatch(SwatchColor=RGB(0, 38, 255)))
offset_surface_9 = OffsetSurface(Surface=surface_9, Distance=Slider(10, range=0..100), BothSides=0, CreateSolid=True)
concatenate_3 = Concatenate(Fragment_A="Workstation", Fragment_B="::", A="Floor")
define_object_attributes_2 = DefineObjectAttributes(Layer=concatenate_2, Color=ColourSwatch(SwatchColor=RGB(0, 173, 12)))
concatenate_4 = Concatenate(Fragment_A="Workstation", Fragment_B="::", A="walls")
mesh_colours_4 = MeshColours(Mesh=offset_surface_7, Colours=ColourSwatch(SwatchColor=RGB(224, 224, 224)))
surface_11 = Surface(desk_curves)
split_brep = SplitBrep(Brep=flatten(surface_10), Cutter=flatten(offset_surface_9))
bake_objects = BakeObjects(Geometry=offset_surface_5, Attributes=define_object_attributes, Bake=Toggle(False))
offset_surface_10 = OffsetSurface(Surface=surface_11, Distance=Slider(25, range=0..100), BothSides=0, CreateSolid=True)
concatenate_5 = Concatenate(Fragment_A="Workstation", Fragment_B="::", A="groundfloor")
define_object_attributes_3 = DefineObjectAttributes(Layer=concatenate_4, Color=ColourSwatch(SwatchColor=RGB(255, 0, 0)))
define_object_attributes_4 = DefineObjectAttributes(Layer=concatenate_3, Color=ColourSwatch(SwatchColor=RGB(107, 11, 11)))
surface_12 = Surface(reparameterize(dispatch_6.ListA))
construct_domain²_3 = ConstructDomain²(
    UMin=Slider(0.03, range=0..1),
    UMax=Slider(0.97, range=0..1),
    VMin=Slider(0.03, range=0..1),
    VMax=Slider(0.97, range=0..1))
concatenate_6 = Concatenate(Fragment_A="Workstation", Fragment_B="::", A="Floor lights")
bake_objects_2 = BakeObjects(Geometry=offset_surface_4, Attributes=define_object_attributes_2, Bake=Toggle(False))
isotrim_5 = Isotrim(Surface=surface_12, Domain=construct_domain²_3)
mesh_colours_5 = MeshColours(Mesh=offset_surface_10, Colours=ColourSwatch(SwatchColor=RGB(217, 37, 130)))
define_object_attributes_5 = DefineObjectAttributes(Layer=concatenate_5, Color=ColourSwatch(SwatchColor=RGB(17, 48, 24)))
bake_objects_3 = BakeObjects(Geometry=cap_holes_2, Attributes=define_object_attributes_3, Bake=Toggle(False))
define_object_attributes_6 = DefineObjectAttributes(Layer=concatenate_6, Color=ColourSwatch(SwatchColor=RGB(222, 222, 222)))
bake_objects_4 = BakeObjects(Geometry=offset_surface_9, Attributes=define_object_attributes_4, Bake=Toggle(False))
offset_surface_11 = OffsetSurface(Surface=isotrim_5, Distance=Slider(11, range=0..100), BothSides=0, CreateSolid=True)
bake_objects_5 = BakeObjects(Geometry=offset_surface_8, Attributes=define_object_attributes_5, Bake=Toggle(False))
mesh_colours_6 = MeshColours(Mesh=offset_surface_11, Colours=ColourSwatch(SwatchColor=RGB(6, 148, 25)))
bake_objects_6 = BakeObjects(Geometry=split_brep, Attributes=define_object_attributes_6, Bake=Toggle(False))
brep = Brep(simplify(cap_holes_2))
number_slider_9 = Slider(2600, range=0..10000)
subtraction = Subtraction(A=number_slider, B=Slider(1, range=0..1))
series_4 = Series(Start=number_slider_9, Step=number_slider_9, Count=subtraction)
shift_paths = ShiftPaths(Data=brep, Offset=-1)
unit_z_11 = UnitZ(Factor=series_4)
tree_branch = TreeBranch(Tree=brep, Path="0", MaintainPaths=True)
group = Group(Objects=tree_branch)
move_9 = Move(Geometry=group, Motion=unit_z_11)  # -> Geometry, Transform
ungroup = Ungroup(Group=move_9.Geometry)
merge_5 = Merge(Data1=ungroup, Data2=cap_holes_2)

# ---- group: RH_OUT:mesh
mesh_brep = MeshBrep(
    Brep=merge_5,
    Settings={GridMaxCount=0, GridMinCount=16, JaggedSeams=False, MaxEdgeLength=0, MinEdgeLength=0.0001, MinTolerance=0, Refine=True, RefineAngle=0, RelativeTolerance=0.65, SimplePlanes=True, Tolerance=0})
