# Grasshopper definition PrototypingOrganic04.gh (Grasshopper 1.0.7)
# plug-ins: LunchBox, Pufferfish, LunchBoxML, Kangaroo2 Components, Kangaroo Components

# ---- group: RH_IN:showPeople
boolean_toggle = BooleanToggle(False)

# ---- group: RH_IN:showTerrain
# LAYER OPTIONS
boolean_toggle_2 = BooleanToggle(True)

# ---- group: RH_IN:showTrees
boolean_toggle_3 = BooleanToggle(False)

# ----
# GROUPING
rh_in_showgroupnumbers = GetBoolean(Toggle(False), AtLeast=1, AtMost=1, FalseValue="False", TreeAccess=False, TrueValue="True")
rh_in_paneltypenumber = GetInteger(Slider(6, range=0..100), AtLeast=1, AtMost=1, Maximum=2147483647, Minimum=-2147483648, TreeAccess=False)
rh_in_panelgroupingtype = GetInteger(Slider(2, range=0..2), AtLeast=1, AtMost=1, Maximum=2147483647, Minimum=-2147483648, TreeAccess=False)

# ----
# COLOURING
rh_in_showcolour = GetBoolean(Toggle(False), AtLeast=1, AtMost=1, FalseValue="False", TreeAccess=False, TrueValue="True")
rh_in_colourtype = GetNumber(Slider(0, range=0..2), AtLeast=1, AtMost=1, Maximum=1.797693135e+308, Minimum=-1.797693135e+308, TreeAccess=False)

rh_in_udivisions = GetNumber(Slider(36, range=0..100), AtLeast=1, AtMost=1, Maximum=1.797693135e+308, Minimum=-1.797693135e+308, TreeAccess=False)
rh_in_vdivisions = GetNumber(Slider(26, range=0..100), AtLeast=1, AtMost=1, Maximum=1.797693135e+308, Minimum=-1.797693135e+308, TreeAccess=False)
rh_in_paneltype = GetInteger(Slider(1, range=0..2), AtLeast=1, AtMost=1, Maximum=2147483647, Minimum=-2147483648, TreeAccess=False)

mesh = Mesh(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)
# PANELIZATION
rh_in_showwireframe = GetBoolean(Toggle(True), AtLeast=1, AtMost=1, FalseValue="False", TreeAccess=False, TrueValue="True")

# ----
# FORM
rh_in_showoriginalmesh = GetBoolean(Toggle(False), AtLeast=1, AtMost=1, FalseValue="False", TreeAccess=False, TrueValue="True")
get_geometry = GetGeometry(mesh, AtLeast=1, AtMost=1, DeleteInput=False, Filter=1074004029, TreeAccess=False)

# ----
# GRIDSHELL
rh_in_showgridshellwireframe = GetBoolean(Toggle(True), AtLeast=1, AtMost=1, FalseValue="False", TreeAccess=False, TrueValue="True")
rh_in_showgridshell = GetBoolean(Toggle(True), AtLeast=1, AtMost=1, FalseValue="False", TreeAccess=False, TrueValue="True")
rh_in_gridangle = GetInteger(Slider(0, range=0..360), AtLeast=1, AtMost=1, Maximum=2147483647, Minimum=-2147483648, TreeAccess=False)
rh_in_gridsize = GetInteger(Slider(2, range=1..5), AtLeast=1, AtMost=1, Maximum=2147483647, Minimum=-2147483648, TreeAccess=False)

# ---- group: mesh drappping
mesh_2 = Mesh(get_geometry)
bbox = BoundingBox(Content=mesh_2, Plane=PlaneXY(0, 0, 0))  # -> Box, Box_2
debrep = DeconstructBrep(Brep=bbox.Box)  # -> Faces, Edges, Vertices
area = Area(Geometry=debrep.Faces)  # -> Area, Centroid
pdecon = Deconstruct(Point=area.Centroid)  # -> XComponent, YComponent, ZComponent
sort = SortList(Keys=pdecon.ZComponent, ValuesA=debrep.Faces)  # -> Keys, ValuesA
custom_mesh_settings = SettingsCustom(
    StitchSeams=True,
    SimplePlanes=False,
    Refine=True,
    MinCount=16,
    MaxCount=400,
    AspectRatio=20,
    MaxDistance=0,
    MaxAngle=20,
    MinEdge=rh_in_gridsize,
    MaxEdge=rh_in_gridsize)
item = ListItem(List=sort.ValuesA, Index=0, Wrap=True)
area_2 = Area(Geometry=item)  # -> Area, Centroid
scale = Scale(Geometry=item, Center=area_2.Centroid, Factor=Slider(2.5, range=0..10))  # -> Geometry, Transform
rotate = Rotate(Geometry=scale.Geometry, Angle=degrees(rh_in_gridangle), Plane=PlaneXY(0, 0, 0))  # -> Geometry, Transform
Z = UnitZ(Factor=Slider(22, range=0..100))
mesh_3 = MeshBrep(Brep=rotate.Geometry, Settings=custom_mesh_settings)
mesh_4 = Mesh(mesh_2)
move = Move(Geometry=mesh_3, Motion=Z)  # -> Geometry, Transform
warpweft = WarpWeft(Mesh=move.Geometry)  # -> Warp, Weft, NakedA, NakedB
crv = Curve(warpweft.Weft)
crv_2 = Curve(warpweft.Warp)
join = JoinCurves(Curves=crv, Preserve=False)
join_2 = JoinCurves(Curves=crv_2, Preserve=False)
demesh = DeconstructMesh(Mesh=move.Geometry)  # -> Vertices, Faces, Colours, Normals
mesh_5 = Mesh(move.Geometry)
merge = Merge(Data1=join_2, Data2=join)
Z_2 = UnitZ(Factor=-0.01)
show = Show(G=mesh_5)
load = Load(Point=demesh.Vertices, ForceVector=Z_2)
crv_3 = Curve(flatten(merge))
spc = SolidPointCollide(Points=demesh.Vertices, Solid=mesh_4, Interior=False, Unidirectional=True, Strength=Slider(10, range=0..10))
rod = Rod(Polyline=crv_3, LengthFactor=1, AngleFactor=1, AxialStrength=10, BendStrength=Slider(5, range=0..10))
number_slider = Slider(3000, range=0..10000)
merge_2 = Merge(Data1=rod, Data2=load, Data3=spc)
entwine = Entwine(Branch00=show, Branch01=merge_2, FlattenInputs=True)  # -> simplify(Result)
zombiesolver = ZombieSolver(GoalObjects=entwine, Threshold=1e-10, Tolerance=0.0001, MaxIterations=Slider(5000, range=0..10000))  # -> I, V, O
clean = CleanTree(RemoveNulls=True, RemoveInvalid=True, RemoveEmpty=False, Tree=zombiesolver.O)
objecttypesort = CSharpScript(geo=clean)  # -> out, Pt, Crv, Mesh, Brep, Srf; inputs geo: list of GeometryBase
# ---------- objecttypesort: C# ----------
    List<Rhino.Geometry.Point> Pts = new List<Rhino.Geometry.Point>();
    List<Curve> Crvs = new List<Curve>();
    List<Mesh> Meshes = new List<Mesh>();
    List<Brep> Breps = new List<Brep>();
    List<Brep> Srfs = new List<Brep>();


    foreach(GeometryBase x in geo){
      Rhino.DocObjects.ObjectType objectType = x.ObjectType;
      switch(objectType){
        case Rhino.DocObjects.ObjectType.Point: Pts.Add(x as Rhino.Geometry.Point);
          break;
        case Rhino.DocObjects.ObjectType.Curve: Crvs.Add(x as Curve);
          break;
        case Rhino.DocObjects.ObjectType.Mesh: Meshes.Add(x as Mesh);
          break;
        case Rhino.DocObjects.ObjectType.Brep:
          Brep brepObj = x as Brep;
          if(brepObj.IsSurface){
            Srfs.Add(brepObj);
          } else {
            Breps.Add(brepObj);
          }
          break;


      }
    }
    Pt = Pts;
    Crv = Crvs;
    Mesh = Meshes;
    Brep = Breps;
    Srf = Srfs;
# ---------- end objecttypesort ----------

# ----
mesh_6 = Mesh(objecttypesort.Mesh)
bounding_box = BoundingBox(Content=get_geometry, Plane=PlaneXY(0, 0, 0), UnionBox=True)  # -> Box, Box_2
number_slider_2 = Slider(1.24, range=0..10)
scale_nu = ScaleNU(
    Geometry=bounding_box.Box,
    Plane=PlaneXY(0, 0, 0),
    ScaleX=number_slider_2,
    ScaleY=number_slider_2,
    ScaleZ=number_slider_2)  # -> Geometry, Transform
area_3 = Area(Geometry=scale_nu.Geometry)  # -> Area, Centroid
number_slider_3 = Slider(1.5, range=0..10)
scale_nu_2 = ScaleNU(Geometry=scale_nu.Geometry, Plane=area_3.Centroid, ScaleX=number_slider_3, ScaleY=number_slider_3, ScaleZ=1)  # -> Geometry, Transform
number_slider_4 = Slider(150, range=0..1000)
deconstruct_brep = DeconstructBrep(Brep=scale_nu_2.Geometry)  # -> Faces, Edges, Vertices
list_item = ListItem(List=deconstruct_brep.Faces, Index=0, Wrap=True)  # -> Item, Item1, Item2, Item3, Item4
surface = Surface(list_item.Item4)
scale_2 = Scale(Geometry=surface, Center=Point(0, 0, 0), Factor=Slider(1.3, range=0..10))  # -> Geometry, Transform
number_slider_5 = Slider(3, range=0..10)
mesh_7 = Mesh(scale_nu.Geometry)
area_4 = Area(Geometry=get_geometry)  # -> Area, Centroid
cir = Circle(Plane=area_4.Centroid, Radius=1)
no_of_divisions = Panel(rh_in_paneltypenumber)
construct_domain = ConstructDomain(DomainStart=0, DomainEnd=1)
range = Range(Domain=construct_domain, Steps=no_of_divisions)
divide_domain = DivideDomain(Domain=construct_domain, Count=no_of_divisions)
list_item_2 = ListItem(List=range, Index=0, Wrap=True)  # -> Item, Item1
construct_domain_2 = ConstructDomain(DomainStart=0, DomainEnd=1)
subtraction = Subtraction(A=list_item_2.Item1, B=list_item_2.Item)
deconstruct_domain = DeconstructDomain(Domain=construct_domain)  # -> Start, End
division = Division(A=subtraction, B="2")
addition = Addition(A=range, B=division)
last_index = LastIndex(List=addition)
Z_3 = UnitZ(Factor=Slider(0.1, range=0..1))
cull_index = CullIndex(List=addition, Indices=last_index, Wrap=True)
gradient = Gradient(
    LowerLimit=deconstruct_domain.Start,
    UpperLimit=deconstruct_domain.End,
    Parameter=cull_index,
    stops=[0.15: RGB(255, 130, 160), 0.85: RGB(220, 0, 40)])
gradient_2 = Gradient(
    LowerLimit=deconstruct_domain.Start,
    UpperLimit=deconstruct_domain.End,
    Parameter=cull_index,
    stops=[0: RGB(243, 57, 0), 0.1: RGB(236, 27, 60), 0.2: RGB(210, 0, 118), 0.3: RGB(103, 0, 120), 0.4: RGB(39, 72, 161), 0.5: RGB(1, 192, 229), 0.6: RGB(18, 178, 90), 0.7: RGB(79, 186, 8), 0.8: RGB(220, 237, 32), 0.9: RGB(247, 159, 20), 1: RGB(243, 57, 0)])
gradient_3 = Gradient(
    LowerLimit=deconstruct_domain.Start,
    UpperLimit=deconstruct_domain.End,
    Parameter=cull_index,
    stops=[0: RGB(234, 38, 0), 0.25: RGB(234, 126, 0), 0.5: RGB(254, 244, 84), 0.75: RGB(173, 203, 249), 1: RGB(75, 107, 169)])
neg = Negative(Value=Z_3)
stream_filter = StreamFilter(Gate=rh_in_colourtype, Stream0=gradient_3, Stream1=gradient_2, Stream2=gradient)
stream_filter_2 = StreamFilter(Gate=rh_in_paneltype, Stream0="Quad", Stream1="Triangular", Stream2="Diamond")
stream_filter_3 = StreamFilter(Gate=rh_in_colourtype, Stream0="heat", Stream1="rainbow", Stream2="red")
stream_filter_4 = StreamFilter(Gate=rh_in_panelgroupingtype, Stream0="scattered", Stream1="x-axis", Stream2="k-means")
integer = Integer(rh_in_paneltypenumber)
stream_filter_5 = StreamFilter(Gate=rh_in_showoriginalmesh, Stream1=get_geometry)

# ---- group: RH_OUT:grouping_type
data = Data(flatten(stream_filter_4))

# ---- group: RH_OUT:panel_type
data_2 = Data(flatten(stream_filter_2))

# ---- group: RH_OUT:panel_type_number
data_3 = Data(flatten(integer))

# ---- group: RH_OUT:colour_gradient
data_4 = Data(flatten(stream_filter_3))

# ----
colour_gradient = Panel(data_4)
grouping_type = Panel(data)
panel_type = Panel(data_2)
panel_type_number = Panel(data_3)

# ---- group: RH_OUT:originalMesh
mesh_8 = Mesh(stream_filter_5)

# ---- group: create patch
mesh_9 = Mesh(get_geometry)
bbox_2 = BoundingBox(Content=mesh_9, Plane=PlaneXY(0, 0, 0))  # -> Box, Box_2
debrep_2 = DeconstructBrep(Brep=bbox_2.Box)  # -> Faces, Edges, Vertices
area_5 = Area(Geometry=debrep_2.Faces)  # -> Area, Centroid
pdecon_2 = Deconstruct(Point=area_5.Centroid)  # -> XComponent, YComponent, ZComponent
sort_2 = SortList(Keys=pdecon_2.ZComponent, ValuesA=debrep_2.Faces)  # -> Keys, ValuesA
item_2 = ListItem(List=sort_2.ValuesA, Index=0, Wrap=True)
debrep_3 = DeconstructBrep(Brep=item_2)  # -> Faces, Edges, Vertices
item_3 = ListItem(List=debrep_3.Edges, Index=0, Wrap=True)
divide = DivideCurve(Curve=item_3, Count=10, Kinks=False)  # -> reverse(Points), Tangents, Parameters
yz = YZPlane(Origin=divide.Points)
sec = MeshPlane(Mesh=get_geometry, Plane=yz)
crv_4 = Curve(sec)
crv_5 = Curve(crv_4)
xy = XYPlane(Origin=Point(0, 0, 0))
pcx = CurvePlane(Curve=crv_5, Plane=xy)  # -> Points, ParamsC, ParamsP
shatter = Shatter(Curve=graft(crv_5), Parameters=pcx.ParamsC)
combine = CombineData(Input0=shatter, Input1=graft(crv_5))  # -> Result, Index
curvepoint = PointOnCurve(combine.Result, parameter=0.5)
pdecon_3 = Deconstruct(Point=curvepoint)  # -> XComponent, YComponent, ZComponent
larger = LargerThan(FirstNumber=pdecon_3.ZComponent, SecondNumber="0")  # -> LargerThan, OrEqualTo
dispatch = Dispatch(List=combine.Result, DispatchPattern=larger.LargerThan)  # -> ListA, ListB
crv_6 = Curve(dispatch.ListA)
xy_2 = XYPlane(Origin=Point(0, 0, 0))
Z_4 = UnitZ(Factor=Slider(0.1, range=0..0.1))
move_2 = Move(Geometry=xy_2, Motion=Z_4)  # -> Geometry, Transform
sec_2 = MeshPlane(Mesh=get_geometry, Plane=move_2.Geometry)
reb = RebuildCurve(Curve=sec_2, Degree="3", Count=Slider(34, range=0..100), Tangents=False)
rebcrv = RebuildCurve(Curve=crv_6, Count=Slider(5, range=0..10), Degree="3", EndTangents=False)
number_slider_6 = Slider(28, range=0..100)

# ----
offset = OffsetCurve(Curve=reb, Distance=Slider(3, range=0..10), Corners=1)

# ---- group: create patch (continued)
patch = Patch(Curves=flatten([offset, rebcrv]), Spans=Slider(50, range=0..100), Flexibility=0.5, Trim=False)
rebsrf = RebuildSurface(Surface=patch, DomainU=number_slider_6, DomainV=number_slider_6)

# ----
srf = Surface(rebsrf)
stream_gate = StreamGate(Stream=srf, Gate=rh_in_paneltype)  # -> Target0, Target1, Target2
diamond_panels = DiamondPanels(Surface=stream_gate.Target2, UDivisions=rh_in_udivisions, VDivisions=rh_in_vdivisions)  # -> DiamondPanels, TriPanels
quad_panels = QuadPanels(Surface=stream_gate.Target0, UDivisions=rh_in_udivisions, VDivisions=rh_in_vdivisions)
triangular_panels_a = TriangularPanelsA(Surface=stream_gate.Target1, UDivisions=rh_in_udivisions, VDivisions=rh_in_vdivisions)
surface_2 = Surface([triangular_panels_a, quad_panels, diamond_panels.DiamondPanels, diamond_panels.TriPanels])

# ---- group: splitting
crv_7 = Curve(rebsrf)
project = Project(Geometry=crv_7, Plane=move_2.Geometry)  # -> Geometry, Transform
number_slider_7 = Slider(25, range=0..100)
reb_2 = RebuildCurve(Curve=project.Geometry, Count=Slider(100, range=0..100), Tangents=False)
neg_2 = Negative(Value=number_slider_7)
offset_2 = OffsetCurve(Curve=reb_2, Distance=Slider(0.5, range=0..1), Corners=1)
Z_5 = UnitZ(Factor=[neg_2, number_slider_7])
extr = Extrude(Base=offset_2, Direction=Z_5)  # -> flatten(Extrusion)
join_3 = BrepJoin(Breps=extr)  # -> Breps, Closed
cap = CapHoles(Brep=join_3.Breps)
cap_2 = CapHoles(Brep=extr)
srf_2 = Surface(surface_2)
splitmul = SplitBrepMultiple(Brep=flatten(srf_2), Cutters=cap)  # -> flatten(Result)
shapein = ShapeInBrep(Brep=cap_2, Shape=flatten(splitmul))
larger_2 = LargerThan(FirstNumber=shapein, SecondNumber="1")  # -> LargerThan, OrEqualTo
number_slider_8 = Slider(50, range=0..100)
cull = CullPattern(List=splitmul, CullPattern=invert(larger_2.LargerThan))
pt = ConstructPoint(XCoordinate=expr("-x", number_slider_8), YCoordinate=expr("-x", number_slider_8), ZCoordinate=0)
rectangle = Rectangle(Plane=pt, XSize=number_slider_4, YSize=number_slider_4, Radius=0)  # -> Rectangle, Length
Z_6 = UnitZ(Factor=Slider(1, range=0..1))
move_3 = Move(Geometry=rectangle.Rectangle, Motion=Z_6)  # -> Geometry, Transform
neg_3 = Negative(Value=Slider(5, range=0..10))
Z_7 = UnitZ(Factor=neg_3)
extr_2 = Extrude(Base=move_3.Geometry, Direction=Z_7)
cap_3 = CapHoles(Brep=extr_2)
trim = TrimSolid(Shape=cull, Cutters=cap_3)
area_6 = Area(Geometry=move_3.Geometry)  # -> Area, Centroid
pdecon_4 = Deconstruct(Point=area_6.Centroid)  # -> XComponent, YComponent, ZComponent
area_7 = Area(Geometry=trim)  # -> Area, Centroid
pdecon_5 = Deconstruct(Point=area_7.Centroid)  # -> XComponent, YComponent, ZComponent
panel = Panel("0")
larger_3 = LargerThan(FirstNumber=pdecon_5.ZComponent, SecondNumber=pdecon_4.ZComponent)  # -> LargerThan, OrEqualTo
dispatch_2 = Dispatch(List=trim, DispatchPattern=larger_3.LargerThan)  # -> ListA, ListB

# ----
pln = Plane(move_3.Geometry)
project_2 = Project(Geometry=scale_2.Geometry, Plane=pln)  # -> Geometry, Transform

# ---- group: People
pln_2 = Plane(project_2.Geometry)
sec_3 = BrepPlane(Brep=srf, Plane=pln_2)  # -> flatten(Curves), Points
join_4 = JoinCurves(Curves=sec_3.Curves, Preserve=False)
reb_3 = RebuildCurve(Curve=join_4, Degree="3", Count=Slider(38, range=0..100), Tangents=False)
len = Length(Curve=reb_3)
sort_3 = SortList(Keys=reverse(len), ValuesA=reb_3)  # -> Keys, ValuesA
item_4 = ListItem(List=sort_3.ValuesA, Index=0, Wrap=True)
neg_4 = Negative(Value=Slider(8, range=0..10))
offset_3 = OffsetCurve(Curve=item_4, Distance=neg_4, Corners=1)
boundary = BoundarySurfaces(Edges=offset_3)
popgeo = PopulateGeometry(Geometry=boundary, Count=Slider(50, range=0..100), Seed=1)
list_length = ListLength(List=popgeo)
plane = Plane(popgeo)
mesh_10 = Mesh(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)
volume = Volume(Geometry=mesh_10)  # -> Volume, Centroid
random = Random(Range=Domain(0, 360), Number=list_length, Seed=Slider(42, range=0..100))
project_3 = Project(Geometry=volume.Centroid, Plane=PlaneXY(0, 0, 0))  # -> Geometry, Transform
pt_2 = Point(project_3.Geometry)
lng = ListLength(List=random)
rotate_2 = Rotate(Geometry=plane, Angle=degrees(random), Plane=plane)  # -> Geometry, Transform
orient = Orient(Geometry=mesh_10, Source=pt_2, Target=rotate_2.Geometry)  # -> Geometry, Transform
random_2 = Random(Range=Domain(0.85, 1), Number=lng, Seed=2)
scale_3 = Scale(Geometry=orient.Geometry, Center=rotate_2.Geometry, Factor=random_2)  # -> Geometry, Transform
mesh_colours = MeshColours(Mesh=scale_3.Geometry, Colours=ColourSwatch(SwatchColor=RGBA(255, 0, 0, 218)))
stream_filter_6 = StreamFilter(Gate=boolean_toggle, Stream1=mesh_colours)

# ----
srf_3 = Surface(flatten(dispatch_2.ListA))

# ---- group: Terrain
settings_custom = SettingsCustom(
    StitchSeams=True,
    SimplePlanes=False,
    Refine=True,
    MinCount=16,
    MaxCount=400,
    AspectRatio=20,
    MaxDistance=0,
    MaxAngle=20,
    MinEdge="0.5",
    MaxEdge="0.5")
mesh_brep = MeshBrep(Brep=project_2.Geometry, Settings=settings_custom)
mesh_11 = Mesh(mesh_brep)
data_5 = Data(Slider(-1.049, range=-2..2))
data_6 = Data(Slider(0.841, range=-2..2))
demesh_2 = DeconstructMesh(Mesh=mesh_11)  # -> Vertices, Faces, Colours, Normals
construct_domain_3 = ConstructDomain(DomainStart=data_5, DomainEnd=data_6)
lng_2 = ListLength(List=demesh_2.Vertices)
random_3 = Random(Range=construct_domain_3, Number=lng_2, Seed=2)
graph = GraphMapper(
    random_3,
    x0=0,
    x1=1,
    y0=0,
    y1=1,
    amplitude=0.218028605,
    container_name="Perlin",
    decay=0.8143943548,
    frequency=0.03698211908,
    x_offset=0.5846650004,
    y_offset=0.4053633809)
gradient_4 = Gradient(LowerLimit=-0.5, UpperLimit=0.5, Parameter=graph, stops=[0.476: RGB(212, 255, 38), 1: RGB(144, 238, 144)])
conmesh = ConstructMesh(Vertices=demesh_2.Vertices, Faces=demesh_2.Faces, Colours=gradient_4)
mblur = BlurMesh(Mesh=conmesh, Iterations=Slider(1, range=0..5))
stream_filter_7 = StreamFilter(Gate=boolean_toggle_2, Stream1=mblur)

# ---- group: Trees
crv_8 = Curve(project_2.Geometry)
neg_5 = Negative(Value=Slider(10, range=0..10))
offset_4 = OffsetCurve(Curve=crv_8, Distance=neg_5, Corners=1)
number_slider_9 = Slider(50, range=0..100)
offset_5 = OffsetCurve(Curve=item_4, Distance=Slider(5, range=0..10), Corners=1)
merge_3 = Merge(Data1=offset_4, Data2=offset_5)  # -> flatten(Result)
multiplication = Multiplication(A=number_slider_9, B=Slider(2, range=0..10))
construct_domain_4 = ConstructDomain(DomainStart=Slider(0, range=0..100), DomainEnd=Slider(500, range=0..1000))
boundary_2 = BoundarySurfaces(Edges=merge_3)
populate_geometry = PopulateGeometry(Geometry=boundary_2, Count=number_slider_9, Seed=Slider(50, range=0..100))  # -> flatten(Population)
mesh_12 = Mesh(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)
plane_2 = Plane(populate_geometry)
random_4 = Random(Range=construct_domain_4, Number=multiplication, Seed=Slider(74, range=0..100))
volume_2 = Volume(Geometry=mesh_12)  # -> Volume, Centroid
project_4 = Project(Geometry=volume_2.Centroid, Plane=PlaneXY(0, 0, 0))  # -> Geometry, Transform
lng_3 = ListLength(List=random_4)
pt_3 = Point(project_4.Geometry)
rotate_3 = Rotate(Geometry=plane_2, Angle=degrees(random_4), Plane=plane_2)  # -> Geometry, Transform
orient_2 = Orient(Geometry=mesh_12, Source=pt_3, Target=rotate_3.Geometry)  # -> Geometry, Transform
random_5 = Random(Range=Domain(1, 2), Number=lng_3, Seed=2)
scale_4 = Scale(Geometry=orient_2.Geometry, Center=rotate_3.Geometry, Factor=random_5)  # -> simplify(graft(Geometry)), Transform
demesh_3 = DeconstructMesh(Mesh=scale_4.Geometry)  # -> simplify(Vertices), Faces, Colours, Normals
pdecon_6 = Deconstruct(Point=demesh_3.Vertices)  # -> XComponent, YComponent, ZComponent
bnd = Bounds(Numbers=pdecon_6.ZComponent)
remap = RemapNumbers(Value=pdecon_6.ZComponent, Source=bnd, Target=Domain(0, 1))  # -> Mapped, Clipped
gradient_5 = Gradient(
    LowerLimit=0,
    UpperLimit=1,
    Parameter=remap.Mapped,
    stops=[0: RGB(132, 196, 29), 0.359: RGB(105, 214, 130), 0.789: RGB(164, 219, 101)])
mcol = MeshColours(Mesh=scale_4.Geometry, Colours=gradient_5)
mblur_2 = BlurMesh(Mesh=mcol, Iterations=Slider(1, range=0..5))
stream_filter_8 = StreamFilter(Gate=boolean_toggle_3, Stream1=mblur_2)

# ----
area_8 = Area(Geometry=srf_3)  # -> Area, Centroid
minc = MeshInclusion(Mesh=mesh_7, Point=area_8.Centroid, Strict=False)
cull_2 = CullPattern(List=srf_3, CullPattern=minc)
mesh_13 = Mesh(flatten(cull_2))
graft_tree = GraftTree(Tree=mesh_13, IncludeEmptyLists=True, IncludeNullItems=True)
clean_2 = CleanTree(RemoveNulls=True, RemoveInvalid=True, RemoveEmpty=False, Tree=cull_2)
debrep_4 = DeconstructBrep(Brep=clean_2)  # -> Faces, Edges, Vertices
area_9 = Area(Geometry=graft_tree)  # -> Area, Centroid
area_10 = Area(Geometry=clean_2)  # -> Area, Centroid
join_5 = JoinCurves(Curves=debrep_4.Edges, Preserve=False)  # -> flatten(Curves)
len_2 = Length(Curve=join_5)
entwine_2 = Entwine(Branch00=area_10.Area, Branch01=len_2, FlattenInputs=True)
flip = FlipMatrix(Data=entwine_2)
list_length_2 = ListLength(List=flatten(area_9.Centroid))
deconstruct = Deconstruct(Point=area_9.Centroid)  # -> XComponent, YComponent, ZComponent
panel_2 = Panel(flip)
bounds = Bounds(Numbers=flatten(deconstruct.YComponent))
k_means = KMeansClustering(TrainingInputs=panel_2, OfClusters=rh_in_paneltypenumber, RandomSeed=5)  # -> Result, Likelihood, Centroids
random_6 = Random(Range=construct_domain_2, Number=list_length_2, Seed=2)  # -> graft(Random)
bnd_2 = Bounds(Numbers=k_means.Result)
remap_numbers = RemapNumbers(Value=deconstruct.YComponent, Source=bounds, Target=construct_domain)  # -> Mapped, Clipped
remap_numbers_2 = RemapNumbers(Value=k_means.Result, Source=bnd_2, Target=construct_domain)  # -> graft(Mapped), Clipped
move_4 = Move(Geometry=stream_filter_7, Motion=neg)  # -> Geometry, Transform
stream_filter_9 = StreamFilter(Gate=rh_in_panelgroupingtype, Stream0=random_6, Stream1=remap_numbers.Mapped, Stream2=remap_numbers_2.Mapped)
curve_boundary = Curve(item_4)
includes = Includes(Value=stream_filter_9, Domain=divide_domain)  # -> Includes, Deviation
curve = Curve(flatten(curve_boundary))
member_index = MemberIndex(Set=includes.Includes, Member=Toggle(True))  # -> Index, Count
mesh_14 = Mesh(curve)
mesh_colours_2 = MeshColours(Mesh=mesh_14, Colours=ColourSwatch(SwatchColor=RGBA(230, 230, 230, 221)))
list_item_3 = ListItem(List=stream_filter, Index=member_index.Index, Wrap=True)  # -> simplify(Item)
stream_filter_10 = StreamFilter(Gate=rh_in_showwireframe, Stream1=cull_2)
colours = Data(flatten(list_item_3))
create_set = CreateSet(List=colours)  # -> Set, Map
stream_filter_11 = StreamFilter(Gate=rh_in_showwireframe, Stream1=mesh_colours_2)
mesh_15 = Data(simplify(flatten(graft_tree)))
member_index_2 = MemberIndex(Set=colours, Member=create_set.Set)  # -> Index, Count
deconstruct_brep_2 = DeconstructBrep(Brep=stream_filter_10)  # -> Faces, Edges, Vertices
list_item_organised_meshes = ListItem(List=mesh_15, Index=member_index_2.Index, Wrap=True)
list_indices = ListIndices(List=create_set.Set)
graft_tree_2 = GraftTree(Tree=list_indices, IncludeEmptyLists=True, IncludeNullItems=True)
area_11 = Area(Geometry=list_item_organised_meshes)  # -> Area, Centroid
x_plus_one = XPlusOne(NumberX=graft_tree_2)
list_length_3 = ListLength(List=flatten(list_item_3))
c_script = CSharpScript(face="Arial", bold=Toggle(False), size=Slider(0.781, range=0..11), content=x_plus_one, pl=area_11.Centroid)  # -> out, A; inputs face: String, bold: Boolean, italics: Boolean, size: Double, content: String, pl: Plane
# ---------- c_script: C# usings ----------
using System.IO;
using System.Linq;
using System.Data;
using System.Drawing;
using System.Reflection;
using System.Windows.Forms;
using System.Xml;
using System.Xml.Linq;
using System.Runtime.InteropServices;

using Rhino.DocObjects;
using Rhino.Collections;
using GH_IO;
using GH_IO.Serialization;
# ---------- c_script: C# ----------
    if(size == 0)
      size = 1;

    if(!string.IsNullOrEmpty(face) && size > 0 && !string.IsNullOrEmpty(content) &&
      pl.IsValid)
    {
      using (var doc = Rhino.RhinoDoc.CreateHeadless(null))
      {
        var te = doc.Objects.AddText(content, pl, size, face, bold, italics);
        var txt = doc.Objects.Find(te) as Rhino.DocObjects.TextObject;

        if(txt != null)
        {
          var tt = txt.Geometry as Rhino.Geometry.TextEntity;
          A = tt.Explode();
        }
      }
    }
# ---------- end c_script ----------
area_12 = Area(Geometry=srf)  # -> Area, Centroid
lng_4 = ListLength(List=surface_2)
division_2 = Division(A=lng_4, B="2")
stream_filter_12 = StreamFilter(Gate=rh_in_showgroupnumbers, Stream1=c_script.A)
offset_mesh = OffsetMesh(Mesh=graft_tree, Distance=Slider(0.2, range=0..1), BothSides=0, CreateSolid=True)
integer_2 = Integer(list_length_3)
integer_3 = Integer(area_12.Area)
round = Round(Number=division_2)  # -> Nearest, Floor, Ceiling
item_5 = ListItem(List=surface_2, Index=round.Nearest, Wrap=True)
custom_preview = CustomPreview(Geometry=offset_mesh, Material=list_item_3)
debrep_5 = DeconstructBrep(Brep=item_5)  # -> Faces, Edges, Vertices
c_script_2 = CSharpScript(mesh=simplify(offset_mesh), color=list_item_3)  # -> out, A; inputs mesh: Mesh, color: Color
# ---------- c_script_2: C# ----------
    var c = color.R + "," + color.G + "," + color.B;
    mesh.SetUserString("color", c);
    A = mesh;
# ---------- end c_script_2 ----------
item_6 = ListItem(List=debrep_5.Edges, Index=0, Wrap=True)
item_7 = ListItem(List=debrep_5.Edges, Index="1", Wrap=True)
stream_filter_13 = StreamFilter(Gate=rh_in_showcolour, Stream1=c_script_2.A)
len_3 = Length(Curve=item_6)
len_4 = Length(Curve=item_7)

# ---- group: RH_OUT:panel_number
data_7 = Data(flatten(integer_2))

# ---- group: RH_OUT:sky_visibility_area
data_8 = Data(flatten(integer_3))

# ----
# DATA OUTPUT
roundd = RoundToDecimalPlace(NumberX=len_4, DecimalPlace="2", RoundType=0)  # -> Rounded, Difference
roundd_2 = RoundToDecimalPlace(NumberX=len_3, DecimalPlace="2", RoundType=0)  # -> Rounded, Difference
panel_number = Panel(data_7)
sky_visibility_area = Panel(data_8)

# ---- group: RH_OUT:people
geometry_people = Geometry(flatten(stream_filter_6))

# ---- group: RH_OUT:trees
geometry_trees = Geometry(flatten(stream_filter_8))

# ---- group: RH_OUT:edge_curves
curve_2 = Curve(flatten(deconstruct_brep_2.Edges))

# ---- group: RH_OUT:base
mesh_16 = Mesh(flatten(stream_filter_11))

# ---- group: RH_OUT:terrain
mesh_17 = Mesh(flatten(move_4.Geometry))

# ---- group: RH_OUT:colour
# GEOMETRY OUTPUT
mesh_18 = Mesh(stream_filter_13)

# ---- group: RH_OUT:panel_group_numbers
curve_3 = Curve(stream_filter_12)

# ----
concat = Concatenate(FragmentA=roundd_2.Rounded, FragmentB=" x ", FragmentC=roundd.Rounded)

# ---- group: RH_OUT:panel_size
data_9 = Data(flatten(concat))

# ----
# DATA
panel_size = Panel(data_9)

# ---- group: Gridshell Structure
warpweft_2 = WarpWeft(Mesh=mesh_6)  # -> Warp, Weft, NakedA, NakedB
bbox_3 = BoundingBox(Content=mesh_2, Plane=PlaneXY(0, 0, 0))  # -> Box, Box_2
warpweft_3 = WarpWeft(Mesh=mesh_6)  # -> Warp, Weft, NakedA, NakedB
Z_8 = UnitZ(Factor="1.7")
move_5 = Move(Geometry=bbox_3.Box, Motion=Z_8)  # -> Geometry, Transform
crv_9 = Curve(warpweft_2.Warp)
number_slider_10 = Slider(1.5, range=0..10)
crv_10 = Curve(warpweft_3.Weft)
crv_11 = Curve(crv_9)
crv_12 = Curve(crv_10)
join_6 = JoinCurves(Curves=crv_11, Preserve=False)
join_7 = JoinCurves(Curves=crv_12, Preserve=False)
clean_3 = CleanTree(RemoveNulls=True, RemoveInvalid=True, RemoveEmpty=True, Tree=join_6)
clean_4 = CleanTree(RemoveNulls=True, RemoveInvalid=True, RemoveEmpty=True, Tree=join_7)
number_slider_11 = Slider(3, range=0..10)
crv_13 = Curve(clean_3)
crv_14 = Curve(clean_4)
dom = ConstructDomain(DomainStart=expr("-x*0.5", ".15"), DomainEnd=expr("x*0.5", ".15"))
dom_2 = ConstructDomain(DomainStart=0, DomainEnd=expr("x*1", "0.1"))

# ----
area_13 = Area(Geometry=move_5.Geometry)  # -> Area, Centroid

# ---- group: Gridshell Structure (continued)
scale_nu_3 = ScaleNU(Geometry=move_5.Geometry, Plane=area_13.Centroid, ScaleX=number_slider_10, ScaleY=number_slider_10, ScaleZ=1)  # -> Geometry, Transform
trim_2 = TrimWithBrep(Curve=crv_13, Brep=scale_nu_3.Geometry)  # -> Inside, Outside
crv_15 = Curve(flatten(trim_2.Inside))
trim_3 = TrimWithBrep(Curve=crv_14, Brep=scale_nu_3.Geometry)  # -> Inside, Outside
crv_16 = Curve(flatten(trim_3.Inside))
len_5 = Length(Curve=crv_15)
division_3 = Division(A=len_5, B=number_slider_11)
len_6 = Length(Curve=crv_16)
reb_4 = RebuildCurve(Curve=crv_15, Degree="3", Count=division_3, Tangents=False)
division_4 = Division(A=len_6, B=number_slider_11)
reb_5 = RebuildCurve(Curve=crv_16, Degree="3", Count=division_4, Tangents=False)

# ----
len_7 = Length(Curve=reb_5)
len_8 = Length(Curve=reb_4)
larger_4 = LargerThan(FirstNumber=len_7, SecondNumber=number_slider_5)  # -> LargerThan, OrEqualTo
larger_5 = LargerThan(FirstNumber=len_8, SecondNumber=number_slider_5)  # -> LargerThan, OrEqualTo
cull_3 = CullPattern(List=reb_5, CullPattern=larger_4.OrEqualTo)
cull_4 = CullPattern(List=reb_4, CullPattern=larger_5.OrEqualTo)

# ---- group: Gridshell Structure (continued)
len_9 = Length(Curve=cull_3)
len_10 = Length(Curve=cull_4)
division_5 = Division(A=len_9, B="5")
division_6 = Division(A=len_10, B="5")
pframes = PerpFrames(Curve=cull_3, Count=division_5, Align=True)  # -> Frames, Parameters
pframes_2 = PerpFrames(Curve=cull_4, Count=division_6, Align=True)  # -> Frames, Parameters
rectangle_2 = Rectangle(Plane=pframes.Frames, XSize=dom_2, YSize=dom, Radius=0)  # -> simplify(Rectangle), Length
rectangle_3 = Rectangle(Plane=pframes_2.Frames, XSize=dom_2, YSize=dom, Radius=0)  # -> simplify(Rectangle), Length
loft = Loft(
    Curves=rectangle_2.Rectangle,
    Options={Adjust=False, Closed=False, LoftEnds=0, LoftSimp=0, LoftType=0, Rebuild=10, Refit=0.01})
loft_2 = Loft(
    Curves=rectangle_3.Rectangle,
    Options={Adjust=False, Closed=False, LoftEnds=0, LoftSimp=0, LoftType=0, Rebuild=10, Refit=0.01})
merge_4 = Merge(Data1=loft_2, Data2=loft)

# ----
end = EndPoints(Curve=[cull_4, cull_3])  # -> Start, End
pt_4 = Point([end.Start, end.End])
pl = PlaneNormal(Origin=pt_4, ZAxis=Vector(0, 0, 1))
alongcrv = SortAlongCurve(Points=pt_4, Curve=cir)  # -> Points, Indices
item_8 = ListItem(List=pl, Index=0, Wrap=True)
intcrv = Interpolate(Vertices=alongcrv.Points, Degree=3, Periodic=False, KnotStyle=1)  # -> Curve, Length, Domain
project_5 = Project(Geometry=intcrv.Curve, Plane=item_8)  # -> Geometry, Transform
clscrv = CloseCurve(Curve=project_5.Geometry, CloseType=0, Bulge=0.5, Tolerance=0)  # -> Closed, R
boundary_3 = BoundarySurfaces(Edges=clscrv.Closed)
merge_5 = Merge(Data1=cull_4, Data2=cull_3)  # -> flatten(Result)
len_11 = Length(Curve=merge_5)
mesh_19 = Mesh(boundary_3)
sort_4 = SortList(Keys=merge_5, ValuesA=len_11)  # -> Keys, ValuesA
item_9 = ListItem(List=reverse(sort_4.Keys), Index=0, Wrap=True)
item_10 = ListItem(List=sort_4.Keys, Index=0, Wrap=True)
lng_5 = ListLength(List=merge_5)
mesh_colours_3 = MeshColours(Mesh=merge_4, Colours=ColourSwatch(SwatchColor=RGB(103, 11, 12)))
roundd_3 = RoundToDecimalPlace(NumberX=item_10, DecimalPlace="2", RoundType=0)  # -> Rounded, Difference
mesh_colours_4 = MeshColours(Mesh=mesh_19, Colours=ColourSwatch(SwatchColor=RGB(254, 255, 230)))
roundd_4 = RoundToDecimalPlace(NumberX=item_9, DecimalPlace="2", RoundType=0)  # -> Rounded, Difference
merge_6 = Merge(Data1=cull_4, Data2=cull_3)
stream_filter_14 = StreamFilter(Gate=rh_in_showgridshellwireframe, Stream1=merge_6)
stream_filter_15 = StreamFilter(Gate=rh_in_showgridshell, Stream1=[mesh_colours_3, mesh_colours_4])

# ---- group: RH_OUT:member_number
data_10 = Data(lng_5)

# ---- group: RH_OUT:shortest_member
data_11 = Data(roundd_3.Rounded)

# ---- group: RH_OUT:longest_member
data_12 = Data(roundd_4.Rounded)

# ----
longestmember = Panel(data_12)
membernumber = Panel(data_10)
shortestmember = Panel(data_11)

# ---- group: RH_OUT:gridshell_curve
curve_4 = Curve(stream_filter_14)

# ---- group: RH_OUT:gridshell_mesh
mesh_20 = Mesh(stream_filter_15)
