# Grasshopper definition PrototypingOrganic_meshupload.gh (Grasshopper 1.0.7)
# plug-ins: Kangaroo2 Components, Kangaroo Components, Pufferfish

# FORM
toggle = BooleanToggle(True)
mesh = Mesh(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)

# ----
# GRIDSHELL
rh_in_showgridshellwireframe = GetBoolean(Toggle(False), AtLeast=1, AtMost=1, FalseValue="False", TreeAccess=False, TrueValue="True")
rh_in_showgridshell = GetBoolean(Toggle(False), AtLeast=1, AtMost=1, FalseValue="False", TreeAccess=False, TrueValue="True")
rh_in_gridsize = GetInteger(Slider(2, range=1..5), AtLeast=1, AtMost=1, Maximum=2147483647, Minimum=-2147483648, TreeAccess=False)
rh_in_gridangle = GetInteger(Slider(0, range=0..360), AtLeast=1, AtMost=1, Maximum=2147483647, Minimum=-2147483648, TreeAccess=False)

rh_in_showoriginalmesh = GetBoolean(toggle, AtLeast=1, AtMost=1, FalseValue="False", TreeAccess=False, TrueValue="True")
meshes = GetGeometry(mesh, AtLeast=1, AtMost=1, DeleteInput=False, Filter=1074004029, TreeAccess=False)

# ---- group: RH_IN:showPeople
boolean_toggle = BooleanToggle(True)

# ---- group: RH_IN:showTerrain
# LAYER OPTIONS
boolean_toggle_2 = BooleanToggle(True)

# ---- group: RH_IN:showTrees
boolean_toggle_3 = BooleanToggle(True)

# ---- group: mesh drappping
mesh_2 = Mesh(meshes)
bbox = BoundingBox(Content=mesh_2, Plane=PlaneXY(0, 0, 0))  # -> Box, Box_2
debrep = DeconstructBrep(Brep=bbox.Box)  # -> Faces, Edges, Vertices
area = Area(Geometry=debrep.Faces)  # -> Area, Centroid
pdecon = Deconstruct(Point=area.Centroid)  # -> XComponent, YComponent, ZComponent
sort = SortList(Keys=pdecon.ZComponent, ValuesA=debrep.Faces)  # -> Keys, ValuesA
custom_mesh_settings = SettingsCustom(
    StitchSeams=True,
    SimplePlanes=False,
    Refine=True,
    MinCount=16,
    MaxCount=400,
    AspectRatio=20,
    MaxDistance=0,
    MaxAngle=20,
    MinEdge=rh_in_gridsize,
    MaxEdge=rh_in_gridsize)
item = ListItem(List=sort.ValuesA, Index=0, Wrap=True)
area_2 = Area(Geometry=item)  # -> Area, Centroid
scale = Scale(Geometry=item, Center=area_2.Centroid, Factor=Slider(2, range=0..10))  # -> Geometry, Transform
rotate = Rotate(Geometry=scale.Geometry, Angle=degrees(rh_in_gridangle), Plane=PlaneXY(0, 0, 0))  # -> Geometry, Transform
mesh_3 = Mesh(mesh_2)
Z = UnitZ(Factor=Slider(22, range=0..100))
mesh_4 = MeshBrep(Brep=rotate.Geometry, Settings=custom_mesh_settings)
move = Move(Geometry=mesh_4, Motion=Z)  # -> Geometry, Transform
warpweft = WarpWeft(Mesh=move.Geometry)  # -> Warp, Weft, NakedA, NakedB
crv = Curve(warpweft.Weft)
crv_2 = Curve(warpweft.Warp)
demesh = DeconstructMesh(Mesh=move.Geometry)  # -> Vertices, Faces, Colours, Normals
join = JoinCurves(Curves=crv, Preserve=False)
join_2 = JoinCurves(Curves=crv_2, Preserve=False)
mesh_5 = Mesh(move.Geometry)
merge = Merge(Data1=join_2, Data2=join)
Z_2 = UnitZ(Factor=-0.01)
show = Show(G=mesh_5)
spc = SolidPointCollide(Points=demesh.Vertices, Solid=mesh_3, Interior=False, Unidirectional=True, Strength=Slider(10, range=0..10))
load = Load(Point=demesh.Vertices, ForceVector=Z_2)
crv_3 = Curve(flatten(merge))
rod = Rod(Polyline=crv_3, LengthFactor=1, AngleFactor=1, AxialStrength=10, BendStrength=Slider(5, range=0..10))
number_slider = Slider(3000, range=0..10000)
merge_2 = Merge(Data1=rod, Data2=load, Data3=spc)
entwine = Entwine(Branch00=show, Branch01=merge_2, FlattenInputs=True)  # -> simplify(Result)
zombiesolver = ZombieSolver(GoalObjects=entwine, Threshold=1e-10, Tolerance=0.0001, MaxIterations=Slider(5000, range=0..10000))  # -> I, V, O
clean = CleanTree(RemoveNulls=True, RemoveInvalid=True, RemoveEmpty=False, Tree=zombiesolver.O)
objecttypesort = CSharpScript(geo=clean)  # -> out, Pt, Crv, Mesh, Brep, Srf; inputs geo: list of GeometryBase
# ---------- objecttypesort: C# ----------
    List<Rhino.Geometry.Point> Pts = new List<Rhino.Geometry.Point>();
    List<Curve> Crvs = new List<Curve>();
    List<Mesh> Meshes = new List<Mesh>();
    List<Brep> Breps = new List<Brep>();
    List<Brep> Srfs = new List<Brep>();


    foreach(GeometryBase x in geo){
      Rhino.DocObjects.ObjectType objectType = x.ObjectType;
      switch(objectType){
        case Rhino.DocObjects.ObjectType.Point: Pts.Add(x as Rhino.Geometry.Point);
          break;
        case Rhino.DocObjects.ObjectType.Curve: Crvs.Add(x as Curve);
          break;
        case Rhino.DocObjects.ObjectType.Mesh: Meshes.Add(x as Mesh);
          break;
        case Rhino.DocObjects.ObjectType.Brep:
          Brep brepObj = x as Brep;
          if(brepObj.IsSurface){
            Srfs.Add(brepObj);
          } else {
            Breps.Add(brepObj);
          }
          break;


      }
    }
    Pt = Pts;
    Crv = Crvs;
    Mesh = Meshes;
    Brep = Breps;
    Srf = Srfs;
# ---------- end objecttypesort ----------

# ----
bounding_box = BoundingBox(Content=meshes, Plane=PlaneXY(0, 0, 0), UnionBox=True)  # -> Box, Box_2
number_slider_2 = Slider(1.05, range=0..10)
scale_nu = ScaleNU(
    Geometry=bounding_box.Box,
    Plane=PlaneXY(0, 0, 0),
    ScaleX=number_slider_2,
    ScaleY=number_slider_2,
    ScaleZ=number_slider_2)  # -> Geometry, Transform
area_3 = Area(Geometry=scale_nu.Geometry)  # -> Area, Centroid
number_slider_3 = Slider(1.5, range=0..10)
mesh_6 = Mesh(objecttypesort.Mesh)
scale_nu_2 = ScaleNU(Geometry=scale_nu.Geometry, Plane=area_3.Centroid, ScaleX=number_slider_3, ScaleY=number_slider_3, ScaleZ=1)  # -> Geometry, Transform
deconstruct_brep = DeconstructBrep(Brep=scale_nu_2.Geometry)  # -> Faces, Edges, Vertices
list_item = ListItem(List=deconstruct_brep.Faces, Index=0, Wrap=True)  # -> Item, Item1, Item2, Item3, Item4
surface = Surface(list_item.Item4)
scale_2 = Scale(Geometry=surface, Center=Point(0, 0, 0), Factor=Slider(1.3, range=0..10))  # -> Geometry, Transform
pln = Plane(item)
project = Project(Geometry=scale_2.Geometry, Plane=pln)  # -> Geometry, Transform

# ---- group: Terrain
settings_custom = SettingsCustom(
    StitchSeams=True,
    SimplePlanes=False,
    Refine=True,
    MinCount=16,
    MaxCount=400,
    AspectRatio=20,
    MaxDistance=0,
    MaxAngle=20,
    MinEdge="0.5",
    MaxEdge="0.5")
mesh_brep = MeshBrep(Brep=project.Geometry, Settings=settings_custom)
mesh_7 = Mesh(mesh_brep)
data = Data(Slider(-1.049, range=-2..2))
data_2 = Data(Slider(0.841, range=-2..2))
demesh_2 = DeconstructMesh(Mesh=mesh_7)  # -> Vertices, Faces, Colours, Normals
construct_domain = ConstructDomain(DomainStart=data, DomainEnd=data_2)
lng = ListLength(List=demesh_2.Vertices)
random = Random(Range=construct_domain, Number=lng, Seed=2)
graph = GraphMapper(
    random,
    x0=0,
    x1=1,
    y0=0,
    y1=1,
    amplitude=0.218028605,
    container_name="Perlin",
    decay=0.8143943548,
    frequency=0.03698211908,
    x_offset=0.5846650004,
    y_offset=0.4053633809)
gradient = Gradient(LowerLimit=-0.5, UpperLimit=0.5, Parameter=graph, stops=[0.476: RGB(212, 255, 38), 1: RGB(144, 238, 144)])
conmesh = ConstructMesh(Vertices=demesh_2.Vertices, Faces=demesh_2.Faces, Colours=gradient)
mblur = BlurMesh(Mesh=conmesh, Iterations=Slider(1, range=0..5))
stream_filter = StreamFilter(Gate=boolean_toggle_2, Stream1=mblur)

# ----
crv_4 = Curve(project.Geometry)

# ---- group: People
join_3 = JoinCurves(Curves=crv_4, Preserve=False)
reb = RebuildCurve(Curve=join_3, Degree="3", Count=Slider(38, range=0..100), Tangents=False)
len = Length(Curve=reb)
sort_2 = SortList(Keys=reverse(len), ValuesA=reb)  # -> Keys, ValuesA
item_2 = ListItem(List=sort_2.ValuesA, Index=0, Wrap=True)
neg = Negative(Value=Slider(8, range=0..10))
offset = OffsetCurve(Curve=item_2, Distance=neg, Corners=1)
boundary = BoundarySurfaces(Edges=offset)
popgeo = PopulateGeometry(Geometry=boundary, Count=Slider(50, range=0..100), Seed=1)
list_length = ListLength(List=popgeo)
plane = Plane(popgeo)
mesh_8 = Mesh(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)
volume = Volume(Geometry=mesh_8)  # -> Volume, Centroid
random_2 = Random(Range=Domain(0, 360), Number=list_length, Seed=Slider(42, range=0..100))
project_2 = Project(Geometry=volume.Centroid, Plane=PlaneXY(0, 0, 0))  # -> Geometry, Transform
pt = Point(project_2.Geometry)
lng_2 = ListLength(List=random_2)
rotate_2 = Rotate(Geometry=plane, Angle=degrees(random_2), Plane=plane)  # -> Geometry, Transform
orient = Orient(Geometry=mesh_8, Source=pt, Target=rotate_2.Geometry)  # -> Geometry, Transform
random_3 = Random(Range=Domain(0.85, 1), Number=lng_2, Seed=2)
scale_3 = Scale(Geometry=orient.Geometry, Center=rotate_2.Geometry, Factor=random_3)  # -> Geometry, Transform
mesh_colours = MeshColours(Mesh=scale_3.Geometry, Colours=ColourSwatch(SwatchColor=RGBA(255, 0, 0, 218)))
stream_filter_2 = StreamFilter(Gate=boolean_toggle, Stream1=mesh_colours)

# ---- group: Trees
crv_5 = Curve(project.Geometry)
neg_2 = Negative(Value=Slider(10, range=0..10))
offset_2 = OffsetCurve(Curve=crv_5, Distance=neg_2, Corners=1)
offset_3 = OffsetCurve(Curve=item_2, Distance=Slider(0, range=0..10), Corners=1)
number_slider_4 = Slider(50, range=0..100)
merge_3 = Merge(Data1=offset_2, Data2=offset_3)  # -> flatten(Result)
multiplication = Multiplication(A=number_slider_4, B=Slider(2, range=0..10))
construct_domain_2 = ConstructDomain(DomainStart=Slider(0, range=0..100), DomainEnd=Slider(500, range=0..1000))
boundary_2 = BoundarySurfaces(Edges=merge_3)
populate_geometry = PopulateGeometry(Geometry=boundary_2, Count=number_slider_4, Seed=Slider(50, range=0..100))  # -> flatten(Population)
mesh_9 = Mesh(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)
plane_2 = Plane(populate_geometry)
random_4 = Random(Range=construct_domain_2, Number=multiplication, Seed=Slider(74, range=0..100))
volume_2 = Volume(Geometry=mesh_9)  # -> Volume, Centroid
project_3 = Project(Geometry=volume_2.Centroid, Plane=PlaneXY(0, 0, 0))  # -> Geometry, Transform
lng_3 = ListLength(List=random_4)
pt_2 = Point(project_3.Geometry)
rotate_3 = Rotate(Geometry=plane_2, Angle=degrees(random_4), Plane=plane_2)  # -> Geometry, Transform
orient_2 = Orient(Geometry=mesh_9, Source=pt_2, Target=rotate_3.Geometry)  # -> Geometry, Transform
random_5 = Random(Range=Domain(1, 2), Number=lng_3, Seed=2)
scale_4 = Scale(Geometry=orient_2.Geometry, Center=rotate_3.Geometry, Factor=random_5)  # -> simplify(graft(Geometry)), Transform
demesh_3 = DeconstructMesh(Mesh=scale_4.Geometry)  # -> simplify(Vertices), Faces, Colours, Normals
pdecon_2 = Deconstruct(Point=demesh_3.Vertices)  # -> XComponent, YComponent, ZComponent
bnd = Bounds(Numbers=pdecon_2.ZComponent)
remap = RemapNumbers(Value=pdecon_2.ZComponent, Source=bnd, Target=Domain(0, 1))  # -> Mapped, Clipped
gradient_2 = Gradient(
    LowerLimit=0,
    UpperLimit=1,
    Parameter=remap.Mapped,
    stops=[0: RGB(132, 196, 29), 0.359: RGB(105, 214, 130), 0.789: RGB(164, 219, 101)])
mcol = MeshColours(Mesh=scale_4.Geometry, Colours=gradient_2)
mblur_2 = BlurMesh(Mesh=mcol, Iterations=Slider(1, range=0..5))
stream_filter_3 = StreamFilter(Gate=boolean_toggle_3, Stream1=mblur_2)

# ----
number_slider_5 = Slider(3, range=0..10)
area_4 = Area(Geometry=meshes)  # -> Area, Centroid
cir = Circle(Plane=area_4.Centroid, Radius=1)
Z_3 = UnitZ(Factor=Slider(0.1, range=0..1))
neg_3 = Negative(Value=Z_3)
move_2 = Move(Geometry=stream_filter, Motion=neg_3)  # -> Geometry, Transform
area_5 = Area(Geometry=mesh_6)  # -> Area, Centroid
integer = Integer(area_5.Area)
stream_filter_4 = StreamFilter(Gate=rh_in_showoriginalmesh, Stream1=meshes)

# ---- group: RH_OUT:trees
geometry_trees = Geometry(flatten(stream_filter_3))

# ---- group: RH_OUT:people
geometry_people = Geometry(flatten(stream_filter_2))

# ---- group: RH_OUT:terrain
mesh_10 = Mesh(flatten(move_2.Geometry))

# ---- group: RH_OUT:sky_visibility_area
data_3 = Data(flatten(integer))

# ----
sky_visibility_area = Panel(data_3)

# ---- group: RH_OUT:originalMesh
# DATA
mesh_11 = Mesh(stream_filter_4)

# ---- group: Gridshell Structure
warpweft_2 = WarpWeft(Mesh=mesh_6)  # -> Warp, Weft, NakedA, NakedB
bbox_2 = BoundingBox(Content=mesh_2, Plane=PlaneXY(0, 0, 0))  # -> Box, Box_2
warpweft_3 = WarpWeft(Mesh=mesh_6)  # -> Warp, Weft, NakedA, NakedB
Z_4 = UnitZ(Factor="1.7")
move_3 = Move(Geometry=bbox_2.Box, Motion=Z_4)  # -> Geometry, Transform
crv_6 = Curve(warpweft_2.Warp)
number_slider_6 = Slider(1.5, range=0..10)
crv_7 = Curve(warpweft_3.Weft)
crv_8 = Curve(crv_6)
crv_9 = Curve(crv_7)
join_4 = JoinCurves(Curves=crv_8, Preserve=False)
scale_nu_3 = ScaleNU(Geometry=bbox_2.Box, Plane=PlaneXY(0, 0, 0), ScaleX=number_slider_6, ScaleY=number_slider_6, ScaleZ=1)  # -> Geometry, Transform
join_5 = JoinCurves(Curves=crv_9, Preserve=False)
clean_2 = CleanTree(RemoveNulls=True, RemoveInvalid=True, RemoveEmpty=True, Tree=join_4)
clean_3 = CleanTree(RemoveNulls=True, RemoveInvalid=True, RemoveEmpty=True, Tree=join_5)
number_slider_7 = Slider(3, range=0..10)
crv_10 = Curve(clean_2)
trim = TrimWithBrep(Curve=crv_10, Brep=scale_nu_3.Geometry)  # -> Inside, Outside
crv_11 = Curve(clean_3)
crv_12 = Curve(flatten(trim.Inside))
trim_2 = TrimWithBrep(Curve=crv_11, Brep=scale_nu_3.Geometry)  # -> Inside, Outside
crv_13 = Curve(flatten(trim_2.Inside))
len_2 = Length(Curve=crv_12)
division = Division(A=len_2, B=number_slider_7)
len_3 = Length(Curve=crv_13)
reb_2 = RebuildCurve(Curve=crv_12, Degree="3", Count=division, Tangents=False)
division_2 = Division(A=len_3, B=number_slider_7)
reb_3 = RebuildCurve(Curve=crv_13, Degree="3", Count=division_2, Tangents=False)
dom = ConstructDomain(DomainStart=expr("-x*0.5", ".15"), DomainEnd=expr("x*0.5", ".15"))
dom_2 = ConstructDomain(DomainStart=0, DomainEnd=expr("x*1", "0.1"))

# ----
len_4 = Length(Curve=reb_2)
len_5 = Length(Curve=reb_3)
larger = LargerThan(FirstNumber=len_5, SecondNumber=number_slider_5)  # -> LargerThan, OrEqualTo
larger_2 = LargerThan(FirstNumber=len_4, SecondNumber=number_slider_5)  # -> LargerThan, OrEqualTo
cull = CullPattern(List=reb_3, CullPattern=larger.OrEqualTo)
cull_2 = CullPattern(List=reb_2, CullPattern=larger_2.OrEqualTo)

# ---- group: Gridshell Structure (continued)
len_6 = Length(Curve=cull)
len_7 = Length(Curve=cull_2)
division_3 = Division(A=len_6, B="5")
division_4 = Division(A=len_7, B="5")
pframes = PerpFrames(Curve=cull, Count=division_3, Align=True)  # -> Frames, Parameters
pframes_2 = PerpFrames(Curve=cull_2, Count=division_4, Align=True)  # -> Frames, Parameters
rectangle = Rectangle(Plane=pframes.Frames, XSize=dom_2, YSize=dom, Radius=0)  # -> simplify(Rectangle), Length
rectangle_2 = Rectangle(Plane=pframes_2.Frames, XSize=dom_2, YSize=dom, Radius=0)  # -> simplify(Rectangle), Length
loft = Loft(
    Curves=rectangle.Rectangle,
    Options={Adjust=False, Closed=False, LoftEnds=0, LoftSimp=0, LoftType=0, Rebuild=10, Refit=0.01})
loft_2 = Loft(
    Curves=rectangle_2.Rectangle,
    Options={Adjust=False, Closed=False, LoftEnds=0, LoftSimp=0, LoftType=0, Rebuild=10, Refit=0.01})
merge_4 = Merge(Data1=loft_2, Data2=loft)

# ----
end = EndPoints(Curve=[cull_2, cull])  # -> Start, End
pt_3 = Point([end.Start, end.End])
pl = PlaneNormal(Origin=pt_3, ZAxis=Vector(0, 0, 1))
alongcrv = SortAlongCurve(Points=pt_3, Curve=cir)  # -> Points, Indices
item_3 = ListItem(List=pl, Index=0, Wrap=True)
intcrv = Interpolate(Vertices=alongcrv.Points, Degree=3, Periodic=False, KnotStyle=1)  # -> Curve, Length, Domain
project_4 = Project(Geometry=intcrv.Curve, Plane=item_3)  # -> Geometry, Transform
clscrv = CloseCurve(Curve=project_4.Geometry, CloseType=0, Bulge=0.5, Tolerance=0)  # -> Closed, R
boundary_3 = BoundarySurfaces(Edges=clscrv.Closed)
merge_5 = Merge(Data1=cull_2, Data2=cull)  # -> flatten(Result)
len_8 = Length(Curve=merge_5)
mesh_12 = Mesh(boundary_3)
sort_3 = SortList(Keys=merge_5, ValuesA=len_8)  # -> Keys, ValuesA
item_4 = ListItem(List=reverse(sort_3.Keys), Index=0, Wrap=True)
item_5 = ListItem(List=sort_3.Keys, Index=0, Wrap=True)
lng_4 = ListLength(List=merge_5)
mesh_colours_2 = MeshColours(Mesh=merge_4, Colours=ColourSwatch(SwatchColor=RGB(103, 11, 12)))
roundd = RoundToDecimalPlace(NumberX=item_5, DecimalPlace="2", RoundType=0)  # -> Rounded, Difference
mesh_colours_3 = MeshColours(Mesh=mesh_12, Colours=ColourSwatch(SwatchColor=RGB(254, 255, 230)))
roundd_2 = RoundToDecimalPlace(NumberX=item_4, DecimalPlace="2", RoundType=0)  # -> Rounded, Difference
merge_6 = Merge(Data1=cull_2, Data2=cull)
stream_filter_5 = StreamFilter(Gate=rh_in_showgridshellwireframe, Stream1=merge_6)
stream_filter_6 = StreamFilter(Gate=rh_in_showgridshell, Stream1=mesh_colours_2)

# ---- group: RH_OUT:member_number
data_4 = Data(lng_4)

# ---- group: RH_OUT:shortest_member
data_5 = Data(roundd.Rounded)

# ---- group: RH_OUT:longest_member
data_6 = Data(roundd_2.Rounded)

# ----
longestmember = Panel(data_6)
membernumber = Panel(data_4)
shortestmember = Panel(data_5)

# ---- group: RH_OUT:gridshell_curve
curve = Curve(stream_filter_5)

# ---- group: RH_OUT:gridshell_mesh
mesh_13 = Mesh(stream_filter_6)
