# Grasshopper definition curve_control.gh (Grasshopper 1.0.7)

# ---- group: RH_IN:siteLength
site_length = Slider(82, range=0..100)

# ---- group: RH_IN:siteWidth
# SITE
site_width = Slider(15, range=0..20)

# ----
rectangle = Rectangle(Plane=PlaneXY(0, 0, 0), XSize=site_width, YSize=site_length, Radius=0)  # -> Rectangle, Length
populate_2d = Populate2D(Region=rectangle.Rectangle, Count=Slider(4, range=0..10), Seed=1)
# CONTROL POINTS
curve_control_points = Point(populate_2d)
points = GetPoint(curve_control_points, AtLeast=1, AtMost=2147483647, Realtime=True)
explode = Explode(Curve=rectangle.Rectangle, Recursive=True)  # -> Segments, Vertices
list_item = ListItem(List=explode.Segments, Index=1, Wrap=True)
sort_along_curve = SortAlongCurve(Points=points, Curve=list_item)  # -> Points, Indices
interpolate = Interpolate(Vertices=sort_along_curve.Points, Degree=3, Periodic=False, KnotStyle=1)  # -> Curve, Length, Domain

# ---- group: RH_OUT:curvePath
curve = Curve(interpolate.Curve)
