# Grasshopper definition curve_control3.gh (Grasshopper 1.0.7)

# ---- group: RH_IN:siteLength
# CONTROL POINTS
site_length = Slider(82, range=0..100)

# ---- group: RH_IN:siteWidth
# SITE
site_width = Slider(15, range=0..20)

# ---- group: RH_IN:arcRadius1
# Arcs for roof form loft
# ARCS
number_slider = Slider(4, range=0..10)

# ---- group: RH_IN:arcRadius2
number_slider_2 = Slider(4, range=0..10)

# ---- group: RH_IN:arcRadius3
number_slider_3 = Slider(4, range=0..10)

# ---- group: RH_IN:arcRadius4
number_slider_4 = Slider(4, range=0..10)

# ----
rh_in_sitelength = GetNumber(site_length, AtLeast=1, AtMost=1, Maximum=1.797693135e+308, Minimum=-1.797693135e+308)
rh_in_sitewidth = GetNumber(site_width, AtLeast=1, AtMost=1, Maximum=1.797693135e+308, Minimum=-1.797693135e+308)
rh_in_arcradius3 = GetNumber(number_slider_3, AtLeast=1, AtMost=1, Maximum=1.797693135e+308, Minimum=-1.797693135e+308)
rh_in_arcradius2 = GetNumber(number_slider_2, AtLeast=1, AtMost=1, Maximum=1.797693135e+308, Minimum=-1.797693135e+308)
rh_in_arcradius1 = GetNumber(number_slider, AtLeast=1, AtMost=1, Maximum=1.797693135e+308, Minimum=-1.797693135e+308)
rh_in_arcradius4 = GetNumber(number_slider_4, AtLeast=1, AtMost=1, Maximum=1.797693135e+308, Minimum=-1.797693135e+308)
rectangle = Rectangle(Plane=PlaneXY(0, 0, 0), XSize=rh_in_sitewidth, YSize=rh_in_sitelength, Radius=0)  # -> Rectangle, Length
populate_2d = Populate2D(Region=rectangle.Rectangle, Count=Slider(4, range=0..10), Seed=1)
merge = Merge(Data1=rh_in_arcradius1, Data2=rh_in_arcradius2, Data3=rh_in_arcradius3, Data4=rh_in_arcradius4)
explode = Explode(Curve=rectangle.Rectangle, Recursive=True)  # -> Segments, Vertices
list_item = ListItem(List=explode.Segments, Index=1, Wrap=True)
sort_along_curve = SortAlongCurve(Points=populate_2d, Curve=list_item)  # -> Points, Indices
interpolate = Interpolate(Vertices=sort_along_curve.Points, Degree=3, Periodic=False, KnotStyle=1)  # -> Curve, Length, Domain
curve_closest_point = CurveClosestPoint(Point=populate_2d, Curve=interpolate.Curve)  # -> Point, Parameter, Distance
perp_frame = PerpFrame(Curve=interpolate.Curve, Parameter=curve_closest_point.Parameter)
sort_along_curve_2 = SortAlongCurve(Points=perp_frame, Curve=interpolate.Curve)  # -> Points, Indices
deconstruct_plane = DeconstructPlane(Plane=sort_along_curve_2.Points)  # -> Origin, XAxis, YAxis, ZAxis
panel = Panel(merge)
data = Data(panel)
negative = Negative(Value=data)
line_sdl = LineSDL(Start=sort_along_curve_2.Points, Direction=deconstruct_plane.XAxis, Length=data)  # -> flatten(Line)
line_sdl_2 = LineSDL(Start=sort_along_curve_2.Points, Direction=deconstruct_plane.XAxis, Length=negative)  # -> flatten(Line)
join_curves = JoinCurves(Curves=[line_sdl_2, line_sdl], Preserve=False)
end_points = EndPoints(Curve=join_curves)  # -> Start, End
xz_plane = XZPlane(Origin=Point(0, 0, 0))
end_points_2 = EndPoints(Curve=line_sdl)  # -> Start, End
end_points_3 = EndPoints(Curve=line_sdl_2)  # -> Start, End
c_script = CSharpScript(plane=xz_plane, start=end_points.Start, end=end_points.End, radius=data)  # -> out, A, B, C, D; inputs plane: Plane, start: Point3d, end: Point3d, radius: Double
# ---------- c_script: C# ----------
    var line = new Line(start, end);
    var vec = Vector3d.CrossProduct(line.Direction, plane.ZAxis);
    vec.Unitize();
    var d = Math.Sqrt(Math.Pow(radius, 2.0) - Math.Pow(line.Length, 2.0) / 4.0);
    A = new Arc(start, line.PointAt(0.5) + vec * (radius - d), end);
    B = new Arc(start, line.PointAt(0.5) - vec * (radius - d), end);
    C = new Arc(start, line.PointAt(0.5) + vec * (radius + d), end);
    D = new Arc(start, line.PointAt(0.5) - vec * (radius + d), end);
# ---------- end c_script ----------
interpolate_2 = Interpolate(Vertices=end_points_2.End, Degree=3, Periodic=False, KnotStyle=1)  # -> Curve, Length, Domain
interpolate_3 = Interpolate(Vertices=end_points_3.End, Degree=3, Periodic=False, KnotStyle=1)  # -> Curve, Length, Domain
end_points_4 = EndPoints(Curve=c_script.B)  # -> Start, End
line = Line(StartPoint=end_points_4.Start, EndPoint=end_points_4.End)
plane = Plane(perp_frame)
curve_middle = CurveMiddle(Curve=line)
rotate_3d = Rotate3D(Geometry=c_script.B, Angle=expr("-x", degrees(Slider(0, range=0..100))), Center=curve_middle, Axis=plane)  # -> flatten(Geometry), Transform
sweep2 = Sweep2(Rail1=interpolate_2.Curve, Rail2=interpolate_3.Curve, Sections=rotate_3d.Geometry, SameHeight=False)

# ---- group: RH_OUT:curvePath
curve = Curve([interpolate.Curve, c_script.B])

# ---- group: RH_OUT:mesh
mesh = Mesh(sweep2)
