# Grasshopper definition curve_control4.gh (Grasshopper 1.0.7)
# plug-ins: LunchBox

site_length = Slider(60, range=30..60)
site_width = Slider(5, range=0..5)
rh_in_sitewidth = GetNumber(site_width, AtLeast=0, AtMost=5, Maximum=1.797693135e+308, Minimum=-1.797693135e+308)
rh_in_sitelength = GetNumber(site_length, AtLeast=30, AtMost=60, Maximum=1.797693135e+308, Minimum=-1.797693135e+308)
rh_in_arcradius3 = GetNumber(Slider(2, range=2..10), AtLeast=2, AtMost=10, Maximum=1.797693135e+308, Minimum=-1.797693135e+308)
rh_in_arcradius2 = GetNumber(Slider(4, range=2..10), AtLeast=2, AtMost=10, Maximum=1.797693135e+308, Minimum=-1.797693135e+308)
rh_in_arcradius1 = GetNumber(Slider(10, range=2..10), AtLeast=2, AtMost=10, Maximum=1.797693135e+308, Minimum=-1.797693135e+308)
rh_in_arcradius4 = GetNumber(Slider(10, range=2..10), AtLeast=2, AtMost=10, Maximum=1.797693135e+308, Minimum=-1.797693135e+308)
rectangle = Rectangle(Plane=PlaneXY(0, 0, 0), XSize=rh_in_sitewidth, YSize=rh_in_sitelength, Radius=0)  # -> Rectangle, Length
populate_2d = Populate2D(Region=rectangle.Rectangle, Count=Slider(4, range=0..10), Seed=1)
merge = Merge(Data1=rh_in_arcradius1, Data2=rh_in_arcradius2, Data3=rh_in_arcradius3, Data4=rh_in_arcradius4)
explode = Explode(Curve=rectangle.Rectangle, Recursive=True)  # -> Segments, Vertices
list_item = ListItem(List=explode.Segments, Index=1, Wrap=True)
sort_along_curve = SortAlongCurve(Points=populate_2d, Curve=list_item)  # -> Points, Indices
interpolate = Interpolate(Vertices=sort_along_curve.Points, Degree=3, Periodic=False, KnotStyle=1)  # -> Curve, Length, Domain
curve_closest_point = CurveClosestPoint(Point=populate_2d, Curve=interpolate.Curve)  # -> Point, Parameter, Distance
perp_frame = PerpFrame(Curve=interpolate.Curve, Parameter=curve_closest_point.Parameter)
sort_along_curve_2 = SortAlongCurve(Points=perp_frame, Curve=interpolate.Curve)  # -> Points, Indices
deconstruct_plane = DeconstructPlane(Plane=sort_along_curve_2.Points)  # -> Origin, XAxis, YAxis, ZAxis
data = Data(merge)
negative = Negative(Value=data)
line_sdl = LineSDL(Start=sort_along_curve_2.Points, Direction=deconstruct_plane.XAxis, Length=data)  # -> flatten(Line)
line_sdl_2 = LineSDL(Start=sort_along_curve_2.Points, Direction=deconstruct_plane.XAxis, Length=negative)  # -> flatten(Line)
join_curves = JoinCurves(Curves=[line_sdl_2, line_sdl], Preserve=False)
xz_plane = XZPlane(Origin=Point(0, 0, 0))
end_points = EndPoints(Curve=join_curves)  # -> Start, End
c_script = CSharpScript(plane=xz_plane, start=end_points.Start, end=end_points.End, radius=data)  # -> out, A, B, C, D; inputs plane: Plane, start: Point3d, end: Point3d, radius: Double
# ---------- c_script: C# ----------
    var line = new Line(start, end);
    var vec = Vector3d.CrossProduct(line.Direction, plane.ZAxis);
    vec.Unitize();
    var d = Math.Sqrt(Math.Pow(radius, 2.0) - Math.Pow(line.Length, 2.0) / 4.0);
    A = new Arc(start, line.PointAt(0.5) + vec * (radius - d), end);
    B = new Arc(start, line.PointAt(0.5) - vec * (radius - d), end);
    C = new Arc(start, line.PointAt(0.5) + vec * (radius + d), end);
    D = new Arc(start, line.PointAt(0.5) - vec * (radius + d), end);
# ---------- end c_script ----------
loft_options = LoftOptions(Closed=False, Adjust=False, Rebuild=0, Refit=0, Type=0)
loft = Loft(Curves=c_script.B, Options=loft_options)
diamond_panels = DiamondPanels(Surface=loft, UDivisions=10, VDivisions=10)  # -> DiamondPanels, TriPanels
curve = Curve([interpolate.Curve, c_script.B])
mesh = Mesh(diamond_panels.DiamondPanels)
context_bake = ContextBake(RH_OUTCurvePath=curve)
context_bake_2 = ContextBake(RH_OUTMesh=mesh)
