# Grasshopper definition curve_control5.gh (Grasshopper 1.0.7)
# plug-ins: LunchBox, Pufferfish

# ---- group: RH_IN:siteLength
site_length = Slider(82, range=0..100)

# ---- group: RH_IN:siteWidth
# CONTROL POINTS
# SITE
site_width = Slider(15, range=0..20)

# ----
rh_in_sitelength = GetNumber(site_length, AtLeast=1, AtMost=1, Maximum=1.797693135e+308, Minimum=-1.797693135e+308)
rh_in_sitewidth = GetNumber(site_width, AtLeast=1, AtMost=1, Maximum=1.797693135e+308, Minimum=-1.797693135e+308)

rh_in_udivisions = GetNumber(Slider(91, range=0..100), AtLeast=1, AtMost=1, Maximum=1.797693135e+308, Minimum=-1.797693135e+308)
# PANELIZATION
rh_in_paneltype = GetNumber(Slider(0, range=0..2), AtLeast=1, AtMost=1, Maximum=1.797693135e+308, Minimum=-1.797693135e+308)
rh_in_vdivisions = GetNumber(Slider(18, range=0..100), AtLeast=1, AtMost=1, Maximum=1.797693135e+308, Minimum=-1.797693135e+308)

# ----
# GROUPING
rh_in_showgroupnumbers = GetBoolean(Toggle(False), AtLeast=1, AtMost=1, FalseValue="False", TrueValue="True")
rh_in_panelgroupingtype = GetNumber(Slider(0, range=0..2), AtLeast=1, AtMost=1, Maximum=1.797693135e+308, Minimum=-1.797693135e+308)
rh_in_paneltypenumber = GetNumber(Slider(13, range=0..20), AtLeast=1, AtMost=1, Maximum=1.797693135e+308, Minimum=-1.797693135e+308)

# ----
# ARCS
rh_in_arcradius1 = GetNumber(Slider(10, range=0..10), AtLeast=1, AtMost=1, Maximum=1.797693135e+308, Minimum=-1.797693135e+308)
rh_in_arcradius2 = GetNumber(Slider(6, range=0..10), AtLeast=1, AtMost=1, Maximum=1.797693135e+308, Minimum=-1.797693135e+308)
rh_in_arcradius3 = GetNumber(Slider(3, range=0..10), AtLeast=1, AtMost=1, Maximum=1.797693135e+308, Minimum=-1.797693135e+308)
rh_in_arcradius4 = GetNumber(Slider(4, range=0..10), AtLeast=1, AtMost=1, Maximum=1.797693135e+308, Minimum=-1.797693135e+308)

rh_in_panelcolour = GetNumber(Slider(1, range=0..2), AtLeast=1, AtMost=1, Maximum=1.797693135e+308, Minimum=-1.797693135e+308)
# COLOURING
rh_in_showcolour = GetBoolean(Toggle(True), AtLeast=1, AtMost=1, FalseValue="False", TrueValue="True")

rh_in_showboundary = GetBoolean(Toggle(True), AtLeast=1, AtMost=1, FalseValue="False", TrueValue="True")
rh_in_showsurface = GetBoolean(Toggle(True), AtLeast=1, AtMost=1, FalseValue="False", TrueValue="True")
rh_in_showterrain = GetBoolean(Toggle(True), AtLeast=1, AtMost=1, FalseValue="False", TrueValue="True")
rh_in_showpeople = GetBoolean(Toggle(True), AtLeast=1, AtMost=1, FalseValue="False", TrueValue="True")
rh_in_showedges = GetBoolean(Toggle(True), AtLeast=1, AtMost=1, FalseValue="False", TrueValue="True")
rh_in_showtrees = GetBoolean(Toggle(True), AtLeast=1, AtMost=1, FalseValue="False", TrueValue="True")
# LAYER OPTIONS
rh_in_showarcs = GetBoolean(Toggle(False), AtLeast=1, AtMost=1, FalseValue="False", TrueValue="True")
rh_in_showpath = GetBoolean(Toggle(True), AtLeast=1, AtMost=1, FalseValue="False", TrueValue="True")

merge = Merge(Data1=rh_in_arcradius1, Data2=rh_in_arcradius2, Data3=rh_in_arcradius3, Data4=rh_in_arcradius4)
rectangle = Rectangle(Plane=PlaneXY(0, 0, 0), XSize=rh_in_sitewidth, YSize=rh_in_sitelength, Radius=0)  # -> Rectangle, Length
explode = Explode(Curve=rectangle.Rectangle, Recursive=True)  # -> Segments, Vertices
populate_2d = Populate2D(Region=rectangle.Rectangle, Count=Slider(4, range=0..10), Seed=1)
list_item = ListItem(List=explode.Segments, Index=1, Wrap=True)
sort_along_curve = SortAlongCurve(Points=populate_2d, Curve=list_item)  # -> Points, Indices
interpolate = Interpolate(Vertices=sort_along_curve.Points, Degree=3, Periodic=False, KnotStyle=1)  # -> Curve, Length, Domain
curve_closest_point = CurveClosestPoint(Point=populate_2d, Curve=interpolate.Curve)  # -> Point, Parameter, Distance
curve = Curve(interpolate.Curve)
perp_frame = PerpFrame(Curve=interpolate.Curve, Parameter=curve_closest_point.Parameter)
sort_along_curve_2 = SortAlongCurve(Points=perp_frame, Curve=interpolate.Curve)  # -> Points, Indices
deconstruct_plane = DeconstructPlane(Plane=sort_along_curve_2.Points)  # -> Origin, XAxis, YAxis, ZAxis
panel = Panel(merge)
data = Data(panel)
negative = Negative(Value=data)
line_sdl = LineSDL(Start=sort_along_curve_2.Points, Direction=deconstruct_plane.XAxis, Length=data)  # -> flatten(Line)
line_sdl_2 = LineSDL(Start=sort_along_curve_2.Points, Direction=deconstruct_plane.XAxis, Length=negative)  # -> flatten(Line)
join_curves = JoinCurves(Curves=[line_sdl_2, line_sdl], Preserve=False)
xz_plane = XZPlane(Origin=Point(0, 0, 0))
end_points = EndPoints(Curve=join_curves)  # -> Start, End
c_script = CSharpScript(plane=xz_plane, start=end_points.Start, end=end_points.End, radius=data)  # -> out, A, B, C, D; inputs plane: Plane, start: Point3d, end: Point3d, radius: Double
# ---------- c_script: C# ----------
    var line = new Line(start, end);
    var vec = Vector3d.CrossProduct(line.Direction, plane.ZAxis);
    vec.Unitize();
    var d = Math.Sqrt(Math.Pow(radius, 2.0) - Math.Pow(line.Length, 2.0) / 4.0);
    A = new Arc(start, line.PointAt(0.5) + vec * (radius - d), end);
    B = new Arc(start, line.PointAt(0.5) - vec * (radius - d), end);
    C = new Arc(start, line.PointAt(0.5) + vec * (radius + d), end);
    D = new Arc(start, line.PointAt(0.5) - vec * (radius + d), end);
# ---------- end c_script ----------
end_points_2 = EndPoints(Curve=line_sdl)  # -> Start, End
end_points_3 = EndPoints(Curve=line_sdl_2)  # -> Start, End
interpolate_2 = Interpolate(Vertices=end_points_2.End, Degree=3, Periodic=False, KnotStyle=1)  # -> Curve, Length, Domain
interpolate_3 = Interpolate(Vertices=end_points_3.End, Degree=3, Periodic=False, KnotStyle=1)  # -> Curve, Length, Domain
end_points_4 = EndPoints(Curve=interpolate_3.Curve)  # -> Start, End
end_points_5 = EndPoints(Curve=interpolate_2.Curve)  # -> Start, End
bounding_box = BoundingBox(Content=[interpolate_2.Curve, interpolate_3.Curve], Plane=PlaneXY(0, 0, 0), UnionBox=True)  # -> Box, Box_2
area = Area(Geometry=bounding_box.Box)  # -> Area, Centroid
loft = Loft(Curves=c_script.B, Options={Adjust=False, Closed=False, LoftEnds=0, LoftSimp=0, LoftType=0, Rebuild=10, Refit=0.01})
line = Line(StartPoint=end_points_5.End, EndPoint=end_points_4.End)
line_2 = Line(StartPoint=end_points_5.Start, EndPoint=end_points_4.Start)
scale_nu = ScaleNU(Geometry=bounding_box.Box, Plane=area.Centroid, ScaleX=Slider(1.5, range=0..10), ScaleY=1, ScaleZ=1)  # -> Geometry, Transform
deconstruct_brep = DeconstructBrep(Brep=scale_nu.Geometry)  # -> Faces, Edges, Vertices
join_curves_2 = JoinCurves(Curves=[interpolate_2.Curve, interpolate_3.Curve, line_2, line], Preserve=False)
stream_gate = StreamGate(Stream=loft, Gate=rh_in_paneltype)  # -> Target0, Target1, Target2
list_item_2 = ListItem(List=deconstruct_brep.Faces, Index=0, Wrap=True)
split_brep = SplitBrep(Brep=list_item_2, Cutter=join_curves_2)
list_item_3 = ListItem(List=split_brep, Index=0, Wrap=True)  # -> Item, Item1, Item2
quad_panels = QuadPanels(Surface=stream_gate.Target0, UDivisions=rh_in_udivisions, VDivisions=rh_in_vdivisions)
triangular_panels_a = TriangularPanelsA(Surface=stream_gate.Target1, UDivisions=rh_in_udivisions, VDivisions=rh_in_vdivisions)
diamond_panels = DiamondPanels(Surface=stream_gate.Target2, UDivisions=rh_in_udivisions, VDivisions=rh_in_vdivisions)  # -> DiamondPanels, TriPanels
surface = Surface([triangular_panels_a, quad_panels, diamond_panels.DiamondPanels, diamond_panels.TriPanels])
mesh = Mesh([quad_panels, triangular_panels_a, diamond_panels.DiamondPanels, diamond_panels.TriPanels])
graft_tree = GraftTree(Tree=mesh, IncludeEmptyLists=True, IncludeNullItems=True)
graft_tree_2 = GraftTree(Tree=surface, IncludeEmptyLists=True, IncludeNullItems=True)
construct_domain = ConstructDomain(DomainStart=0, DomainEnd=1)
no_of_divisions = Panel(rh_in_paneltypenumber)
area_2 = Area(Geometry=graft_tree)  # -> Area, Centroid
surface_closest_point = SurfaceClosestPoint(Point=area_2.Centroid, Surface=graft_tree_2)  # -> Point, UVPoint, Distance
principal_curvature = PrincipalCurvature(Surface=loft, Point=surface_closest_point.UVPoint)  # -> Frame, Maximum, Minimum, MaxDirection, MinDirection
range = Range(Domain=construct_domain, Steps=no_of_divisions)
divide_domain = DivideDomain(Domain=construct_domain, Count=no_of_divisions)
deconstruct = Deconstruct(Point=area_2.Centroid)  # -> XComponent, YComponent, ZComponent
deconstruct_domain = DeconstructDomain(Domain=construct_domain)  # -> Start, End
list_item_4 = ListItem(List=range, Index=0, Wrap=True)  # -> Item, Item1
multiplication = Multiplication(A=principal_curvature.Maximum, B=principal_curvature.Minimum)
list_length = ListLength(List=flatten(area_2.Centroid))
bounds = Bounds(Numbers=flatten(multiplication))
subtraction = Subtraction(A=list_item_4.Item1, B=list_item_4.Item)
bounds_2 = Bounds(Numbers=flatten(deconstruct.YComponent))
division = Division(A=subtraction, B="2")
remap_numbers = RemapNumbers(Value=multiplication, Source=bounds, Target=Domain(0, 1))  # -> Mapped, Clipped
construct_domain_2 = ConstructDomain(DomainStart=0, DomainEnd=1)
addition = Addition(A=range, B=division)
remap_numbers_2 = RemapNumbers(Value=deconstruct.YComponent, Source=bounds_2, Target=construct_domain)  # -> Mapped, Clipped
last_index = LastIndex(List=addition)
random = Random(Range=construct_domain_2, Number=list_length, Seed=2)  # -> graft(Random)
cull_index = CullIndex(List=addition, Indices=last_index, Wrap=True)
gradient = Gradient(
    LowerLimit=deconstruct_domain.Start,
    UpperLimit=deconstruct_domain.End,
    Parameter=cull_index,
    stops=[0.15: RGB(255, 130, 160), 0.85: RGB(220, 0, 40)])
gradient_2 = Gradient(
    LowerLimit=deconstruct_domain.Start,
    UpperLimit=deconstruct_domain.End,
    Parameter=cull_index,
    stops=[0: RGB(243, 57, 0), 0.1: RGB(236, 27, 60), 0.2: RGB(210, 0, 118), 0.3: RGB(103, 0, 120), 0.4: RGB(39, 72, 161), 0.5: RGB(1, 192, 229), 0.6: RGB(18, 178, 90), 0.7: RGB(79, 186, 8), 0.8: RGB(220, 237, 32), 0.9: RGB(247, 159, 20), 1: RGB(243, 57, 0)])
gradient_3 = Gradient(
    LowerLimit=deconstruct_domain.Start,
    UpperLimit=deconstruct_domain.End,
    Parameter=cull_index,
    stops=[0: RGB(234, 38, 0), 0.25: RGB(234, 126, 0), 0.5: RGB(254, 244, 84), 0.75: RGB(173, 203, 249), 1: RGB(75, 107, 169)])
stream_filter = StreamFilter(Gate=rh_in_panelgroupingtype, Stream0=remap_numbers.Mapped, Stream1=remap_numbers_2.Mapped, Stream2=random)
includes = Includes(Value=stream_filter, Domain=divide_domain)  # -> Includes, Deviation
stream_filter_2 = StreamFilter(Gate=rh_in_panelcolour, Stream0=gradient_3, Stream1=gradient_2, Stream2=gradient)
member_index = MemberIndex(Set=includes.Includes, Member=Toggle(True))  # -> Index, Count
mesh_2 = Data(simplify(flatten(graft_tree)))
list_item_5 = ListItem(List=stream_filter_2, Index=member_index.Index, Wrap=True)  # -> simplify(Item)
colours = Data(flatten(list_item_5))
member_index_2 = MemberIndex(Set=flatten(list_item_5), Member=stream_filter_2)  # -> Index, Count
create_set = CreateSet(List=colours)  # -> Set, Map
member_index_3 = MemberIndex(Set=colours, Member=create_set.Set)  # -> Index, Count
mesh_colours = MeshColours(Mesh=graft_tree, Colours=list_item_5)
random_2 = Random(Range=Domain(0, 1), Number=Slider(10, range=0..100), Seed=Slider(5, range=0..10))
list_item_organised_meshes = ListItem(List=mesh_2, Index=member_index_3.Index, Wrap=True)
list_item_organised_colours = ListItem(List=colours, Index=member_index_3.Index, Wrap=True)
evaluate_curve = EvaluateCurve(Curve=reparameterize(curve), Parameter=random_2)  # -> Point, Tangent, Angle
number_slider = Slider(12, range=0..100)
surface_2 = Surface(flatten([list_item_3.Item1, list_item_3.Item2]))
surface_3 = Surface([list_item_3.Item1, list_item_3.Item2])
curve_2 = Curve(interpolate.Curve)
list_indices = ListIndices(List=create_set.Set)
construct_domain_3 = ConstructDomain(DomainStart=Slider(1, range=0..1), DomainEnd=Slider(4, range=0..10))
curve_3 = Curve([interpolate_2.Curve, interpolate_3.Curve])
stream_filter_3 = StreamFilter(Gate=rh_in_showpeople, Stream1=evaluate_curve.Point)
curve_4 = Curve(c_script.B)
populate_geometry = PopulateGeometry(Geometry=surface_2, Count=number_slider, Seed=1)
stream_filter_4 = StreamFilter(Gate=rh_in_showterrain, Stream1=surface_3)
stream_filter_5 = StreamFilter(Gate=rh_in_paneltype, Stream0="Quad Panels", Stream1="Triangular Panels", Stream2="Diamond Panels")
stream_filter_6 = StreamFilter(Gate=rh_in_showboundary, Stream1=curve_3)
area_3 = Area(Geometry=list_item_organised_meshes)  # -> Area, Centroid
stream_filter_7 = StreamFilter(Gate=0, Stream0="heat", Stream1="rainbow", Stream2="red")
stream_filter_8 = StreamFilter(Gate=rh_in_showpath, Stream1=curve_2)
stream_filter_9 = StreamFilter(Gate=rh_in_showarcs, Stream1=curve_4)
cylinder = Cylinder(Base=stream_filter_3, Radius=Slider(0.2, range=0..1), Length=Slider(1.7, range=0..10))
graft_tree_3 = GraftTree(Tree=list_indices, IncludeEmptyLists=True, IncludeNullItems=True)
x_plus_one = XPlusOne(NumberX=graft_tree_3)
random_3 = Random(Range=construct_domain_3, Number=number_slider, Seed=2)
stream_filter_10 = StreamFilter(Gate=rh_in_showcolour, Stream1=mesh_colours)
curve_boundary = Curve(stream_filter_6)
area_4 = Area(Geometry=loft)  # -> Area, Centroid

# ---- group: RH_OUT:roof_terrain
mesh_3 = Mesh(stream_filter_4)

# ----
mesh_4 = Mesh(cylinder)
stream_filter_11 = StreamFilter(Gate=rh_in_showedges, Stream1=surface)
length = Length(Curve=interpolate.Curve)
cylinder_2 = Cylinder(Base=populate_geometry, Radius=Slider(0.1, range=0..1), Length=random_3)
list_length_2 = ListLength(List=flatten(list_item_5))

# ---- group: RH_OUT:people
geometry_people = Geometry(mesh_4)

# ---- group: RH_OUT:curve_boundary
curve_5 = Curve(curve_boundary)

# ---- group: RH_OUT:curve_path
curve_path = Curve(stream_filter_8)

# ---- group: RH_OUT:curve_arcs
curve_arcs = Curve(stream_filter_9)

# ----
deconstruct_brep_2 = DeconstructBrep(Brep=stream_filter_11)  # -> Faces, Edges, Vertices
c_script_2 = CSharpScript(face="Arial", bold=Toggle(False), size=Slider(0.781, range=0..11), content=x_plus_one, pl=area_3.Centroid)  # -> out, A; inputs face: String, bold: Boolean, italics: Boolean, size: Double, content: String, pl: Plane
# ---------- c_script_2: C# usings ----------
using System.IO;
using System.Linq;
using System.Data;
using System.Drawing;
using System.Reflection;
using System.Windows.Forms;
using System.Xml;
using System.Xml.Linq;
using System.Runtime.InteropServices;

using Rhino.DocObjects;
using Rhino.Collections;
using GH_IO;
using GH_IO.Serialization;
# ---------- c_script_2: C# ----------
    if(size == 0)
      size = 1;

    if(!string.IsNullOrEmpty(face) && size > 0 && !string.IsNullOrEmpty(content) &&
      pl.IsValid)
    {
      using (var doc = Rhino.RhinoDoc.CreateHeadless(null))
      {
        var te = doc.Objects.AddText(content, pl, size, face, bold, italics);
        var txt = doc.Objects.Find(te) as Rhino.DocObjects.TextObject;

        if(txt != null)
        {
          var tt = txt.Geometry as Rhino.Geometry.TextEntity;
          A = tt.Explode();
        }
      }
    }
# ---------- end c_script_2 ----------
stream_filter_12 = StreamFilter(Gate=rh_in_showsurface, Stream1=loft)
mesh_5 = Mesh(cylinder_2)
integer = Integer(area_4.Area)
integer_2 = Integer(flatten(length))
integer_3 = Integer(rh_in_paneltypenumber)
integer_4 = Integer(list_length_2)
stream_filter_13 = StreamFilter(Gate=rh_in_showtrees, Stream1=mesh_5)
central_path_length = Panel(integer_2)
sky_visibility_area = Panel(integer)
colour_gradient = Panel(stream_filter_7)
panel_type_number = Panel(integer_3)
panel_number = Panel(integer_4)
panel_type = Panel(stream_filter_5)

# ---- group: RH_OUT:trees
geometry_trees = Geometry(stream_filter_13)

# ---- group: RH_OUT:surface
surface_4 = Surface(stream_filter_12)

# ----
stream_filter_14 = StreamFilter(Gate=rh_in_showgroupnumbers, Stream1=c_script_2.A)

# ---- group: RH_OUT:edge_curves
curve_6 = Curve(deconstruct_brep_2.Edges)

# ---- group: RH_OUT:colour
mesh_6 = Mesh(stream_filter_10)

# ---- group: RH_OUT:panel_group_numbers
# DATA
curve_7 = Curve(stream_filter_14)
