# Grasshopper definition curve_control7.gh (Grasshopper 1.0.7)
# plug-ins: LunchBox, Pufferfish

# SITE
site_length = Slider(82, range=0..100)
# CONTROL POINTS
site_width = Slider(15, range=0..20)

# ----
# ARCS
rh_in_arcradius1 = GetNumber(Slider(10, range=0..10), AtLeast=1, AtMost=1, Maximum=1.797693135e+308, Minimum=-1.797693135e+308)
rh_in_arcradius2 = GetNumber(Slider(6, range=0..10), AtLeast=1, AtMost=1, Maximum=1.797693135e+308, Minimum=-1.797693135e+308)
rh_in_arcradius3 = GetNumber(Slider(3, range=0..10), AtLeast=1, AtMost=1, Maximum=1.797693135e+308, Minimum=-1.797693135e+308)
rh_in_arcradius4 = GetNumber(Slider(4, range=0..10), AtLeast=1, AtMost=1, Maximum=1.797693135e+308, Minimum=-1.797693135e+308)

rh_in_sitelength = GetNumber(site_length, AtLeast=1, AtMost=1, Maximum=1.797693135e+308, Minimum=-1.797693135e+308)
rh_in_sitewidth = GetNumber(site_width, AtLeast=1, AtMost=1, Maximum=1.797693135e+308, Minimum=-1.797693135e+308)

rh_in_udivisions = GetNumber(Slider(43, range=0..100), AtLeast=1, AtMost=1, Maximum=1.797693135e+308, Minimum=-1.797693135e+308)
rh_in_vdivisions = GetNumber(Slider(18, range=0..100), AtLeast=1, AtMost=1, Maximum=1.797693135e+308, Minimum=-1.797693135e+308)

# ----
# PANELIZATION
rh_in_paneltype = GetInteger(Slider(2, range=0..2), AtLeast=1, AtMost=1, Maximum=2147483647, Minimum=-2147483648)
merge = Merge(Data1=rh_in_arcradius1, Data2=rh_in_arcradius2, Data3=rh_in_arcradius3, Data4=rh_in_arcradius4)
site_width_2 = Slider(15, range=0..20)
rectangle = Rectangle(Plane=PlaneXY(0, 0, 0), XSize=rh_in_sitewidth, YSize=rh_in_sitelength, Radius=0)  # -> Rectangle, Length
populate_2d = Populate2D(Region=rectangle.Rectangle, Count=Slider(5, range=0..10), Seed=1)
points = GetPoint(populate_2d, AtLeast=1, AtMost=1, Realtime=True)
explode = Explode(Curve=rectangle.Rectangle, Recursive=True)  # -> Segments, Vertices
list_item = ListItem(List=explode.Segments, Index=1, Wrap=True)
sort_along_curve = SortAlongCurve(Points=populate_2d, Curve=list_item)  # -> Points, Indices
interpolate = Interpolate(Vertices=sort_along_curve.Points, Degree=3, Periodic=False, KnotStyle=1)  # -> Curve, Length, Domain
curve_closest_point = CurveClosestPoint(Point=points, Curve=interpolate.Curve)  # -> Point, Parameter, Distance
perp_frame = PerpFrame(Curve=interpolate.Curve, Parameter=curve_closest_point.Parameter)
sort_along_curve_2 = SortAlongCurve(Points=perp_frame, Curve=interpolate.Curve)  # -> Points, Indices
panel = Panel(merge)
deconstruct_plane = DeconstructPlane(Plane=sort_along_curve_2.Points)  # -> Origin, XAxis, YAxis, ZAxis
data = Data(panel)
negative = Negative(Value=data)
line_sdl = LineSDL(Start=sort_along_curve_2.Points, Direction=deconstruct_plane.XAxis, Length=data)  # -> flatten(Line)
line_sdl_2 = LineSDL(Start=sort_along_curve_2.Points, Direction=deconstruct_plane.XAxis, Length=negative)  # -> flatten(Line)
join_curves = JoinCurves(Curves=[line_sdl_2, line_sdl], Preserve=False)
xz_plane = XZPlane(Origin=Point(0, 0, 0))
end_points = EndPoints(Curve=join_curves)  # -> Start, End
c_script = CSharpScript(plane=xz_plane, start=end_points.Start, end=end_points.End, radius=data)  # -> out, A, B, C, D; inputs plane: Plane, start: Point3d, end: Point3d, radius: Double
# ---------- c_script: C# ----------
    var line = new Line(start, end);
    var vec = Vector3d.CrossProduct(line.Direction, plane.ZAxis);
    vec.Unitize();
    var d = Math.Sqrt(Math.Pow(radius, 2.0) - Math.Pow(line.Length, 2.0) / 4.0);
    A = new Arc(start, line.PointAt(0.5) + vec * (radius - d), end);
    B = new Arc(start, line.PointAt(0.5) - vec * (radius - d), end);
    C = new Arc(start, line.PointAt(0.5) + vec * (radius + d), end);
    D = new Arc(start, line.PointAt(0.5) - vec * (radius + d), end);
# ---------- end c_script ----------
loft = Loft(Curves=c_script.B, Options={Adjust=False, Closed=False, LoftEnds=0, LoftSimp=0, LoftType=0, Rebuild=10, Refit=0.01})
stream_gate = StreamGate(Stream=loft, Gate=rh_in_paneltype)  # -> Target0, Target1, Target2
quad_panels = QuadPanels(Surface=stream_gate.Target0, UDivisions=rh_in_udivisions, VDivisions=rh_in_vdivisions)
triangular_panels_a = TriangularPanelsA(Surface=stream_gate.Target1, UDivisions=rh_in_udivisions, VDivisions=rh_in_vdivisions)
diamond_panels = DiamondPanels(Surface=stream_gate.Target2, UDivisions=rh_in_udivisions, VDivisions=rh_in_vdivisions)  # -> DiamondPanels, TriPanels
surface = Surface([triangular_panels_a, quad_panels, diamond_panels.DiamondPanels, diamond_panels.TriPanels])
mesh = Mesh([quad_panels, triangular_panels_a, diamond_panels.DiamondPanels, diamond_panels.TriPanels])
graft_tree = GraftTree(Tree=mesh, IncludeEmptyLists=True, IncludeNullItems=True)
graft_tree_2 = GraftTree(Tree=surface, IncludeEmptyLists=True, IncludeNullItems=True)
construct_domain = ConstructDomain(DomainStart=0, DomainEnd=1)
no_of_divisions = Panel("20")
area = Area(Geometry=graft_tree)  # -> Area, Centroid
surface_closest_point = SurfaceClosestPoint(Point=area.Centroid, Surface=graft_tree_2)  # -> Point, UVPoint, Distance
principal_curvature = PrincipalCurvature(Surface=loft, Point=surface_closest_point.UVPoint)  # -> Frame, Maximum, Minimum, MaxDirection, MinDirection
range = Range(Domain=construct_domain, Steps=no_of_divisions)
divide_domain = DivideDomain(Domain=construct_domain, Count=no_of_divisions)
deconstruct = Deconstruct(Point=area.Centroid)  # -> XComponent, YComponent, ZComponent
deconstruct_domain = DeconstructDomain(Domain=construct_domain)  # -> Start, End
list_item_2 = ListItem(List=range, Index=0, Wrap=True)  # -> Item, Item1
multiplication = Multiplication(A=principal_curvature.Maximum, B=principal_curvature.Minimum)
list_length = ListLength(List=flatten(area.Centroid))
bounds = Bounds(Numbers=flatten(multiplication))
subtraction = Subtraction(A=list_item_2.Item1, B=list_item_2.Item)
bounds_2 = Bounds(Numbers=flatten(deconstruct.YComponent))
division = Division(A=subtraction, B="2")
remap_numbers = RemapNumbers(Value=multiplication, Source=bounds, Target=Domain(0, 1))  # -> Mapped, Clipped
construct_domain_2 = ConstructDomain(DomainStart=0, DomainEnd=1)
addition = Addition(A=range, B=division)
remap_numbers_2 = RemapNumbers(Value=deconstruct.YComponent, Source=bounds_2, Target=construct_domain)  # -> Mapped, Clipped
last_index = LastIndex(List=addition)
random = Random(Range=construct_domain_2, Number=list_length, Seed=2)  # -> graft(Random)
cull_index = CullIndex(List=addition, Indices=last_index, Wrap=True)
gradient = Gradient(
    LowerLimit=deconstruct_domain.Start,
    UpperLimit=deconstruct_domain.End,
    Parameter=cull_index,
    stops=[0.15: RGB(255, 130, 160), 0.85: RGB(220, 0, 40)])
gradient_2 = Gradient(
    LowerLimit=deconstruct_domain.Start,
    UpperLimit=deconstruct_domain.End,
    Parameter=cull_index,
    stops=[0: RGB(243, 57, 0), 0.1: RGB(236, 27, 60), 0.2: RGB(210, 0, 118), 0.3: RGB(103, 0, 120), 0.4: RGB(39, 72, 161), 0.5: RGB(1, 192, 229), 0.6: RGB(18, 178, 90), 0.7: RGB(79, 186, 8), 0.8: RGB(220, 237, 32), 0.9: RGB(247, 159, 20), 1: RGB(243, 57, 0)])
gradient_3 = Gradient(
    LowerLimit=deconstruct_domain.Start,
    UpperLimit=deconstruct_domain.End,
    Parameter=cull_index,
    stops=[0: RGB(234, 38, 0), 0.25: RGB(234, 126, 0), 0.5: RGB(254, 244, 84), 0.75: RGB(173, 203, 249), 1: RGB(75, 107, 169)])
stream_filter = StreamFilter(Gate=0, Stream0=remap_numbers.Mapped, Stream1=remap_numbers_2.Mapped, Stream2=random)
includes = Includes(Value=stream_filter, Domain=divide_domain)  # -> Includes, Deviation
stream_filter_2 = StreamFilter(Gate=0, Stream0=gradient_3, Stream1=gradient_2, Stream2=gradient)
member_index = MemberIndex(Set=includes.Includes, Member=Toggle(True))  # -> Index, Count
list_item_3 = ListItem(List=stream_filter_2, Index=member_index.Index, Wrap=True)  # -> simplify(Item)
member_index_2 = MemberIndex(Set=flatten(list_item_3), Member=stream_filter_2)  # -> Index, Count
mesh_colours = MeshColours(Mesh=graft_tree, Colours=list_item_3)
stream_filter_3 = StreamFilter(Gate=0, Stream0="Quad Panels", Stream1="Triangular Panels", Stream2="Diamond Panels")
stream_filter_4 = StreamFilter(Gate=0, Stream0="heat", Stream1="rainbow", Stream2="red")
stream_filter_5 = StreamFilter(Gate=0, Stream0=mesh_colours)
area_2 = Area(Geometry=loft)  # -> Area, Centroid
stream_filter_6 = StreamFilter(Gate=0, Stream0=surface)
length = Length(Curve=interpolate.Curve)
list_length_2 = ListLength(List=flatten(list_item_3))
deconstruct_brep = DeconstructBrep(Brep=stream_filter_6)  # -> Faces, Edges, Vertices
stream_filter_7 = StreamFilter(Gate=0, Stream0=loft)
integer = Integer(area_2.Area)
integer_2 = Integer(flatten(length))
integer_3 = Integer()
integer_4 = Integer(list_length_2)

# ---- group: RH_OUT:sky_visibility_area
data_2 = Data(flatten(integer))

# ----
central_path_length = Panel(integer_2)
colour_gradient = Panel(stream_filter_4)
panel_type_number = Panel(integer_3)
panel_number = Panel(integer_4)
panel_type = Panel(stream_filter_3)

# ---- group: RH_OUT:colour
mesh_2 = Mesh(stream_filter_5)

# ----
sky_visibility_area = Panel(data_2)

# ---- group: RH_OUT:surface
surface_2 = Surface(stream_filter_7)

# ---- group: RH_OUT:edge_curves
# DATA
curve = Curve(deconstruct_brep.Edges)
