# Grasshopper definition prototypingOrganicV1.gh (Grasshopper 1.0.7)
# plug-ins: Kangaroo2 Components, MeshEdit Components, Parakeet, Kangaroo Components

# ---- group: RH_IN:gridSize
# 10% increments
number_slider = Slider(3, range=1..5)

# ---- group: RH_IN:gridAngle
# 10% increments
number_slider_2 = Slider(0, range=0..360)

# ----
# 5% increments
mesh = Mesh(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)
get_geometry = GetGeometry(mesh, AtLeast=1, AtMost=1, DeleteInput=False, Filter=1074004029, TreeAccess=False)
meshcap = MeshCap(Mesh=get_geometry)
bbox = BoundingBox(Content=meshcap, Plane=PlaneXY(0, 0, 0))  # -> Box, Box_2
# FEELING LUCKY!
# SITE
# ARCS
debrep = DeconstructBrep(Brep=bbox.Box)  # -> Faces, Edges, Vertices
area = Area(Geometry=debrep.Faces)  # -> Area, Centroid
pdecon = Deconstruct(Point=area.Centroid)  # -> XComponent, YComponent, ZComponent
sort = SortList(Keys=pdecon.ZComponent, ValuesA=debrep.Faces)  # -> Keys, ValuesA
item = ListItem(List=sort.ValuesA, Index=0, Wrap=True)
area_2 = Area(Geometry=item)  # -> Area, Centroid
scale = Scale(Geometry=item, Center=area_2.Centroid, Factor=Slider(1.3, range=0..10))  # -> Geometry, Transform
custom_mesh_settings = SettingsCustom(
    StitchSeams=True,
    SimplePlanes=False,
    Refine=True,
    MinCount=16,
    MaxCount=400,
    AspectRatio=20,
    MaxDistance=0,
    MaxAngle=20,
    MinEdge=number_slider,
    MaxEdge=number_slider)
rotate = Rotate(Geometry=scale.Geometry, Angle=degrees(number_slider_2), Plane=PlaneXY(0, 0, 0))  # -> Geometry, Transform
mesh_2 = Mesh(meshcap)
Z = UnitZ(Factor=Slider(22, range=0..100))
mesh_3 = MeshBrep(Brep=rotate.Geometry, Settings=custom_mesh_settings)
move = Move(Geometry=mesh_3, Motion=Z)  # -> Geometry, Transform
warpweft = WarpWeft(Mesh=move.Geometry)  # -> Warp, Weft, NakedA, NakedB
crv = Curve(warpweft.Weft)
crv_2 = Curve(warpweft.Warp)
demesh = DeconstructMesh(Mesh=move.Geometry)  # -> Vertices, Faces, Colours, Normals
join = JoinCurves(Curves=crv, Preserve=False)
join_2 = JoinCurves(Curves=crv_2, Preserve=False)
area_3 = MeshArea(Mesh=move.Geometry)  # -> Area, Centroid
mesh_4 = Mesh(move.Geometry)
merge = Merge(Data1=join_2, Data2=join)
Z_2 = UnitZ(Factor=-0.01)
anchorxyz = AnchorXYZ(Point=area_3.Centroid, X=True, Y=True, Z=False, Strength=1000)
show = Show(G=mesh_4)
spc = SolidPointCollide(Points=demesh.Vertices, Solid=mesh_2, Interior=False, Unidirectional=True, Strength=Slider(10, range=0..10))
load = Load(Point=demesh.Vertices, ForceVector=Z_2)
crv_3 = Curve(merge)
rod = Rod(Polyline=crv_3, LengthFactor=1, AngleFactor=1, AxialStrength=10, BendStrength=1)
merge_2 = Merge(Data1=rod, Data2=load, Data3=spc, Data4=anchorxyz)
entwine = Entwine(Branch00=show, Branch01=merge_2, FlattenInputs=True)  # -> simplify(Result)
zombiesolver = ZombieSolver(GoalObjects=entwine, Threshold=1e-10, Tolerance=0.0001, MaxIterations=Slider(3000, range=0..10000))  # -> I, V, O
bbox_2 = BoundingBox(Content=get_geometry, Plane=PlaneXY(0, 0, 0))  # -> Box, Box_2
clean = CleanTree(RemoveNulls=True, RemoveInvalid=True, RemoveEmpty=False, Tree=zombiesolver.O)
debrep_2 = DeconstructBrep(Brep=bbox_2.Box)  # -> Faces, Edges, Vertices
area_4 = Area(Geometry=debrep_2.Faces)  # -> Area, Centroid
objecttypesort = CSharpScript(geo=clean)  # -> out, Pt, Crv, Mesh, Brep, Srf; inputs geo: list of GeometryBase
# ---------- objecttypesort: C# ----------
    List<Rhino.Geometry.Point> Pts = new List<Rhino.Geometry.Point>();
    List<Curve> Crvs = new List<Curve>();
    List<Mesh> Meshes = new List<Mesh>();
    List<Brep> Breps = new List<Brep>();
    List<Brep> Srfs = new List<Brep>();


    foreach(GeometryBase x in geo){
      Rhino.DocObjects.ObjectType objectType = x.ObjectType;
      switch(objectType){
        case Rhino.DocObjects.ObjectType.Point: Pts.Add(x as Rhino.Geometry.Point);
          break;
        case Rhino.DocObjects.ObjectType.Curve: Crvs.Add(x as Curve);
          break;
        case Rhino.DocObjects.ObjectType.Mesh: Meshes.Add(x as Mesh);
          break;
        case Rhino.DocObjects.ObjectType.Brep:
          Brep brepObj = x as Brep;
          if(brepObj.IsSurface){
            Srfs.Add(brepObj);
          } else {
            Breps.Add(brepObj);
          }
          break;


      }
    }
    Pt = Pts;
    Crv = Crvs;
    Mesh = Meshes;
    Brep = Breps;
    Srf = Srfs;
# ---------- end objecttypesort ----------
crv_4 = Curve(objecttypesort.Crv)
pdecon_2 = Deconstruct(Point=area_4.Centroid)  # -> XComponent, YComponent, ZComponent
sort_2 = SortList(Keys=pdecon_2.ZComponent, ValuesA=debrep_2.Faces)  # -> Keys, ValuesA
join_3 = JoinCurves(Curves=crv_4, Preserve=False)
item_2 = ListItem(List=sort_2.ValuesA, Index=0, Wrap=True)
clean_2 = CleanTree(RemoveNulls=True, RemoveInvalid=True, RemoveEmpty=True, Tree=join_3)
mesh_5 = Mesh(objecttypesort.Mesh)
area_5 = Area(Geometry=item_2)  # -> Area, Centroid
crv_5 = Curve(clean_2)
scale_2 = Scale(Geometry=item_2, Center=area_5.Centroid, Factor="1.1")  # -> Geometry, Transform
edges = BrepEdges(Brep=scale_2.Geometry)  # -> Naked, Interior, NonManifold
scale_3 = Scale(Geometry=edges.Naked, Center=area_5.Centroid, Factor="1.1")  # -> Geometry, Transform
trim = TrimWithBrep(Curve=crv_5, Brep=bbox_2.Box)  # -> Inside, Outside

# ---- group: Ground Plane Preview
preview = CustomPreview(Geometry=scale_2.Geometry, Shader="Gray")

# ----
crv_6 = Curve(flatten(trim.Inside))
end = EndPoints(Curve=crv_6)  # -> Start, End
rectangle = Rectangle(Plane=PlaneXY(0, 0, 0), XSize="0.05", YSize=".08", Radius=0)  # -> Rectangle, Length
pframe = PerpFrame(Curve=reparameterize(crv_6), Parameter="0")
pln = Plane(rectangle.Rectangle)
orient = Orient(Geometry=graft(rectangle.Rectangle), Source=pln, Target=pframe)  # -> graft(Geometry), Transform
xy = XYPlane(Origin=Point(0, 0, 0))
xy_2 = XYPlane(Origin=Point(0, 0, 0))
reb = RebuildCurve(Curve=crv_6, Degree="3", Count=Slider(29, range=0..100), Tangents=False)
curvature = Curvature(Curve=reparameterize(reb), Parameter="0.5")  # -> P, K, C
devec = DeconstructVector(Vector=curvature.K)  # -> XComponent, YComponent, ZComponent
msplit = MeshSplitPlane(Mesh=mesh_5, Plane=xy_2)  # -> Above, Below
sec = MeshPlane(Mesh=mesh_5, Plane=xy)
graft = GraftTree(Tree=reb, IncludeEmptyLists=True, IncludeNullItems=True)
vec = VectorXYZ(XComponent=devec.XComponent, YComponent=devec.YComponent, ZComponent=devec.ZComponent)  # -> Vector, Length
len = Length(Curve=reb)
crvgraph = CurvatureGraph(Curve=reb, Density=5, Scale=105)
swp1 = Sweep1(Rail=graft, Sections=orient.Geometry, Miter=1)
division = Division(A=Slider(1, range=0..1), B=vec.Length)
reb_2 = RebuildCurve(Curve=sec, Degree="3", Count=Slider(100, range=0..100), Tangents=False)
sort_3 = SortList(Keys=reb, ValuesA=len)  # -> Keys, ValuesA
sort_4 = SortList(Keys=division, ValuesA=reb)  # -> Keys, ValuesA
mesh_colours = MeshColours(Mesh=msplit.Above, Colours=ColourSwatch(SwatchColor=RGBA(205, 255, 255, 116)))
boundary = BoundarySurfaces(Edges=reb_2, UseTasks=False)
item_3 = ListItem(List=reverse(sort_3.Keys), Index=0, Wrap=True)
item_4 = ListItem(List=sort_3.Keys, Index=0, Wrap=True)
lng = ListLength(List=reb)
item_5 = ListItem(List=reverse(sort_4.Keys), Index=0, Wrap=True)
item_6 = ListItem(List=sort_4.Keys, Index=0, Wrap=True)
mesh_colours_2 = MeshColours(Mesh=swp1, Colours=ColourSwatch(SwatchColor=RGB(103, 11, 12)))
mcol = MeshColours(Mesh=boundary, Colours=ColourSwatch(SwatchColor=RGB(230, 230, 230)))
panel = Panel(lng)
panel_2 = Panel(item_4)
panel_3 = Panel(item_3)
# DATA
# Increase this slider (after first running the
# relaxation with it set at 1) to enforce the
# length constraint more strongly.
# This sphere can be replaced with
# a closed solid of any shape
# Fixing a point in the middle of the mesh to
# only move vertically stops it from sliding of
# the side of the sphere.
panel_4 = Panel(item_6)
panel_5 = Panel(item_5)

# ---- group: RH_OUT:base
mesh_6 = Mesh(mcol)

# ---- group: RH_OUT:gridshell_curve
curve = Curve(reb)

# ---- group: RH_OUT:glass_mesh
mesh_7 = Mesh(mesh_colours)

# ---- group: RH_OUT:gridshell_mesh
mesh_8 = Mesh(mesh_colours_2)
