# Grasshopper definition skyglazer final mesh.gh (Grasshopper 1.0.7)
# plug-ins: LunchBox, Pufferfish, Parakeet

# ---- group: RH_IN:showArcs
# LAYER OPTIONS
boolean_toggle = BooleanToggle(True)

# ---- group: RH_IN:showTerrain
boolean_toggle_2 = BooleanToggle(True)

# ---- group: RH_IN:showBoundary
boolean_toggle_3 = BooleanToggle(True)

# ---- group: RH_IN:showPath
boolean_toggle_4 = BooleanToggle(True)

# ---- group: RH_IN:showPeople
boolean_toggle_5 = BooleanToggle(True)

# ---- group: RH_IN:showTrees
boolean_toggle_6 = BooleanToggle(True)

# ---- group: RH_IN:showWireframe
# PANELIZATION
boolean_toggle_7 = BooleanToggle(True)

# ----
rh_in_panelgroupingtype = GetInteger(Slider(1, range=0..2), AtLeast=1, AtMost=1, Maximum=2147483647, Minimum=-2147483648, TreeAccess=False)
# GROUPING
rh_in_showgroupnumbers = GetBoolean(Toggle(False), AtLeast=1, AtMost=1, FalseValue="False", TreeAccess=False, TrueValue="True")
rh_in_paneltypenumber = GetInteger(Slider(14, range=0..100), AtLeast=1, AtMost=1, Maximum=2147483647, Minimum=-2147483648, TreeAccess=False)

rh_in_udivisions = GetNumber(Slider(19, range=0..100), AtLeast=1, AtMost=1, Maximum=1.797693135e+308, Minimum=-1.797693135e+308, TreeAccess=False)
rh_in_vdivisions = GetNumber(Slider(12, range=0..100), AtLeast=1, AtMost=1, Maximum=1.797693135e+308, Minimum=-1.797693135e+308, TreeAccess=False)
rh_in_paneltype = GetInteger(Slider(2, range=0..2), AtLeast=1, AtMost=1, Maximum=2147483647, Minimum=-2147483648, TreeAccess=False)

# ----
# ARCS
rh_in_arcradius1 = GetNumber(Slider(7, range=0..10), AtLeast=1, AtMost=1, Maximum=1.797693135e+308, Minimum=-1.797693135e+308, TreeAccess=False)
rh_in_arcradius2 = GetNumber(Slider(3, range=0..10), AtLeast=1, AtMost=1, Maximum=1.797693135e+308, Minimum=-1.797693135e+308, TreeAccess=False)
rh_in_arcradius3 = GetNumber(Slider(2, range=0..10), AtLeast=1, AtMost=1, Maximum=1.797693135e+308, Minimum=-1.797693135e+308, TreeAccess=False)
rh_in_arcradius4 = GetNumber(Slider(2, range=0..10), AtLeast=1, AtMost=1, Maximum=1.797693135e+308, Minimum=-1.797693135e+308, TreeAccess=False)

rh_in_showcolour = GetBoolean(Toggle(True), AtLeast=1, AtMost=1, FalseValue="False", TreeAccess=False, TrueValue="True")
# COLOURING
rh_in_colourtype = GetNumber(Slider(1, range=0..2), AtLeast=1, AtMost=1, Maximum=1.797693135e+308, Minimum=-1.797693135e+308, TreeAccess=False)

mesh = Mesh()
# CONTROL POINTS
# SITE
crv = Curve(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)
mesh_2 = GetGeometry(mesh, AtLeast=1, AtMost=2147483647, DeleteInput=False, Filter=1073741840, TreeAccess=False)
curve = GetGeometry(crv, AtLeast=1, AtMost=1, DeleteInput=False, Filter=1074004029, TreeAccess=False)
merge = Merge(Data1=rh_in_arcradius1, Data2=rh_in_arcradius2, Data3=rh_in_arcradius3, Data4=rh_in_arcradius4)
mesh_3 = Mesh(<mesh referenced from the Rhino model>)  # disabled
mesh_4 = Mesh(mesh_3)  # disabled
meshcap = MeshCap(Mesh=mesh_4)  # disabled

# ---- group: RH_OUT:mesh
mesh_5 = Mesh(mesh_2)

# ----
bbox = BoundingBox(Content=meshcap, Plane=PlaneXY(0, 0, 0))  # -> Box, Box_2; disabled
debrep = DeconstructBrep(Brep=bbox.Box)  # -> Faces, Edges, Vertices; disabled
area = Area(Geometry=debrep.Faces)  # -> Area, Centroid; disabled
pdecon = Deconstruct(Point=area.Centroid)  # -> XComponent, YComponent, ZComponent; disabled
sort = SortList(Keys=pdecon.ZComponent, ValuesA=debrep.Faces)  # -> Keys, ValuesA; disabled
item = ListItem(List=sort.ValuesA, Index=0, Wrap=True)  # disabled
debrep_2 = DeconstructBrep(Brep=item)  # -> Faces, Edges, Vertices; disabled
item_2 = ListItem(List=debrep_2.Edges, Index=0, Wrap=True)  # disabled
divide = DivideCurve(Curve=item_2, Count=10, Kinks=False)  # -> reverse(Points), Tangents, Parameters; disabled
yz = YZPlane(Origin=divide.Points)  # disabled
sec = MeshPlane(Mesh=mesh_3, Plane=yz)  # disabled
crv_2 = Curve(sec)  # disabled
crv_3 = Curve(crv_2)  # disabled
xy = XYPlane(Origin=Point(0, 0, 0))  # disabled
pcx = CurvePlane(Curve=crv_3, Plane=xy)  # -> Points, ParamsC, ParamsP; disabled
shatter = Shatter(Curve=graft(crv_3), Parameters=pcx.ParamsC)  # disabled
combine = CombineData(Input0=shatter, Input1=graft(crv_3))  # -> Result, Index; disabled
curvepoint = PointOnCurve(combine.Result, parameter=0.5)  # disabled
pdecon_2 = Deconstruct(Point=curvepoint)  # -> XComponent, YComponent, ZComponent; disabled
panel = Panel("0")  # disabled
larger = LargerThan(FirstNumber=pdecon_2.ZComponent, SecondNumber=panel)  # -> LargerThan, OrEqualTo; disabled
number_slider = Slider(0.1, range=0..0.1)  # disabled
dispatch = Dispatch(List=combine.Result, DispatchPattern=larger.LargerThan)  # -> ListA, ListB; disabled
xy_2 = XYPlane(Origin=Point(0, 0, 0))  # disabled
Z = UnitZ(Factor=number_slider)  # disabled
crv_4 = Curve(dispatch.ListA)  # disabled
move = Move(Geometry=xy_2, Motion=Z)  # -> Geometry, Transform; disabled
srf = Surface(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)
sec_2 = MeshPlane(Mesh=mesh_3, Plane=move.Geometry)  # disabled
number_slider_2 = Slider(34, range=0..100)  # disabled
panel_2 = Panel("3")  # disabled
number_slider_3 = Slider(7, range=0..10)  # disabled
reb = RebuildCurve(Curve=sec_2, Degree=panel_2, Count=number_slider_2, Tangents=False)  # disabled
number_slider_4 = Slider(50, range=0..100)  # disabled
panel_3 = Panel("3")  # disabled
rebcrv = RebuildCurve(Curve=crv_4, Count=number_slider_3, Degree=panel_3, EndTangents=False)  # disabled
srf_2 = Surface(srf)
number_slider_5 = Slider(40, range=0..100)  # disabled
patch = Patch(Curves=flatten([reb, rebcrv]), Spans=number_slider_4, Flexibility=1, Trim=False)  # disabled
rebsrf = RebuildSurface(Surface=patch, DomainU=number_slider_5, DomainV=number_slider_5)  # disabled
stream_gate = StreamGate(Stream=srf_2, Gate=rh_in_paneltype)  # -> Target0, Target1, Target2
deconstruct_brep = DeconstructBrep(Brep=srf_2)  # -> Faces, Edges, Vertices
list_item = ListItem(List=deconstruct_brep.Edges, Index=0, Wrap=True)  # -> Item, Item1, Item2
curve_2 = Curve(list_item.Item2)
curve_3 = Curve(list_item.Item)
triangular_panels_a = TriangularPanelsA(Surface=stream_gate.Target1, UDivisions=rh_in_udivisions, VDivisions=rh_in_vdivisions)
quad_panels = QuadPanels(Surface=stream_gate.Target0, UDivisions=rh_in_udivisions, VDivisions=rh_in_vdivisions)
diamond_panels = DiamondPanels(Surface=stream_gate.Target2, UDivisions=rh_in_udivisions, VDivisions=rh_in_vdivisions)  # -> DiamondPanels, TriPanels
bounding_box = BoundingBox(Content=[curve_3, curve_2], Plane=PlaneXY(0, 0, 0), UnionBox=True)  # -> Box, Box_2
area_2 = Area(Geometry=bounding_box.Box)  # -> Area, Centroid
end_points = EndPoints(Curve=curve_2)  # -> Start, End
end_points_2 = EndPoints(Curve=curve_3)  # -> Start, End
surface = Surface([triangular_panels_a, quad_panels, diamond_panels.DiamondPanels, diamond_panels.TriPanels])
mesh_6 = Mesh([quad_panels, triangular_panels_a, diamond_panels.DiamondPanels, diamond_panels.TriPanels])
line = Line(StartPoint=end_points_2.Start, EndPoint=end_points.End)
scale_nu = ScaleNU(Geometry=bounding_box.Box, Plane=area_2.Centroid, ScaleX=Slider(1.5, range=0..10), ScaleY=1, ScaleZ=1)  # -> Geometry, Transform
line_2 = Line(StartPoint=end_points_2.End, EndPoint=end_points.Start)
deconstruct_brep_2 = DeconstructBrep(Brep=scale_nu.Geometry)  # -> Faces, Edges, Vertices
list_item_2 = ListItem(List=deconstruct_brep_2.Faces, Index=0, Wrap=True)  # -> Item, Item1, Item2, Item3, Item4
join_curves = JoinCurves(Curves=[curve_3, curve_2, line_2, line], Preserve=False)
split_brep = SplitBrep(Brep=list_item_2.Item4, Cutter=join_curves)  # disabled
list_item_3 = ListItem(List=split_brep, Index=0, Wrap=True)  # -> Item, Item1, Item2; disabled
surface_2 = Surface(list_item_2.Item4)
graft_tree = GraftTree(Tree=mesh_6, IncludeEmptyLists=True, IncludeNullItems=True)
graft_tree_2 = GraftTree(Tree=surface, IncludeEmptyLists=True, IncludeNullItems=True)
no_of_divisions = Panel(rh_in_paneltypenumber)
construct_domain = ConstructDomain(DomainStart=0, DomainEnd=1)
area_3 = Area(Geometry=graft_tree)  # -> Area, Centroid
surface_closest_point = SurfaceClosestPoint(Point=area_3.Centroid, Surface=graft_tree_2)  # -> Point, UVPoint, Distance
surface_3 = Surface(surface_2)
principal_curvature = PrincipalCurvature(Surface=srf_2, Point=surface_closest_point.UVPoint)  # -> Frame, Maximum, Minimum, MaxDirection, MinDirection
range = Range(Domain=construct_domain, Steps=no_of_divisions)
divide_domain = DivideDomain(Domain=construct_domain, Count=no_of_divisions)
deconstruct = Deconstruct(Point=area_3.Centroid)  # -> XComponent, YComponent, ZComponent
settings_custom = SettingsCustom(
    StitchSeams=True,
    SimplePlanes=False,
    Refine=True,
    MinCount=16,
    MaxCount=400,
    AspectRatio=20,
    MaxDistance=0,
    MaxAngle=20,
    MinEdge="0.5",
    MaxEdge="0.5")
list_item_4 = ListItem(List=range, Index=0, Wrap=True)  # -> Item, Item1
multiplication = Multiplication(A=principal_curvature.Maximum, B=principal_curvature.Minimum)
deconstruct_domain = DeconstructDomain(Domain=construct_domain)  # -> Start, End
list_length = ListLength(List=flatten(area_3.Centroid))
bounds = Bounds(Numbers=flatten(multiplication))
subtraction = Subtraction(A=list_item_4.Item1, B=list_item_4.Item)
bounds_2 = Bounds(Numbers=flatten(deconstruct.YComponent))
mesh_brep = MeshBrep(Brep=surface_3, Settings=settings_custom)
division = Division(A=subtraction, B="2")
remap_numbers = RemapNumbers(Value=multiplication, Source=bounds, Target=Domain(0, 1))  # -> Mapped, Clipped
construct_domain_2 = ConstructDomain(DomainStart=0, DomainEnd=1)
addition = Addition(A=range, B=division)
mesh_7 = Mesh(mesh_brep)
mesh_8 = Mesh(mesh_7)
remap_numbers_2 = RemapNumbers(Value=deconstruct.YComponent, Source=bounds_2, Target=construct_domain)  # -> Mapped, Clipped
last_index = LastIndex(List=addition)
demesh = DeconstructMesh(Mesh=mesh_8)  # -> Vertices, Faces, Colours, Normals
random = Random(Range=construct_domain_2, Number=list_length, Seed=2)  # -> graft(Random)
bnd = Bounds(Numbers=demesh.Vertices)
cull_index = CullIndex(List=addition, Indices=last_index, Wrap=True)
gradient = Gradient(
    LowerLimit=deconstruct_domain.Start,
    UpperLimit=deconstruct_domain.End,
    Parameter=cull_index,
    stops=[0.15: RGB(255, 130, 160), 0.85: RGB(220, 0, 40)])
gradient_2 = Gradient(
    LowerLimit=deconstruct_domain.Start,
    UpperLimit=deconstruct_domain.End,
    Parameter=cull_index,
    stops=[0: RGB(243, 57, 0), 0.1: RGB(236, 27, 60), 0.2: RGB(210, 0, 118), 0.3: RGB(103, 0, 120), 0.4: RGB(39, 72, 161), 0.5: RGB(1, 192, 229), 0.6: RGB(18, 178, 90), 0.7: RGB(79, 186, 8), 0.8: RGB(220, 237, 32), 0.9: RGB(247, 159, 20), 1: RGB(243, 57, 0)])
gradient_3 = Gradient(
    LowerLimit=deconstruct_domain.Start,
    UpperLimit=deconstruct_domain.End,
    Parameter=cull_index,
    stops=[0: RGB(234, 38, 0), 0.25: RGB(234, 126, 0), 0.5: RGB(254, 244, 84), 0.75: RGB(173, 203, 249), 1: RGB(75, 107, 169)])
remap = RemapNumbers(Value=demesh.Vertices, Source=bnd, Target=Domain(0, 1))  # -> Mapped, Clipped
stream_filter = StreamFilter(Gate=rh_in_panelgroupingtype, Stream0=remap_numbers.Mapped, Stream1=remap_numbers_2.Mapped, Stream2=random)
includes = Includes(Value=stream_filter, Domain=divide_domain)  # -> Includes, Deviation
graph = GraphMapper(
    remap.Mapped,
    x0=0,
    x1=1,
    y0=0,
    y1=1,
    amplitude=0.218028605,
    container_name="Perlin",
    decay=1,
    frequency=0.03698211908,
    x_offset=0.5846650004,
    y_offset=0.4053633809)
surface_4 = Surface(flatten(surface_2))
gradient_4 = Gradient(LowerLimit="0", UpperLimit="1", Parameter=graph, stops=[0.28: RGB(212, 255, 38), 0.945: RGB(255, 255, 255)])
negative = Negative(Value="1.5")
stream_filter_2 = StreamFilter(Gate=rh_in_colourtype, Stream0=gradient_3, Stream1=gradient_2, Stream2=gradient)
member_index = MemberIndex(Set=includes.Includes, Member=Toggle(True))  # -> Index, Count
offset_curve = OffsetCurve(Curve=surface_4, Plane=PlaneXY(0, 0, 0), Distance=negative, BothSides=0, Kinks=0, CapType=1)
conmesh = ConstructMesh(Vertices=demesh.Vertices, Faces=demesh.Faces, Colours=gradient_4)
list_item_5 = ListItem(List=stream_filter_2, Index=member_index.Index, Wrap=True)  # -> simplify(Item)

# ---- group: dud
curve_4 = Curve(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)

# ----
number_slider_6 = Slider(10, range=0..100)
mblur = BlurMesh(Mesh=conmesh, Iterations=Slider(0, range=0..5))
surface_5 = Surface(offset_curve)
curve_5 = Curve(curve_4)
multiplication_2 = Multiplication(A=number_slider_6, B=Slider(2, range=0..10))
mesh_9 = Mesh(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)
colours = Data(flatten(list_item_5))
create_set = CreateSet(List=colours)  # -> Set, Map
construct_domain_3 = ConstructDomain(DomainStart=Slider(0, range=0..100), DomainEnd=Slider(433, range=0..1000))
mesh_10 = Data(simplify(flatten(graft_tree)))
populate_geometry = PopulateGeometry(Geometry=surface_5, Count=number_slider_6, Seed=Slider(50, range=0..100))  # -> flatten(Population)
member_index_2 = MemberIndex(Set=colours, Member=create_set.Set)  # -> Index, Count
mesh_colours = MeshColours(Mesh=graft_tree, Colours=list_item_5)
plane = Plane(populate_geometry)
random_2 = Random(Range=construct_domain_3, Number=multiplication_2, Seed=Slider(52, range=0..100))
list_item_organised_meshes = ListItem(List=mesh_10, Index=member_index_2.Index, Wrap=True)
list_indices = ListIndices(List=create_set.Set)
volume = Volume(Geometry=mesh_9)  # -> Volume, Centroid
project = Project(Geometry=volume.Centroid, Plane=PlaneXY(0, 0, 0))  # -> Geometry, Transform
lng = ListLength(List=random_2)
random_3 = Random(Range=Domain(0, 1), Number=Slider(5, range=0..100), Seed=Slider(4, range=0..10))
stream_filter_3 = StreamFilter(Gate=boolean_toggle_7, Stream1=surface)
stream_filter_4 = StreamFilter(Gate=boolean_toggle_2, Stream1=mblur)
graft_tree_3 = GraftTree(Tree=list_indices, IncludeEmptyLists=True, IncludeNullItems=True)
area_4 = Area(Geometry=list_item_organised_meshes)  # -> Area, Centroid
pt = Point(project.Geometry)
rotate = Rotate(Geometry=plane, Angle=degrees(random_2), Plane=plane)  # -> Geometry, Transform
stream_filter_5 = StreamFilter(Gate=boolean_toggle, Stream1=curve_5)
deconstruct_brep_3 = DeconstructBrep(Brep=stream_filter_3)  # -> Faces, Edges, Vertices
x_plus_one = XPlusOne(NumberX=graft_tree_3)
curve_6 = Curve(join_curves)
orient = Orient(Geometry=mesh_9, Source=pt, Target=rotate.Geometry)  # -> Geometry, Transform
stream_filter_6 = StreamFilter(Gate=boolean_toggle_3, Stream1=curve_6)
random_4 = Random(Range=Domain(0.5, 1), Number=lng, Seed=2)
evaluate_curve = EvaluateCurve(Curve=reparameterize(curve_4), Parameter=random_3)  # -> Point, Tangent, Angle
stream_filter_7 = StreamFilter(Gate=rh_in_paneltype, Stream0="Quad", Stream1="Triangular", Stream2="Diamond")
stream_filter_8 = StreamFilter(Gate=boolean_toggle_4, Stream1=curve_4)
curve_boundary = Curve(stream_filter_6)
c_script = CSharpScript(face="Arial", bold=Toggle(False), size=Slider(0.781, range=0..11), content=x_plus_one, pl=area_4.Centroid)  # -> out, A; inputs face: String, bold: Boolean, italics: Boolean, size: Double, content: String, pl: Plane
# ---------- c_script: C# usings ----------
using System.IO;
using System.Linq;
using System.Data;
using System.Drawing;
using System.Reflection;
using System.Windows.Forms;
using System.Xml;
using System.Xml.Linq;
using System.Runtime.InteropServices;

using Rhino.DocObjects;
using Rhino.Collections;
using GH_IO;
using GH_IO.Serialization;
# ---------- c_script: C# ----------
    if(size == 0)
      size = 1;

    if(!string.IsNullOrEmpty(face) && size > 0 && !string.IsNullOrEmpty(content) &&
      pl.IsValid)
    {
      using (var doc = Rhino.RhinoDoc.CreateHeadless(null))
      {
        var te = doc.Objects.AddText(content, pl, size, face, bold, italics);
        var txt = doc.Objects.Find(te) as Rhino.DocObjects.TextObject;

        if(txt != null)
        {
          var tt = txt.Geometry as Rhino.Geometry.TextEntity;
          A = tt.Explode();
        }
      }
    }
# ---------- end c_script ----------
stream_filter_9 = StreamFilter(Gate=rh_in_colourtype, Stream0="heat", Stream1="rainbow", Stream2="red")
stream_filter_10 = StreamFilter(Gate=rh_in_colourtype, Stream0="curvature", Stream1="x-axis", Stream2="scattered")
scale = Scale(Geometry=orient.Geometry, Center=rotate.Geometry, Factor=random_4)  # -> simplify(graft(Geometry)), Transform
area_5 = Area(Geometry=srf_2)  # -> Area, Centroid
list_length_2 = ListLength(List=evaluate_curve.Point)
demesh_2 = DeconstructMesh(Mesh=scale.Geometry)  # -> simplify(Vertices), Faces, Colours, Normals
length = Length(Curve=curve_4)
list_length_3 = ListLength(List=flatten(list_item_5))
stream_filter_11 = StreamFilter(Gate=rh_in_showgroupnumbers, Stream1=c_script.A)
pdecon_3 = Deconstruct(Point=demesh_2.Vertices)  # -> XComponent, YComponent, ZComponent
integer = Integer(list_length_3)
integer_2 = Integer(flatten(length))
offset_mesh = OffsetMesh(Mesh=graft_tree, Distance=Slider(0.2, range=0..1), BothSides=0, CreateSolid=True)
integer_3 = Integer(area_5.Area)
integer_4 = Integer(rh_in_paneltypenumber)
custom_preview = CustomPreview(Geometry=offset_mesh, Material=list_item_5)
bnd_2 = Bounds(Numbers=pdecon_3.ZComponent)
remap_2 = RemapNumbers(Value=pdecon_3.ZComponent, Source=bnd_2, Target=Domain(0, 1))  # -> Mapped, Clipped
c_script_2 = CSharpScript(mesh=simplify(offset_mesh), color=list_item_5)  # -> out, A; inputs mesh: Mesh, color: Color
# ---------- c_script_2: C# ----------
    var c = color.R + "," + color.G + "," + color.B;
    mesh.SetUserString("color", c);
    A = mesh;
# ---------- end c_script_2 ----------
gradient_5 = Gradient(
    LowerLimit=0,
    UpperLimit=1,
    Parameter=remap_2.Mapped,
    stops=[0: RGB(132, 196, 29), 0.359: RGB(105, 214, 130), 0.789: RGB(164, 219, 101)])
stream_filter_12 = StreamFilter(Gate=rh_in_showcolour, Stream1=c_script_2.A)
mcol = MeshColours(Mesh=scale.Geometry, Colours=gradient_5)
mesh_11 = Mesh(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)
plane_2 = Plane(evaluate_curve.Point)
random_5 = Random(Range=Domain(0, 360), Number=list_length_2, Seed=Slider(42, range=0..100))

# ---- group: RH_OUT:sky_visibility_area
# DATA OUTPUT
data = Data(flatten(integer_3))

# ---- group: RH_OUT:panel_type
data_2 = Data(flatten(stream_filter_7))

# ---- group: RH_OUT:central_path_length
data_3 = Data(flatten(integer_2))

# ---- group: RH_OUT:colour_gradient
data_4 = Data(flatten(stream_filter_9))

# ---- group: RH_OUT:panel_type_number
data_5 = Data(flatten(integer_4))

# ---- group: RH_OUT:grouping_type
data_6 = Data(flatten(stream_filter_10))

# ---- group: RH_OUT:panel_number
data_7 = Data(flatten(integer))

# ----
volume_2 = Volume(Geometry=mesh_11)  # -> Volume, Centroid
mblur_2 = BlurMesh(Mesh=mcol, Iterations=Slider(1, range=0..5))
sky_visibility_area = Panel(data)
central_path_length = Panel(data_3)
colour_gradient = Panel(data_4)
grouping_type = Panel(data_6)
panel_type = Panel(data_2)
panel_number = Panel(data_7)
panel_type_number = Panel(data_5)
project_2 = Project(Geometry=volume_2.Centroid, Plane=PlaneXY(0, 0, 0))  # -> Geometry, Transform
pt_2 = Point(project_2.Geometry)
rotate_2 = Rotate(Geometry=plane_2, Angle=degrees(random_5), Plane=plane_2)  # -> Geometry, Transform
stream_filter_13 = StreamFilter(Gate=boolean_toggle_6, Stream1=mblur_2)
orient_2 = Orient(Geometry=mesh_11, Source=pt_2, Target=rotate_2.Geometry)  # -> Geometry, Transform
lng_2 = ListLength(List=random_5)
random_6 = Random(Range=Domain(0.85, 1), Number=lng_2, Seed=2)
scale_2 = Scale(Geometry=orient_2.Geometry, Center=rotate_2.Geometry, Factor=random_6)  # -> Geometry, Transform
mesh_colours_2 = MeshColours(Mesh=scale_2.Geometry, Colours=ColourSwatch(SwatchColor=RGB(255, 255, 255)))
stream_filter_14 = StreamFilter(Gate=boolean_toggle_5, Stream1=mesh_colours_2)

# ---- group: RH_OUT:panel_group_numbers
curve_7 = Curve(stream_filter_11)

# ---- group: RH_OUT:colour
# GEOMETRY OUTPUT
mesh_12 = Mesh(stream_filter_12)

# ---- group: RH_OUT:curve_arcs
curve_arcs = Curve(flatten(stream_filter_5))

# ---- group: RH_OUT:curve_path
curve_path = Curve(flatten(stream_filter_8))

# ---- group: RH_OUT:terrain
mesh_13 = Mesh(flatten(stream_filter_4))

# ---- group: RH_OUT:curve_boundary
curve_8 = Curve(flatten(curve_boundary))

# ---- group: RH_OUT:people
geometry_people = Geometry(flatten(stream_filter_14))

# ---- group: RH_OUT:trees
geometry_trees = Geometry(flatten(stream_filter_13))

# ---- group: RH_OUT:edge_curves
# DATA
curve_9 = Curve(flatten(deconstruct_brep_3.Edges))
