# Grasshopper definition skyglazer final meshTESTINGv3.gh (Grasshopper 1.0.7)
# plug-ins: LunchBox, Pufferfish, LunchBoxML, Kangaroo2 Components, Kangaroo Components

# ---- group: RH_IN:showPeople
boolean_toggle = BooleanToggle(False)

# ---- group: RH_IN:showTerrain
# LAYER OPTIONS
boolean_toggle_2 = BooleanToggle(False)

# ---- group: RH_IN:showTrees
boolean_toggle_3 = BooleanToggle(False)

# ----
# GROUPING
rh_in_showgroupnumbers = GetBoolean(Toggle(False), AtLeast=1, AtMost=1, FalseValue="False", TreeAccess=False, TrueValue="True")
rh_in_paneltypenumber = GetInteger(Slider(6, range=0..100), AtLeast=1, AtMost=1, Maximum=2147483647, Minimum=-2147483648, TreeAccess=False)
rh_in_panelgroupingtype = GetInteger(Slider(2, range=0..2), AtLeast=1, AtMost=1, Maximum=2147483647, Minimum=-2147483648, TreeAccess=False)

# ----
# COLOURING
rh_in_showcolour = GetBoolean(Toggle(False), AtLeast=1, AtMost=1, FalseValue="False", TreeAccess=False, TrueValue="True")
rh_in_colourtype = GetNumber(Slider(0, range=0..2), AtLeast=1, AtMost=1, Maximum=1.797693135e+308, Minimum=-1.797693135e+308, TreeAccess=False)

rh_in_udivisions = GetNumber(Slider(36, range=0..100), AtLeast=1, AtMost=1, Maximum=1.797693135e+308, Minimum=-1.797693135e+308, TreeAccess=False)
rh_in_vdivisions = GetNumber(Slider(26, range=0..100), AtLeast=1, AtMost=1, Maximum=1.797693135e+308, Minimum=-1.797693135e+308, TreeAccess=False)
rh_in_paneltype = GetInteger(Slider(1, range=0..2), AtLeast=1, AtMost=1, Maximum=2147483647, Minimum=-2147483648, TreeAccess=False)

# ----
# PANELIZATION
rh_in_showwireframe = GetBoolean(Toggle(False), AtLeast=1, AtMost=1, FalseValue="False", TreeAccess=False, TrueValue="True")
mesh = Mesh(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)

# ----
# FORM
rh_in_showoriginalmesh = GetBoolean(Toggle(False), AtLeast=1, AtMost=1, FalseValue="False", TreeAccess=False, TrueValue="True")
get_geometry = GetGeometry(mesh, AtLeast=1, AtMost=1, DeleteInput=False, Filter=1074004029, TreeAccess=False)

# ----
# GRIDSHELL
rh_in_showgridshellwireframe = GetBoolean(Toggle(False), AtLeast=1, AtMost=1, FalseValue="False", TreeAccess=False, TrueValue="True")
rh_in_showgridshell = GetBoolean(Toggle(False), AtLeast=1, AtMost=1, FalseValue="False", TreeAccess=False, TrueValue="True")
rh_in_gridangle = GetInteger(Slider(0, range=0..360), AtLeast=1, AtMost=1, Maximum=2147483647, Minimum=-2147483648, TreeAccess=False)
rh_in_gridsize = GetInteger(Slider(2, range=1..5), AtLeast=1, AtMost=1, Maximum=2147483647, Minimum=-2147483648, TreeAccess=False)

# ---- group: mesh drappping
mesh_2 = Mesh(get_geometry)
bbox = BoundingBox(Content=mesh_2, Plane=PlaneXY(0, 0, 0))  # -> Box, Box_2
debrep = DeconstructBrep(Brep=bbox.Box)  # -> Faces, Edges, Vertices
area = Area(Geometry=debrep.Faces)  # -> Area, Centroid
pdecon = Deconstruct(Point=area.Centroid)  # -> XComponent, YComponent, ZComponent
sort = SortList(Keys=pdecon.ZComponent, ValuesA=debrep.Faces)  # -> Keys, ValuesA
custom_mesh_settings = SettingsCustom(
    StitchSeams=True,
    SimplePlanes=False,
    Refine=True,
    MinCount=16,
    MaxCount=400,
    AspectRatio=20,
    MaxDistance=0,
    MaxAngle=20,
    MinEdge=rh_in_gridsize,
    MaxEdge=rh_in_gridsize)
item = ListItem(List=sort.ValuesA, Index=0, Wrap=True)
area_2 = Area(Geometry=item)  # -> Area, Centroid
scale = Scale(Geometry=item, Center=area_2.Centroid, Factor=Slider(2, range=0..10))  # -> Geometry, Transform
rotate = Rotate(Geometry=scale.Geometry, Angle=degrees(rh_in_gridangle), Plane=PlaneXY(0, 0, 0))  # -> Geometry, Transform
mesh_3 = Mesh(mesh_2)
Z = UnitZ(Factor=Slider(22, range=0..100))
mesh_4 = MeshBrep(Brep=rotate.Geometry, Settings=custom_mesh_settings)
move = Move(Geometry=mesh_4, Motion=Z)  # -> Geometry, Transform
warpweft = WarpWeft(Mesh=move.Geometry)  # -> Warp, Weft, NakedA, NakedB
crv = Curve(warpweft.Weft)
crv_2 = Curve(warpweft.Warp)
demesh = DeconstructMesh(Mesh=move.Geometry)  # -> Vertices, Faces, Colours, Normals
join = JoinCurves(Curves=crv, Preserve=False)
join_2 = JoinCurves(Curves=crv_2, Preserve=False)
mesh_5 = Mesh(move.Geometry)
merge = Merge(Data1=join_2, Data2=join)
Z_2 = UnitZ(Factor=-0.01)
show = Show(G=mesh_5)
spc = SolidPointCollide(Points=demesh.Vertices, Solid=mesh_3, Interior=False, Unidirectional=True, Strength=Slider(10, range=0..10))
load = Load(Point=demesh.Vertices, ForceVector=Z_2)
crv_3 = Curve(flatten(merge))
rod = Rod(Polyline=crv_3, LengthFactor=1, AngleFactor=1, AxialStrength=10, BendStrength=Slider(5, range=0..10))
number_slider = Slider(3000, range=0..10000)
merge_2 = Merge(Data1=rod, Data2=load, Data3=spc)
entwine = Entwine(Branch00=show, Branch01=merge_2, FlattenInputs=True)  # -> simplify(Result)
zombiesolver = ZombieSolver(GoalObjects=entwine, Threshold=1e-10, Tolerance=0.0001, MaxIterations=Slider(5000, range=0..10000))  # -> I, V, O
clean = CleanTree(RemoveNulls=True, RemoveInvalid=True, RemoveEmpty=False, Tree=zombiesolver.O)
objecttypesort = CSharpScript(geo=clean)  # -> out, Pt, Crv, Mesh, Brep, Srf; inputs geo: list of GeometryBase
# ---------- objecttypesort: C# ----------
    List<Rhino.Geometry.Point> Pts = new List<Rhino.Geometry.Point>();
    List<Curve> Crvs = new List<Curve>();
    List<Mesh> Meshes = new List<Mesh>();
    List<Brep> Breps = new List<Brep>();
    List<Brep> Srfs = new List<Brep>();


    foreach(GeometryBase x in geo){
      Rhino.DocObjects.ObjectType objectType = x.ObjectType;
      switch(objectType){
        case Rhino.DocObjects.ObjectType.Point: Pts.Add(x as Rhino.Geometry.Point);
          break;
        case Rhino.DocObjects.ObjectType.Curve: Crvs.Add(x as Curve);
          break;
        case Rhino.DocObjects.ObjectType.Mesh: Meshes.Add(x as Mesh);
          break;
        case Rhino.DocObjects.ObjectType.Brep:
          Brep brepObj = x as Brep;
          if(brepObj.IsSurface){
            Srfs.Add(brepObj);
          } else {
            Breps.Add(brepObj);
          }
          break;


      }
    }
    Pt = Pts;
    Crv = Crvs;
    Mesh = Meshes;
    Brep = Breps;
    Srf = Srfs;
# ---------- end objecttypesort ----------

# ----
mesh_6 = Mesh(objecttypesort.Mesh)
bounding_box = BoundingBox(Content=get_geometry, Plane=PlaneXY(0, 0, 0), UnionBox=True)  # -> Box, Box_2
number_slider_2 = Slider(1.05, range=0..10)
scale_nu = ScaleNU(
    Geometry=bounding_box.Box,
    Plane=PlaneXY(0, 0, 0),
    ScaleX=number_slider_2,
    ScaleY=number_slider_2,
    ScaleZ=number_slider_2)  # -> Geometry, Transform
area_3 = Area(Geometry=scale_nu.Geometry)  # -> Area, Centroid
number_slider_3 = Slider(1.5, range=0..10)
warpweft_2 = WarpWeft(Mesh=mesh_6)  # -> Warp, Weft, NakedA, NakedB
bbox_2 = BoundingBox(Content=mesh_2, Plane=PlaneXY(0, 0, 0))  # -> Box, Box_2
warpweft_3 = WarpWeft(Mesh=mesh_6)  # -> Warp, Weft, NakedA, NakedB
scale_nu_2 = ScaleNU(Geometry=scale_nu.Geometry, Plane=area_3.Centroid, ScaleX=number_slider_3, ScaleY=number_slider_3, ScaleZ=1)  # -> Geometry, Transform
Z_3 = UnitZ(Factor="2")
number_slider_4 = Slider(150, range=0..1000)
crv_4 = Curve(warpweft_2.Warp)
move_2 = Move(Geometry=bbox_2.Box, Motion=Z_3)  # -> Geometry, Transform
number_slider_5 = Slider(1.5, range=0..10)
deconstruct_brep = DeconstructBrep(Brep=scale_nu_2.Geometry)  # -> Faces, Edges, Vertices
crv_5 = Curve(warpweft_3.Weft)
crv_6 = Curve(crv_4)
crv_7 = Curve(crv_5)
join_3 = JoinCurves(Curves=crv_6, Preserve=False)
scale_nu_3 = ScaleNU(Geometry=move_2.Geometry, Plane=PlaneXY(0, 0, 0), ScaleX=number_slider_5, ScaleY=number_slider_5, ScaleZ=1)  # -> Geometry, Transform
join_4 = JoinCurves(Curves=crv_7, Preserve=False)
clean_2 = CleanTree(RemoveNulls=True, RemoveInvalid=True, RemoveEmpty=True, Tree=join_3)
list_item = ListItem(List=deconstruct_brep.Faces, Index=0, Wrap=True)  # -> Item, Item1, Item2, Item3, Item4
clean_3 = CleanTree(RemoveNulls=True, RemoveInvalid=True, RemoveEmpty=True, Tree=join_4)
number_slider_6 = Slider(3, range=0..10)
crv_8 = Curve(clean_2)
trim = TrimWithBrep(Curve=crv_8, Brep=scale_nu_3.Geometry)  # -> Inside, Outside
crv_9 = Curve(clean_3)
surface = Surface(list_item.Item4)
crv_10 = Curve(flatten(trim.Inside))
trim_2 = TrimWithBrep(Curve=crv_9, Brep=scale_nu_3.Geometry)  # -> Inside, Outside
crv_11 = Curve(flatten(trim_2.Inside))
scale_2 = Scale(Geometry=surface, Center=Point(0, 0, 0), Factor=Slider(1.3, range=0..10))  # -> Geometry, Transform
len = Length(Curve=crv_10)
division = Division(A=len, B=number_slider_6)
len_2 = Length(Curve=crv_11)
reb = RebuildCurve(Curve=crv_10, Degree="3", Count=division, Tangents=False)
division_2 = Division(A=len_2, B=number_slider_6)
reb_2 = RebuildCurve(Curve=crv_11, Degree="3", Count=division_2, Tangents=False)
end = EndPoints(Curve=[reb, reb_2])  # -> Start, End

# ---- group: frame orientation
len_3 = Length(Curve=reb)
subdmesh = SubDFromMesh(Mesh=mesh_6, Creases=1, Corners=1, Interpolate=False)
division_3 = Division(A=len_3, B="5")
brep = Brep(subdmesh)
debrep_2 = DeconstructBrep(Brep=brep)  # -> Faces, Edges, Vertices
pframes = PerpFrames(Curve=reb, Count=division_3, Align=True)  # -> Frames, Parameters
srf_cp = SurfaceClosestPoint(Point=graft(pframes.Frames), Surface=debrep_2.Faces)  # -> Point, UVPoint, Distance
sort_2 = SortList(Keys=srf_cp.Distance, ValuesA=debrep_2.Faces, ValuesB=srf_cp.UVPoint)  # -> Keys, ValuesA, ValuesB
item_2 = ListItem(List=sort_2.ValuesB, Index=0, Wrap=True)
item_3 = ListItem(List=sort_2.ValuesA, Index=0, Wrap=True)
evalsrf = EvaluateSurface(Surface=item_3, Point=item_2)  # -> Point, Normal, UDirection, VDirection, Frame
align = AlignPlane(Plane=graft(pframes.Frames), Direction=evalsrf.Normal)  # -> Plane, Angle

# ----
area_4 = Area(Geometry=get_geometry)  # -> Area, Centroid
pt = Point([end.Start, end.End])

# ---- group: frame orientation
len_4 = Length(Curve=reb_2)
subdmesh_2 = SubDFromMesh(Mesh=mesh_6, Creases=1, Corners=1, Interpolate=False)
division_4 = Division(A=len_4, B="5")
brep_2 = Brep(subdmesh_2)
debrep_3 = DeconstructBrep(Brep=brep_2)  # -> Faces, Edges, Vertices
pframes_2 = PerpFrames(Curve=reb_2, Count=division_4, Align=True)  # -> Frames, Parameters
srf_cp_2 = SurfaceClosestPoint(Point=graft(pframes_2.Frames), Surface=debrep_3.Faces)  # -> Point, UVPoint, Distance
sort_3 = SortList(Keys=srf_cp_2.Distance, ValuesA=debrep_3.Faces, ValuesB=srf_cp_2.UVPoint)  # -> Keys, ValuesA, ValuesB
item_4 = ListItem(List=sort_3.ValuesB, Index=0, Wrap=True)
item_5 = ListItem(List=sort_3.ValuesA, Index=0, Wrap=True)
evalsrf_2 = EvaluateSurface(Surface=item_5, Point=item_4)  # -> Point, Normal, UDirection, VDirection, Frame
align_2 = AlignPlane(Plane=graft(pframes_2.Frames), Direction=evalsrf_2.Normal)  # -> Plane, Angle

# ----
cir = Circle(Plane=area_4.Centroid, Radius=1)
settings_custom = SettingsCustom(
    StitchSeams=True,
    SimplePlanes=False,
    Refine=True,
    MinCount=16,
    MaxCount=400,
    AspectRatio=20,
    MaxDistance=0,
    MaxAngle=20,
    MinEdge="0.5",
    MaxEdge="0.5")
pl = PlaneNormal(Origin=pt, ZAxis=Vector(0, 0, 1))
alongcrv = SortAlongCurve(Points=pt, Curve=cir)  # -> Points, Indices
item_6 = ListItem(List=pl, Index=0, Wrap=True)
intcrv = Interpolate(Vertices=alongcrv.Points, Degree=3, Periodic=False, KnotStyle=1)  # -> Curve, Length, Domain
mesh_7 = Mesh(scale_nu.Geometry)
project = Project(Geometry=intcrv.Curve, Plane=item_6)  # -> Geometry, Transform
clscrv = CloseCurve(Curve=project.Geometry, CloseType=0, Bulge=0.5, Tolerance=0)  # -> Closed, R
data = Data(Slider(-1.049, range=-2..2))
data_2 = Data(Slider(0.841, range=-2..2))
boundary = BoundarySurfaces(Edges=clscrv.Closed)
construct_domain = ConstructDomain(DomainStart=data, DomainEnd=data_2)
rev = Reverse(Vector=evalsrf.Normal)
number_slider_7 = Slider(0.1, range=0..0.1)
rev_2 = Reverse(Vector=evalsrf_2.Normal)
no_of_divisions = Panel(rh_in_paneltypenumber)
pt_2 = PointOriented(BasePlane=align.Plane, UComponent=Slider(0, range=0..1), VComponent=0, WComponent=0)
construct_domain_2 = ConstructDomain(DomainStart=0, DomainEnd=1)
addition = Addition(A=Slider(0, range=0..1), B="0.1")
pl_origin = PlaneOrigin(Base=align.Plane, Origin=pt_2)
addition_2 = Addition(A=Slider(0.1, range=0..0.1), B="0.1")
pt_3 = PointOriented(BasePlane=align_2.Plane, UComponent=addition, VComponent=0, WComponent=0)
pl_origin_2 = PlaneOrigin(Base=align_2.Plane, Origin=pt_3)
neg = Negative(Value=Slider(10, range=0..10))
number_slider_8 = Slider(25, range=0..100)
range = Range(Domain=construct_domain_2, Steps=no_of_divisions)
divide_domain = DivideDomain(Domain=construct_domain_2, Count=no_of_divisions)
dom = ConstructDomain(DomainStart=0, DomainEnd=expr("x*1", "0.05"))
dom_2 = ConstructDomain(DomainStart=expr("-x*0.5", ".15"), DomainEnd=expr("x*0.5", ".15"))
neg_2 = Negative(Value=Slider(8, range=0..10))
dom_3 = ConstructDomain(DomainStart=0, DomainEnd=expr("x*1", "0.05"))
multiplication = Multiplication(A=number_slider_8, B=Slider(2, range=0..10))
dom_4 = ConstructDomain(DomainStart=expr("-x*0.5", ".15"), DomainEnd=expr("x*0.5", ".15"))
list_item_2 = ListItem(List=range, Index=0, Wrap=True)  # -> Item, Item1
rectangle = Rectangle(Plane=pl_origin, XSize=dom, YSize=dom_2, Radius=0)  # -> simplify(Rectangle), Length
construct_domain_3 = ConstructDomain(DomainStart=Slider(0, range=0..100), DomainEnd=Slider(433, range=0..1000))
construct_domain_4 = ConstructDomain(DomainStart=0, DomainEnd=1)
subtraction = Subtraction(A=list_item_2.Item1, B=list_item_2.Item)
rectangle_2 = Rectangle(Plane=pl_origin_2, XSize=dom_3, YSize=dom_4, Radius=0)  # -> simplify(Rectangle), Length
item_7 = ListItem(List=rectangle.Rectangle, Index=0, Wrap=True)  # -> Item, Item1
graft = GraftTree(Tree=reb, IncludeEmptyLists=True, IncludeNullItems=True)  # -> simplify(Tree)
mesh_8 = Mesh(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)
pshift = ShiftPaths(Data=item_7.Item, Offset=-1)
random = Random(Range=construct_domain_3, Number=multiplication, Seed=Slider(52, range=0..100))
deconstruct_domain = DeconstructDomain(Domain=construct_domain_2)  # -> Start, End
graft_2 = GraftTree(Tree=reb_2, IncludeEmptyLists=True, IncludeNullItems=True)  # -> simplify(Tree)
item_8 = ListItem(List=rectangle_2.Rectangle, Index=0, Wrap=True)  # -> Item, Item1
volume = Volume(Geometry=mesh_8)  # -> Volume, Centroid
division_5 = Division(A=subtraction, B="2")
addition_3 = Addition(A=range, B=division_5)
graft_3 = GraftTree(Tree=reb, IncludeEmptyLists=True, IncludeNullItems=True)  # -> simplify(Tree)
pshift_2 = ShiftPaths(Data=item_8.Item, Offset=-1)
pshift_3 = ShiftPaths(Data=item_7.Item1, Offset=-1)
project_2 = Project(Geometry=volume.Centroid, Plane=PlaneXY(0, 0, 0))  # -> Geometry, Transform
graft_4 = GraftTree(Tree=reb_2, IncludeEmptyLists=True, IncludeNullItems=True)  # -> simplify(Tree)
pshift_4 = ShiftPaths(Data=item_8.Item1, Offset=-1)
last_index = LastIndex(List=addition_3)
cull_index = CullIndex(List=addition_3, Indices=last_index, Wrap=True)
lng = ListLength(List=random)
pt_4 = Point(project_2.Geometry)
gradient = Gradient(
    LowerLimit=deconstruct_domain.Start,
    UpperLimit=deconstruct_domain.End,
    Parameter=cull_index,
    stops=[0.15: RGB(255, 130, 160), 0.85: RGB(220, 0, 40)])
gradient_2 = Gradient(
    LowerLimit=deconstruct_domain.Start,
    UpperLimit=deconstruct_domain.End,
    Parameter=cull_index,
    stops=[0: RGB(243, 57, 0), 0.1: RGB(236, 27, 60), 0.2: RGB(210, 0, 118), 0.3: RGB(103, 0, 120), 0.4: RGB(39, 72, 161), 0.5: RGB(1, 192, 229), 0.6: RGB(18, 178, 90), 0.7: RGB(79, 186, 8), 0.8: RGB(220, 237, 32), 0.9: RGB(247, 159, 20), 1: RGB(243, 57, 0)])
gradient_3 = Gradient(
    LowerLimit=deconstruct_domain.Start,
    UpperLimit=deconstruct_domain.End,
    Parameter=cull_index,
    stops=[0: RGB(234, 38, 0), 0.25: RGB(234, 126, 0), 0.5: RGB(254, 244, 84), 0.75: RGB(173, 203, 249), 1: RGB(75, 107, 169)])
swp1 = Sweep1(Rail=graft_3, Sections=pshift_3, Miter=1)
swp1_2 = Sweep1(Rail=graft_4, Sections=pshift_4, Miter=1)
random_2 = Random(Range=Domain(1, 2), Number=lng, Seed=2)
stream_filter = StreamFilter(Gate=rh_in_colourtype, Stream0=gradient_3, Stream1=gradient_2, Stream2=gradient)
swp1_3 = Sweep1(Rail=graft_2, Sections=pshift_2, Miter=1)
swp1_4 = Sweep1(Rail=graft, Sections=pshift, Miter=1)
mesh_9 = Mesh(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)
volume_2 = Volume(Geometry=mesh_9)  # -> Volume, Centroid
project_3 = Project(Geometry=volume_2.Centroid, Plane=PlaneXY(0, 0, 0))  # -> Geometry, Transform
pt_5 = Point(project_3.Geometry)
stream_filter_2 = StreamFilter(Gate=rh_in_paneltype, Stream0="Quad", Stream1="Triangular", Stream2="Diamond")
stream_filter_3 = StreamFilter(Gate=rh_in_colourtype, Stream0="heat", Stream1="rainbow", Stream2="red")
merge_3 = Merge(Data1=reb, Data2=reb_2)  # -> flatten(Result)
stream_filter_4 = StreamFilter(Gate=rh_in_panelgroupingtype, Stream0="scattered", Stream1="x-axis", Stream2="k-means")
len_5 = Length(Curve=merge_3)
Z_4 = UnitZ(Factor=Slider(0.2, range=0..1))
sort_4 = SortList(Keys=merge_3, ValuesA=len_5)  # -> Keys, ValuesA
neg_3 = Negative(Value=Z_4)
integer = Integer(rh_in_paneltypenumber)
mesh_10 = Mesh(boundary)
merge_4 = Merge(Data1=swp1_4, Data2=swp1_3)
move_3 = Move(Geometry=mesh_10, Motion=neg_3)  # -> Geometry, Transform
item_9 = ListItem(List=reverse(sort_4.Keys), Index=0, Wrap=True)
item_10 = ListItem(List=sort_4.Keys, Index=0, Wrap=True)
lng_2 = ListLength(List=merge_3)
stream_filter_5 = StreamFilter(Gate=rh_in_showoriginalmesh, Stream1=get_geometry)
mesh_colours = MeshColours(Mesh=merge_4, Colours=ColourSwatch(SwatchColor=RGB(103, 11, 12)))
mesh_colours_2 = MeshColours(Mesh=move_3.Geometry, Colours=ColourSwatch(SwatchColor=RGB(227, 218, 218)))
roundd = RoundToDecimalPlace(NumberX=item_10, DecimalPlace="2", RoundType=0)  # -> Rounded, Difference
roundd_2 = RoundToDecimalPlace(NumberX=item_9, DecimalPlace="2", RoundType=0)  # -> Rounded, Difference
merge_5 = Merge(Data1=reb, Data2=reb_2)
stream_filter_6 = StreamFilter(Gate=rh_in_showgridshellwireframe, Stream1=merge_5)

# ---- group: RH_OUT:grouping_type
data_3 = Data(flatten(stream_filter_4))

# ---- group: RH_OUT:panel_type
data_4 = Data(flatten(stream_filter_2))

# ---- group: RH_OUT:panel_type_number
data_5 = Data(flatten(integer))

# ---- group: RH_OUT:colour_gradient
data_6 = Data(flatten(stream_filter_3))

# ----
stream_filter_7 = StreamFilter(Gate=rh_in_showgridshell, Stream1=[mesh_colours, mesh_colours_2])

# ---- group: RH_OUT:member_number
data_7 = Data(lng_2)

# ---- group: RH_OUT:shortest_member
data_8 = Data(roundd.Rounded)

# ---- group: RH_OUT:longest_member
data_9 = Data(roundd_2.Rounded)

# ----
colour_gradient = Panel(data_6)
grouping_type = Panel(data_3)
panel_type = Panel(data_4)
panel_type_number = Panel(data_5)

# ---- group: RH_OUT:originalMesh
mesh_11 = Mesh(stream_filter_5)

# ----
longestmember = Panel(data_9)
membernumber = Panel(data_7)
shortestmember = Panel(data_8)

# ---- group: RH_OUT:gridshell_curve
curve = Curve(stream_filter_6)

# ---- group: RH_OUT:gridshell_mesh
# DATA
mesh_12 = Mesh(stream_filter_7)

# ---- group: create patch
mesh_13 = Mesh(get_geometry)
bbox_3 = BoundingBox(Content=mesh_13, Plane=PlaneXY(0, 0, 0))  # -> Box, Box_2
debrep_4 = DeconstructBrep(Brep=bbox_3.Box)  # -> Faces, Edges, Vertices
area_5 = Area(Geometry=debrep_4.Faces)  # -> Area, Centroid
pdecon_2 = Deconstruct(Point=area_5.Centroid)  # -> XComponent, YComponent, ZComponent
sort_5 = SortList(Keys=pdecon_2.ZComponent, ValuesA=debrep_4.Faces)  # -> Keys, ValuesA
item_11 = ListItem(List=sort_5.ValuesA, Index=0, Wrap=True)
debrep_5 = DeconstructBrep(Brep=item_11)  # -> Faces, Edges, Vertices
item_12 = ListItem(List=debrep_5.Edges, Index=0, Wrap=True)
divide = DivideCurve(Curve=item_12, Count=10, Kinks=False)  # -> reverse(Points), Tangents, Parameters
yz = YZPlane(Origin=divide.Points)
sec = MeshPlane(Mesh=get_geometry, Plane=yz)
crv_12 = Curve(sec)
crv_13 = Curve(crv_12)
xy = XYPlane(Origin=Point(0, 0, 0))
pcx = CurvePlane(Curve=crv_13, Plane=xy)  # -> Points, ParamsC, ParamsP
shatter = Shatter(Curve=graft(crv_13), Parameters=pcx.ParamsC)
combine = CombineData(Input0=shatter, Input1=graft(crv_13))  # -> Result, Index
curvepoint = PointOnCurve(combine.Result, parameter=0.5)
pdecon_3 = Deconstruct(Point=curvepoint)  # -> XComponent, YComponent, ZComponent
larger = LargerThan(FirstNumber=pdecon_3.ZComponent, SecondNumber="0")  # -> LargerThan, OrEqualTo
dispatch = Dispatch(List=combine.Result, DispatchPattern=larger.LargerThan)  # -> ListA, ListB
crv_14 = Curve(dispatch.ListA)
xy_2 = XYPlane(Origin=Point(0, 0, 0))
Z_5 = UnitZ(Factor=Slider(0.1, range=0..0.1))
move_4 = Move(Geometry=xy_2, Motion=Z_5)  # -> Geometry, Transform
sec_2 = MeshPlane(Mesh=get_geometry, Plane=move_4.Geometry)
rebcrv = RebuildCurve(Curve=crv_14, Count=Slider(4, range=0..10), Degree="3", EndTangents=False)
number_slider_9 = Slider(28, range=0..100)

# ----
offset = OffsetCurve(Curve=sec_2, Distance=Slider(2, range=0..10), Corners=1)

# ---- group: create patch (continued)
reb_3 = RebuildCurve(Curve=offset, Degree="3", Count=Slider(34, range=0..100), Tangents=False)
patch = Patch(Curves=flatten([reb_3, rebcrv]), Spans=Slider(50, range=0..100), Flexibility=0.5, Trim=False)
rebsrf = RebuildSurface(Surface=patch, DomainU=number_slider_9, DomainV=number_slider_9)

# ----
srf = Surface(rebsrf)
stream_gate = StreamGate(Stream=srf, Gate=rh_in_paneltype)  # -> Target0, Target1, Target2
diamond_panels = DiamondPanels(Surface=stream_gate.Target2, UDivisions=rh_in_udivisions, VDivisions=rh_in_vdivisions)  # -> DiamondPanels, TriPanels
quad_panels = QuadPanels(Surface=stream_gate.Target0, UDivisions=rh_in_udivisions, VDivisions=rh_in_vdivisions)
triangular_panels_a = TriangularPanelsA(Surface=stream_gate.Target1, UDivisions=rh_in_udivisions, VDivisions=rh_in_vdivisions)
surface_2 = Surface([triangular_panels_a, quad_panels, diamond_panels.DiamondPanels, diamond_panels.TriPanels])

# ---- group: splitting
crv_15 = Curve(rebsrf)
project_4 = Project(Geometry=crv_15, Plane=move_4.Geometry)  # -> Geometry, Transform
number_slider_10 = Slider(25, range=0..100)
reb_4 = RebuildCurve(Curve=project_4.Geometry, Count=Slider(100, range=0..100), Tangents=False)
neg_4 = Negative(Value=number_slider_10)
offset_2 = OffsetCurve(Curve=reb_4, Distance=Slider(0.5, range=0..1), Corners=1)
Z_6 = UnitZ(Factor=[neg_4, number_slider_10])
extr = Extrude(Base=offset_2, Direction=Z_6)  # -> flatten(Extrusion)
join_5 = BrepJoin(Breps=extr)  # -> Breps, Closed
cap = CapHoles(Brep=join_5.Breps)
cap_2 = CapHoles(Brep=extr)
srf_2 = Surface(surface_2)
splitmul = SplitBrepMultiple(Brep=flatten(srf_2), Cutters=cap)  # -> flatten(Result)
shapein = ShapeInBrep(Brep=cap_2, Shape=flatten(splitmul))
larger_2 = LargerThan(FirstNumber=shapein, SecondNumber="1")  # -> LargerThan, OrEqualTo
number_slider_11 = Slider(50, range=0..100)
cull = CullPattern(List=splitmul, CullPattern=invert(larger_2.LargerThan))
pt_6 = ConstructPoint(XCoordinate=expr("-x", number_slider_11), YCoordinate=expr("-x", number_slider_11), ZCoordinate=0)
rectangle_3 = Rectangle(Plane=pt_6, XSize=number_slider_4, YSize=number_slider_4, Radius=0)  # -> Rectangle, Length
Z_7 = UnitZ(Factor=Slider(1, range=0..1))
move_5 = Move(Geometry=rectangle_3.Rectangle, Motion=Z_7)  # -> Geometry, Transform
neg_5 = Negative(Value=Slider(5, range=0..10))
Z_8 = UnitZ(Factor=neg_5)
extr_2 = Extrude(Base=move_5.Geometry, Direction=Z_8)
cap_3 = CapHoles(Brep=extr_2)
trim_3 = TrimSolid(Shape=cull, Cutters=cap_3)
area_6 = Area(Geometry=move_5.Geometry)  # -> Area, Centroid
pdecon_4 = Deconstruct(Point=area_6.Centroid)  # -> XComponent, YComponent, ZComponent
area_7 = Area(Geometry=trim_3)  # -> Area, Centroid
pdecon_5 = Deconstruct(Point=area_7.Centroid)  # -> XComponent, YComponent, ZComponent
panel = Panel("0")
larger_3 = LargerThan(FirstNumber=pdecon_5.ZComponent, SecondNumber=pdecon_4.ZComponent)  # -> LargerThan, OrEqualTo
dispatch_2 = Dispatch(List=trim_3, DispatchPattern=larger_3.LargerThan)  # -> ListA, ListB

# ----
pln = Plane(move_5.Geometry)
project_5 = Project(Geometry=scale_2.Geometry, Plane=pln)  # -> Geometry, Transform
mesh_brep = MeshBrep(Brep=project_5.Geometry, Settings=settings_custom)
srf_3 = Surface(flatten(dispatch_2.ListA))
area_8 = Area(Geometry=srf_3)  # -> Area, Centroid
mesh_14 = Mesh(mesh_brep)
minc = MeshInclusion(Mesh=mesh_7, Point=area_8.Centroid, Strict=False)
demesh_2 = DeconstructMesh(Mesh=mesh_14)  # -> Vertices, Faces, Colours, Normals
lng_3 = ListLength(List=demesh_2.Vertices)
cull_2 = CullPattern(List=srf_3, CullPattern=minc)
mesh_15 = Mesh(flatten(cull_2))
random_3 = Random(Range=construct_domain, Number=lng_3, Seed=2)
graph = GraphMapper(
    random_3,
    x0=0,
    x1=1,
    y0=0,
    y1=1,
    amplitude=0.218028605,
    container_name="Perlin",
    decay=0.8143943548,
    frequency=0.03698211908,
    x_offset=0.5846650004,
    y_offset=0.4053633809)
graft_tree = GraftTree(Tree=mesh_15, IncludeEmptyLists=True, IncludeNullItems=True)
clean_4 = CleanTree(RemoveNulls=True, RemoveInvalid=True, RemoveEmpty=False, Tree=cull_2)
gradient_4 = Gradient(LowerLimit=-0.5, UpperLimit=0.5, Parameter=graph, stops=[0.476: RGB(212, 255, 38), 1: RGB(144, 238, 144)])
debrep_6 = DeconstructBrep(Brep=clean_4)  # -> Faces, Edges, Vertices
crv_16 = Curve(project_5.Geometry)
area_9 = Area(Geometry=graft_tree)  # -> Area, Centroid
area_10 = Area(Geometry=clean_4)  # -> Area, Centroid
join_6 = JoinCurves(Curves=debrep_6.Edges, Preserve=False)  # -> flatten(Curves)
pln_2 = Plane(project_5.Geometry)
offset_3 = OffsetCurve(Curve=crv_16, Distance=neg, Corners=1)
conmesh = ConstructMesh(Vertices=demesh_2.Vertices, Faces=demesh_2.Faces, Colours=gradient_4)
len_6 = Length(Curve=join_6)
entwine_2 = Entwine(Branch00=area_10.Area, Branch01=len_6, FlattenInputs=True)
flip = FlipMatrix(Data=entwine_2)
list_length = ListLength(List=flatten(area_9.Centroid))
sec_3 = BrepPlane(Brep=srf, Plane=pln_2)  # -> flatten(Curves), Points
mblur = BlurMesh(Mesh=conmesh, Iterations=Slider(1, range=0..5))
deconstruct = Deconstruct(Point=area_9.Centroid)  # -> XComponent, YComponent, ZComponent
join_7 = JoinCurves(Curves=sec_3.Curves, Preserve=False)
panel_2 = Panel(flip)
reb_5 = RebuildCurve(Curve=join_7, Degree="3", Count=Slider(38, range=0..100), Tangents=False)
bounds = Bounds(Numbers=flatten(deconstruct.YComponent))
len_7 = Length(Curve=reb_5)
k_means = KMeansClustering(TrainingInputs=panel_2, OfClusters=rh_in_paneltypenumber, RandomSeed=5)  # -> Result, Likelihood, Centroids
curve_2 = Curve(reb_5)
sort_6 = SortList(Keys=reverse(len_7), ValuesA=reb_5)  # -> Keys, ValuesA
random_4 = Random(Range=construct_domain_4, Number=list_length, Seed=2)  # -> graft(Random)
item_13 = ListItem(List=sort_6.ValuesA, Index=0, Wrap=True)
offset_4 = OffsetCurve(Curve=item_13, Distance=Slider(5, range=0..10), Corners=1)
merge_6 = Merge(Data1=offset_3, Data2=offset_4)  # -> flatten(Result)
boundary_2 = BoundarySurfaces(Edges=merge_6)
offset_5 = OffsetCurve(Curve=item_13, Distance=neg_2, Corners=1)
boundary_3 = BoundarySurfaces(Edges=offset_5)
populate_geometry = PopulateGeometry(Geometry=boundary_2, Count=number_slider_8, Seed=Slider(50, range=0..100))  # -> flatten(Population)
plane = Plane(populate_geometry)
bnd = Bounds(Numbers=k_means.Result)
remap_numbers = RemapNumbers(Value=deconstruct.YComponent, Source=bounds, Target=construct_domain_2)  # -> Mapped, Clipped
popgeo = PopulateGeometry(Geometry=boundary_3, Count=Slider(25, range=0..100), Seed=1)
remap_numbers_2 = RemapNumbers(Value=k_means.Result, Source=bnd, Target=construct_domain_2)  # -> graft(Mapped), Clipped
stream_filter_8 = StreamFilter(Gate=boolean_toggle_2, Stream1=mblur)
rotate_2 = Rotate(Geometry=plane, Angle=degrees(random), Plane=plane)  # -> Geometry, Transform
stream_filter_9 = StreamFilter(Gate=rh_in_panelgroupingtype, Stream0=random_4, Stream1=remap_numbers.Mapped, Stream2=remap_numbers_2.Mapped)
curve_boundary = Curve(item_13)
orient = Orient(Geometry=mesh_8, Source=pt_4, Target=rotate_2.Geometry)  # -> Geometry, Transform
includes = Includes(Value=stream_filter_9, Domain=divide_domain)  # -> Includes, Deviation
curve_3 = Curve(flatten(curve_boundary))
scale_3 = Scale(Geometry=orient.Geometry, Center=rotate_2.Geometry, Factor=random_2)  # -> simplify(graft(Geometry)), Transform
member_index = MemberIndex(Set=includes.Includes, Member=Toggle(True))  # -> Index, Count
demesh_3 = DeconstructMesh(Mesh=scale_3.Geometry)  # -> simplify(Vertices), Faces, Colours, Normals
mesh_16 = Mesh(curve_3)
pdecon_6 = Deconstruct(Point=demesh_3.Vertices)  # -> XComponent, YComponent, ZComponent
mesh_colours_3 = MeshColours(Mesh=mesh_16, Colours=ColourSwatch(SwatchColor=RGB(255, 255, 255)))
list_length_2 = ListLength(List=popgeo)
list_item_3 = ListItem(List=stream_filter, Index=member_index.Index, Wrap=True)  # -> simplify(Item)
bnd_2 = Bounds(Numbers=pdecon_6.ZComponent)
plane_2 = Plane(popgeo)
stream_filter_10 = StreamFilter(Gate=rh_in_showwireframe, Stream1=cull_2)
remap = RemapNumbers(Value=pdecon_6.ZComponent, Source=bnd_2, Target=Domain(0, 1))  # -> Mapped, Clipped
colours = Data(flatten(list_item_3))
gradient_5 = Gradient(
    LowerLimit=0,
    UpperLimit=1,
    Parameter=remap.Mapped,
    stops=[0: RGB(132, 196, 29), 0.359: RGB(105, 214, 130), 0.789: RGB(164, 219, 101)])
create_set = CreateSet(List=colours)  # -> Set, Map
stream_filter_11 = StreamFilter(Gate=rh_in_showwireframe, Stream1=mesh_colours_3)
mesh_17 = Data(simplify(flatten(graft_tree)))
member_index_2 = MemberIndex(Set=colours, Member=create_set.Set)  # -> Index, Count
deconstruct_brep_2 = DeconstructBrep(Brep=stream_filter_10)  # -> Faces, Edges, Vertices
mcol = MeshColours(Mesh=scale_3.Geometry, Colours=gradient_5)
list_item_organised_meshes = ListItem(List=mesh_17, Index=member_index_2.Index, Wrap=True)
list_indices = ListIndices(List=create_set.Set)
random_5 = Random(Range=Domain(0, 360), Number=list_length_2, Seed=Slider(42, range=0..100))
mblur_2 = BlurMesh(Mesh=mcol, Iterations=Slider(1, range=0..5))
graft_tree_2 = GraftTree(Tree=list_indices, IncludeEmptyLists=True, IncludeNullItems=True)
area_11 = Area(Geometry=list_item_organised_meshes)  # -> Area, Centroid
x_plus_one = XPlusOne(NumberX=graft_tree_2)
stream_filter_12 = StreamFilter(Gate=boolean_toggle_3, Stream1=mblur_2)
rotate_3 = Rotate(Geometry=plane_2, Angle=degrees(random_5), Plane=plane_2)  # -> Geometry, Transform
orient_2 = Orient(Geometry=mesh_9, Source=pt_5, Target=rotate_3.Geometry)  # -> Geometry, Transform
lng_4 = ListLength(List=random_5)
list_length_3 = ListLength(List=flatten(list_item_3))
c_script = CSharpScript(face="Arial", bold=Toggle(False), size=Slider(0.781, range=0..11), content=x_plus_one, pl=area_11.Centroid)  # -> out, A; inputs face: String, bold: Boolean, italics: Boolean, size: Double, content: String, pl: Plane
# ---------- c_script: C# usings ----------
using System.IO;
using System.Linq;
using System.Data;
using System.Drawing;
using System.Reflection;
using System.Windows.Forms;
using System.Xml;
using System.Xml.Linq;
using System.Runtime.InteropServices;

using Rhino.DocObjects;
using Rhino.Collections;
using GH_IO;
using GH_IO.Serialization;
# ---------- c_script: C# ----------
    if(size == 0)
      size = 1;

    if(!string.IsNullOrEmpty(face) && size > 0 && !string.IsNullOrEmpty(content) &&
      pl.IsValid)
    {
      using (var doc = Rhino.RhinoDoc.CreateHeadless(null))
      {
        var te = doc.Objects.AddText(content, pl, size, face, bold, italics);
        var txt = doc.Objects.Find(te) as Rhino.DocObjects.TextObject;

        if(txt != null)
        {
          var tt = txt.Geometry as Rhino.Geometry.TextEntity;
          A = tt.Explode();
        }
      }
    }
# ---------- end c_script ----------
area_12 = Area(Geometry=srf)  # -> Area, Centroid
random_6 = Random(Range=Domain(0.85, 1), Number=lng_4, Seed=2)
scale_4 = Scale(Geometry=orient_2.Geometry, Center=rotate_3.Geometry, Factor=random_6)  # -> Geometry, Transform
stream_filter_13 = StreamFilter(Gate=rh_in_showgroupnumbers, Stream1=c_script.A)
offset_mesh = OffsetMesh(Mesh=graft_tree, Distance=Slider(0.2, range=0..1), BothSides=0, CreateSolid=True)
integer_2 = Integer(list_length_3)
integer_3 = Integer(area_12.Area)
mesh_colours_4 = MeshColours(Mesh=scale_4.Geometry, Colours=ColourSwatch(SwatchColor=RGB(255, 222, 222)))
custom_preview = CustomPreview(Geometry=offset_mesh, Material=list_item_3)
stream_filter_14 = StreamFilter(Gate=boolean_toggle, Stream1=mesh_colours_4)
c_script_2 = CSharpScript(mesh=simplify(offset_mesh), color=list_item_3)  # -> out, A; inputs mesh: Mesh, color: Color
# ---------- c_script_2: C# ----------
    var c = color.R + "," + color.G + "," + color.B;
    mesh.SetUserString("color", c);
    A = mesh;
# ---------- end c_script_2 ----------
stream_filter_15 = StreamFilter(Gate=rh_in_showcolour, Stream1=c_script_2.A)

# ---- group: RH_OUT:panel_number
data_10 = Data(flatten(integer_2))

# ---- group: RH_OUT:sky_visibility_area
data_11 = Data(flatten(integer_3))

# ----
panel_number = Panel(data_10)
# DATA OUTPUT
sky_visibility_area = Panel(data_11)

# ---- group: RH_OUT:people
geometry_people = Geometry(flatten(stream_filter_14))

# ---- group: RH_OUT:trees
geometry_trees = Geometry(flatten(stream_filter_12))

# ---- group: RH_OUT:edge_curves
curve_4 = Curve(flatten(deconstruct_brep_2.Edges))

# ---- group: RH_OUT:base
mesh_18 = Mesh(flatten(stream_filter_11))

# ---- group: RH_OUT:terrain
mesh_19 = Mesh(flatten(stream_filter_8))

# ---- group: RH_OUT:colour
# GEOMETRY OUTPUT
mesh_20 = Mesh(stream_filter_15)

# ---- group: RH_OUT:panel_group_numbers
curve_5 = Curve(stream_filter_13)
