# Grasshopper definition skyglazer final meshTESTINGv5.gh (Grasshopper 1.0.7)
# plug-ins: Kangaroo2 Components

mesh = Mesh(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)
rh_in_showgridshellwireframe = GetBoolean(Toggle(True), AtLeast=1, AtMost=1, FalseValue="False", TreeAccess=False, TrueValue="True")
# LAYER OPTIONS
number_slider = Slider(3, range=1..5)
# FORM
toggle = BooleanToggle(True)
# GRIDSHELL
meshes = GetGeometry(mesh, AtLeast=1, AtMost=1, DeleteInput=False, Filter=1074004029, TreeAccess=False)
mesh_2 = Mesh(meshes)
bbox = BoundingBox(Content=mesh_2, Plane=PlaneXY(0, 0, 0))  # -> Box, Box_2
debrep = DeconstructBrep(Brep=bbox.Box)  # -> Faces, Edges, Vertices
area = Area(Geometry=debrep.Faces)  # -> Area, Centroid
pdecon = Deconstruct(Point=area.Centroid)  # -> XComponent, YComponent, ZComponent
sort = SortList(Keys=pdecon.ZComponent, ValuesA=debrep.Faces)  # -> Keys, ValuesA
item = ListItem(List=sort.ValuesA, Index=0, Wrap=True)
custom_mesh_settings = SettingsCustom(
    StitchSeams=True,
    SimplePlanes=False,
    Refine=True,
    MinCount=16,
    MaxCount=400,
    AspectRatio=20,
    MaxDistance=0,
    MaxAngle=20,
    MinEdge=number_slider,
    MaxEdge=number_slider)
area_2 = Area(Geometry=item)  # -> Area, Centroid
scale = Scale(Geometry=item, Center=area_2.Centroid, Factor=Slider(2, range=0..10))  # -> Geometry, Transform
rotate = Rotate(Geometry=scale.Geometry, Angle=degrees(Slider(0, range=0..360)), Plane=PlaneXY(0, 0, 0))  # -> Geometry, Transform
mesh_3 = Mesh(mesh_2)
Z = UnitZ(Factor=Slider(22, range=0..100))
mesh_4 = MeshBrep(Brep=rotate.Geometry, Settings=custom_mesh_settings)
move = Move(Geometry=mesh_4, Motion=Z)  # -> Geometry, Transform
warpweft = WarpWeft(Mesh=move.Geometry)  # -> Warp, Weft, NakedA, NakedB
crv = Curve(warpweft.Weft)
crv_2 = Curve(warpweft.Warp)
demesh = DeconstructMesh(Mesh=move.Geometry)  # -> Vertices, Faces, Colours, Normals
join = JoinCurves(Curves=crv, Preserve=False)
join_2 = JoinCurves(Curves=crv_2, Preserve=False)
mesh_5 = Mesh(move.Geometry)
merge = Merge(Data1=join_2, Data2=join)
Z_2 = UnitZ(Factor=-0.01)
show = Show(G=mesh_5)
spc = SolidPointCollide(Points=demesh.Vertices, Solid=mesh_3, Interior=False, Unidirectional=True, Strength=Slider(10, range=0..10))
load = Load(Point=demesh.Vertices, ForceVector=Z_2)
crv_3 = Curve(merge)
rod = Rod(Polyline=crv_3, LengthFactor=1, AngleFactor=1, AxialStrength=10, BendStrength=1)
merge_2 = Merge(Data1=rod, Data2=load, Data3=spc)
entwine = Entwine(Branch00=show, Branch01=merge_2, FlattenInputs=True)  # -> simplify(Result)
zombiesolver = ZombieSolver(GoalObjects=entwine, Threshold=1e-10, Tolerance=0.0001, MaxIterations=Slider(3000, range=0..10000))  # -> I, V, O
clean = CleanTree(RemoveNulls=True, RemoveInvalid=True, RemoveEmpty=False, Tree=zombiesolver.O)
objecttypesort = CSharpScript(geo=clean)  # -> out, Pt, Crv, Mesh, Brep, Srf; inputs geo: list of GeometryBase
# ---------- objecttypesort: C# ----------
    List<Rhino.Geometry.Point> Pts = new List<Rhino.Geometry.Point>();
    List<Curve> Crvs = new List<Curve>();
    List<Mesh> Meshes = new List<Mesh>();
    List<Brep> Breps = new List<Brep>();
    List<Brep> Srfs = new List<Brep>();


    foreach(GeometryBase x in geo){
      Rhino.DocObjects.ObjectType objectType = x.ObjectType;
      switch(objectType){
        case Rhino.DocObjects.ObjectType.Point: Pts.Add(x as Rhino.Geometry.Point);
          break;
        case Rhino.DocObjects.ObjectType.Curve: Crvs.Add(x as Curve);
          break;
        case Rhino.DocObjects.ObjectType.Mesh: Meshes.Add(x as Mesh);
          break;
        case Rhino.DocObjects.ObjectType.Brep:
          Brep brepObj = x as Brep;
          if(brepObj.IsSurface){
            Srfs.Add(brepObj);
          } else {
            Breps.Add(brepObj);
          }
          break;


      }
    }
    Pt = Pts;
    Crv = Crvs;
    Mesh = Meshes;
    Brep = Breps;
    Srf = Srfs;
# ---------- end objecttypesort ----------
crv_4 = Curve(objecttypesort.Crv)
join_3 = JoinCurves(Curves=crv_4, Preserve=False)
clean_2 = CleanTree(RemoveNulls=True, RemoveInvalid=True, RemoveEmpty=True, Tree=join_3)
bbox_2 = BoundingBox(Content=mesh_2, Plane=PlaneXY(0, 0, 0))  # -> Box, Box_2
crv_5 = Curve(clean_2)
trim = TrimWithBrep(Curve=crv_5, Brep=bbox_2.Box)  # -> Inside, Outside
crv_6 = Curve(flatten(trim.Inside))
end = EndPoints(Curve=crv_6)  # -> Start, End
rectangle = Rectangle(Plane=PlaneXY(0, 0, 0), XSize="0.05", YSize=".08", Radius=0)  # -> Rectangle, Length
pframe = PerpFrame(Curve=reparameterize(crv_6), Parameter="0")
pln = Plane(rectangle.Rectangle)
reb = RebuildCurve(Curve=crv_6, Degree="3", Count=Slider(29, range=0..100), Tangents=False)
graft = GraftTree(Tree=reb, IncludeEmptyLists=True, IncludeNullItems=True)
orient = Orient(Geometry=graft(rectangle.Rectangle), Source=pln, Target=pframe)  # -> graft(Geometry), Transform
swp1 = Sweep1(Rail=graft, Sections=orient.Geometry, Miter=1)
len = Length(Curve=reb)
mesh_colours = MeshColours(Mesh=swp1, Colours=ColourSwatch(SwatchColor=RGB(103, 11, 12)))
sort_2 = SortList(Keys=reb, ValuesA=len)  # -> Keys, ValuesA
item_2 = ListItem(List=reverse(sort_2.Keys), Index=0, Wrap=True)
item_3 = ListItem(List=sort_2.Keys, Index=0, Wrap=True)
lng = ListLength(List=reb)
stream_filter = StreamFilter(Gate=rh_in_showgridshellwireframe, Stream1=reb)
stream_filter_2 = StreamFilter(Gate=Toggle(False), Stream1=mesh_colours)
stream_filter_3 = StreamFilter(Gate=toggle, Stream1=meshes)

# ---- group: RH_OUT:gridshell_mesh
# DATA OUTPUT
# GEOMETRY OUTPUT
mesh_6 = Mesh(stream_filter_2)

# ---- group: RH_OUT:originalMesh
mesh_7 = Mesh(stream_filter_3)

# ---- group: RH_OUT:gridshell_curve
# DATA
curve = Curve(stream_filter)
