# Grasshopper definition skyglazer final.gh (Grasshopper 1.0.7)
# plug-ins: LunchBox, Pufferfish

# ---- group: RH_IN:showArcs
# LAYER OPTIONS
boolean_toggle = BooleanToggle(True)

# ---- group: RH_IN:showTerrain
boolean_toggle_2 = BooleanToggle(True)

# ---- group: RH_IN:showBoundary
boolean_toggle_3 = BooleanToggle(True)

# ---- group: RH_IN:showPath
boolean_toggle_4 = BooleanToggle(True)

# ---- group: RH_IN:showPeople
boolean_toggle_5 = BooleanToggle(True)

# ---- group: RH_IN:showTrees
boolean_toggle_6 = BooleanToggle(True)

# ----
# CONTROL POINTS
# SITE
point = Point([Point(-2.551825491, -1.290493457, 0), Point(-1.751963995, 17.00250815, 0), Point(0.943073726, 4.358281188, 0), Point(-1.142545713, -8.521349459, 0)])

# ---- group: RH_IN:showWireframe
# PANELIZATION
boolean_toggle_7 = BooleanToggle(True)

# ----
rh_in_panelgroupingtype = GetInteger(Slider(1, range=0..2), AtLeast=1, AtMost=1, Maximum=2147483647, Minimum=-2147483648)
# GROUPING
rh_in_showgroupnumbers = GetBoolean(Toggle(False), AtLeast=1, AtMost=1, FalseValue="False", TrueValue="True")
rh_in_paneltypenumber = GetInteger(Slider(14, range=0..100), AtLeast=1, AtMost=1, Maximum=2147483647, Minimum=-2147483648)

rh_in_udivisions = GetNumber(Slider(19, range=0..100), AtLeast=1, AtMost=1, Maximum=1.797693135e+308, Minimum=-1.797693135e+308)
rh_in_paneltype = GetInteger(Slider(1, range=0..2), AtLeast=1, AtMost=1, Maximum=2147483647, Minimum=-2147483648)
rh_in_vdivisions = GetNumber(Slider(12, range=0..100), AtLeast=1, AtMost=1, Maximum=1.797693135e+308, Minimum=-1.797693135e+308)

# ----
# ARCS
rh_in_arcradius1 = GetNumber(Slider(7, range=0..10), AtLeast=1, AtMost=1, Maximum=1.797693135e+308, Minimum=-1.797693135e+308)
rh_in_arcradius2 = GetNumber(Slider(3, range=0..10), AtLeast=1, AtMost=1, Maximum=1.797693135e+308, Minimum=-1.797693135e+308)
rh_in_arcradius3 = GetNumber(Slider(2, range=0..10), AtLeast=1, AtMost=1, Maximum=1.797693135e+308, Minimum=-1.797693135e+308)
rh_in_arcradius4 = GetNumber(Slider(2, range=0..10), AtLeast=1, AtMost=1, Maximum=1.797693135e+308, Minimum=-1.797693135e+308)

rh_in_showcolour = GetBoolean(Toggle(True), AtLeast=1, AtMost=1, FalseValue="False", TrueValue="True")
# COLOURING
rh_in_colourtype = GetNumber(Slider(1, range=0..2), AtLeast=1, AtMost=1, Maximum=1.797693135e+308, Minimum=-1.797693135e+308)

merge = Merge(Data1=rh_in_arcradius1, Data2=rh_in_arcradius2, Data3=rh_in_arcradius3, Data4=rh_in_arcradius4)
rh_in_points = GetPoint(point, AtLeast=1, AtMost=2147483647, Realtime=True)
construct_point = ConstructPoint(XCoordinate=0, YCoordinate="-20", ZCoordinate=0)
construct_point_2 = ConstructPoint(XCoordinate=0, YCoordinate="20", ZCoordinate=0)
line = Line(StartPoint=construct_point, EndPoint=construct_point_2)
sort_along_curve = SortAlongCurve(Points=rh_in_points, Curve=line)  # -> Points, Indices
panel = Panel(sort_along_curve.Points)
interpolate = Interpolate(Vertices=sort_along_curve.Points, Degree=3, Periodic=False, KnotStyle=1)  # -> Curve, Length, Domain
curve_closest_point = CurveClosestPoint(Point=rh_in_points, Curve=interpolate.Curve)  # -> Point, Parameter, Distance
perp_frame = PerpFrame(Curve=interpolate.Curve, Parameter=curve_closest_point.Parameter)
sort_along_curve_2 = SortAlongCurve(Points=perp_frame, Curve=interpolate.Curve)  # -> Points, Indices
deconstruct_plane = DeconstructPlane(Plane=sort_along_curve_2.Points)  # -> Origin, XAxis, YAxis, ZAxis
panel_2 = Panel(merge)
data = Data(panel_2)
negative = Negative(Value=data)
line_sdl = LineSDL(Start=sort_along_curve_2.Points, Direction=deconstruct_plane.XAxis, Length=negative)  # -> flatten(Line)
line_sdl_2 = LineSDL(Start=sort_along_curve_2.Points, Direction=deconstruct_plane.XAxis, Length=data)  # -> flatten(Line)
xz_plane = XZPlane(Origin=Point(0, 0, 0))
join_curves = JoinCurves(Curves=[line_sdl, line_sdl_2], Preserve=False)
end_points = EndPoints(Curve=join_curves)  # -> Start, End
c_script = CSharpScript(plane=xz_plane, start=end_points.Start, end=end_points.End, radius=data)  # -> out, A, B, C, D; inputs plane: Plane, start: Point3d, end: Point3d, radius: Double
# ---------- c_script: C# ----------
    var line = new Line(start, end);
    var vec = Vector3d.CrossProduct(line.Direction, plane.ZAxis);
    vec.Unitize();
    var d = Math.Sqrt(Math.Pow(radius, 2.0) - Math.Pow(line.Length, 2.0) / 4.0);
    A = new Arc(start, line.PointAt(0.5) + vec * (radius - d), end);
    B = new Arc(start, line.PointAt(0.5) - vec * (radius - d), end);
    C = new Arc(start, line.PointAt(0.5) + vec * (radius + d), end);
    D = new Arc(start, line.PointAt(0.5) - vec * (radius + d), end);
# ---------- end c_script ----------
loft = Loft(Curves=c_script.B, Options={Adjust=False, Closed=False, LoftEnds=0, LoftSimp=0, LoftType=0, Rebuild=10, Refit=0.01})
stream_gate = StreamGate(Stream=loft, Gate=rh_in_paneltype)  # -> Target0, Target1, Target2
deconstruct_brep = DeconstructBrep(Brep=loft)  # -> Faces, Edges, Vertices
list_item = ListItem(List=deconstruct_brep.Edges, Index=0, Wrap=True)  # -> Item, Item1, Item2
curve = Curve(list_item.Item2)
curve_2 = Curve(list_item.Item)
quad_panels = QuadPanels(Surface=stream_gate.Target0, UDivisions=rh_in_udivisions, VDivisions=rh_in_vdivisions)
triangular_panels_a = TriangularPanelsA(Surface=stream_gate.Target1, UDivisions=rh_in_udivisions, VDivisions=rh_in_vdivisions)
diamond_panels = DiamondPanels(Surface=stream_gate.Target2, UDivisions=rh_in_udivisions, VDivisions=rh_in_vdivisions)  # -> DiamondPanels, TriPanels
bounding_box = BoundingBox(Content=[curve_2, curve], Plane=PlaneXY(0, 0, 0), UnionBox=True)  # -> Box, Box_2
area = Area(Geometry=bounding_box.Box)  # -> Area, Centroid
end_points_2 = EndPoints(Curve=curve)  # -> Start, End
end_points_3 = EndPoints(Curve=curve_2)  # -> Start, End
surface = Surface([triangular_panels_a, quad_panels, diamond_panels.DiamondPanels, diamond_panels.TriPanels])
mesh = Mesh([quad_panels, triangular_panels_a, diamond_panels.DiamondPanels, diamond_panels.TriPanels])
line_2 = Line(StartPoint=end_points_3.Start, EndPoint=end_points_2.End)
scale_nu = ScaleNU(Geometry=bounding_box.Box, Plane=area.Centroid, ScaleX=Slider(1.5, range=0..10), ScaleY=1, ScaleZ=1)  # -> Geometry, Transform
line_3 = Line(StartPoint=end_points_3.End, EndPoint=end_points_2.Start)
deconstruct_brep_2 = DeconstructBrep(Brep=scale_nu.Geometry)  # -> Faces, Edges, Vertices
join_curves_2 = JoinCurves(Curves=[curve_2, curve, line_3, line_2], Preserve=False)
list_item_2 = ListItem(List=deconstruct_brep_2.Faces, Index=0, Wrap=True)  # -> Item, Item1, Item2, Item3, Item4
split_brep = SplitBrep(Brep=list_item_2.Item4, Cutter=join_curves_2)
list_item_3 = ListItem(List=split_brep, Index=0, Wrap=True)  # -> Item, Item1, Item2
surface_2 = Surface([list_item_3.Item1, list_item_3.Item2])
graft_tree = GraftTree(Tree=mesh, IncludeEmptyLists=True, IncludeNullItems=True)
graft_tree_2 = GraftTree(Tree=surface, IncludeEmptyLists=True, IncludeNullItems=True)
no_of_divisions = Panel(rh_in_paneltypenumber)
construct_domain = ConstructDomain(DomainStart=0, DomainEnd=1)
area_2 = Area(Geometry=graft_tree)  # -> Area, Centroid
surface_closest_point = SurfaceClosestPoint(Point=area_2.Centroid, Surface=graft_tree_2)  # -> Point, UVPoint, Distance
surface_3 = Surface(surface_2)
principal_curvature = PrincipalCurvature(Surface=loft, Point=surface_closest_point.UVPoint)  # -> Frame, Maximum, Minimum, MaxDirection, MinDirection
range = Range(Domain=construct_domain, Steps=no_of_divisions)
divide_domain = DivideDomain(Domain=construct_domain, Count=no_of_divisions)
deconstruct = Deconstruct(Point=area_2.Centroid)  # -> XComponent, YComponent, ZComponent
settings_custom = SettingsCustom(
    StitchSeams=True,
    SimplePlanes=False,
    Refine=True,
    MinCount=16,
    MaxCount=400,
    AspectRatio=20,
    MaxDistance=0,
    MaxAngle=20,
    MinEdge="0.5",
    MaxEdge="0.5")
list_item_4 = ListItem(List=range, Index=0, Wrap=True)  # -> Item, Item1
multiplication = Multiplication(A=principal_curvature.Maximum, B=principal_curvature.Minimum)
deconstruct_domain = DeconstructDomain(Domain=construct_domain)  # -> Start, End
list_length = ListLength(List=flatten(area_2.Centroid))
bounds = Bounds(Numbers=flatten(multiplication))
subtraction = Subtraction(A=list_item_4.Item1, B=list_item_4.Item)
bounds_2 = Bounds(Numbers=flatten(deconstruct.YComponent))
mesh_brep = MeshBrep(Brep=surface_3, Settings=settings_custom)
division = Division(A=subtraction, B="2")
remap_numbers = RemapNumbers(Value=multiplication, Source=bounds, Target=Domain(0, 1))  # -> Mapped, Clipped
construct_domain_2 = ConstructDomain(DomainStart=0, DomainEnd=1)
addition = Addition(A=range, B=division)
mesh_2 = Mesh(mesh_brep)
mesh_3 = Mesh(mesh_2)
remap_numbers_2 = RemapNumbers(Value=deconstruct.YComponent, Source=bounds_2, Target=construct_domain)  # -> Mapped, Clipped
last_index = LastIndex(List=addition)
demesh = DeconstructMesh(Mesh=mesh_3)  # -> Vertices, Faces, Colours, Normals
random = Random(Range=construct_domain_2, Number=list_length, Seed=2)  # -> graft(Random)
bnd = Bounds(Numbers=demesh.Vertices)
cull_index = CullIndex(List=addition, Indices=last_index, Wrap=True)
gradient = Gradient(
    LowerLimit=deconstruct_domain.Start,
    UpperLimit=deconstruct_domain.End,
    Parameter=cull_index,
    stops=[0.15: RGB(255, 130, 160), 0.85: RGB(220, 0, 40)])
gradient_2 = Gradient(
    LowerLimit=deconstruct_domain.Start,
    UpperLimit=deconstruct_domain.End,
    Parameter=cull_index,
    stops=[0: RGB(243, 57, 0), 0.1: RGB(236, 27, 60), 0.2: RGB(210, 0, 118), 0.3: RGB(103, 0, 120), 0.4: RGB(39, 72, 161), 0.5: RGB(1, 192, 229), 0.6: RGB(18, 178, 90), 0.7: RGB(79, 186, 8), 0.8: RGB(220, 237, 32), 0.9: RGB(247, 159, 20), 1: RGB(243, 57, 0)])
gradient_3 = Gradient(
    LowerLimit=deconstruct_domain.Start,
    UpperLimit=deconstruct_domain.End,
    Parameter=cull_index,
    stops=[0: RGB(234, 38, 0), 0.25: RGB(234, 126, 0), 0.5: RGB(254, 244, 84), 0.75: RGB(173, 203, 249), 1: RGB(75, 107, 169)])
remap = RemapNumbers(Value=demesh.Vertices, Source=bnd, Target=Domain(0, 1))  # -> Mapped, Clipped
stream_filter = StreamFilter(Gate=rh_in_panelgroupingtype, Stream0=remap_numbers.Mapped, Stream1=remap_numbers_2.Mapped, Stream2=random)
includes = Includes(Value=stream_filter, Domain=divide_domain)  # -> Includes, Deviation
graph = GraphMapper(
    remap.Mapped,
    x0=0,
    x1=1,
    y0=0,
    y1=1,
    amplitude=0.218028605,
    container_name="Perlin",
    decay=1,
    frequency=0.03698211908,
    x_offset=0.5846650004,
    y_offset=0.4053633809)
surface_4 = Surface(flatten(surface_2))
gradient_4 = Gradient(LowerLimit="0", UpperLimit="1", Parameter=graph, stops=[0.28: RGB(212, 255, 38), 0.945: RGB(255, 255, 255)])
negative_2 = Negative(Value="1.5")
stream_filter_2 = StreamFilter(Gate=rh_in_colourtype, Stream0=gradient_3, Stream1=gradient_2, Stream2=gradient)
member_index = MemberIndex(Set=includes.Includes, Member=Toggle(True))  # -> Index, Count
offset_curve = OffsetCurve(Curve=surface_4, Plane=PlaneXY(0, 0, 0), Distance=negative_2, BothSides=0, Kinks=0, CapType=1)
conmesh = ConstructMesh(Vertices=demesh.Vertices, Faces=demesh.Faces, Colours=gradient_4)
list_item_5 = ListItem(List=stream_filter_2, Index=member_index.Index, Wrap=True)  # -> simplify(Item)
number_slider = Slider(10, range=0..100)
mblur = BlurMesh(Mesh=conmesh, Iterations=Slider(0, range=0..5))
surface_5 = Surface(offset_curve)
curve_3 = Curve(c_script.B)
multiplication_2 = Multiplication(A=number_slider, B=Slider(2, range=0..10))
mesh_4 = Mesh(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)
colours = Data(flatten(list_item_5))
create_set = CreateSet(List=colours)  # -> Set, Map
construct_domain_3 = ConstructDomain(DomainStart=Slider(0, range=0..100), DomainEnd=Slider(433, range=0..1000))
mesh_5 = Data(simplify(flatten(graft_tree)))
populate_geometry = PopulateGeometry(Geometry=surface_5, Count=number_slider, Seed=Slider(50, range=0..100))  # -> flatten(Population)
member_index_2 = MemberIndex(Set=colours, Member=create_set.Set)  # -> Index, Count
mesh_colours = MeshColours(Mesh=graft_tree, Colours=list_item_5)
plane = Plane(populate_geometry)
random_2 = Random(Range=construct_domain_3, Number=multiplication_2, Seed=Slider(52, range=0..100))
list_item_organised_meshes = ListItem(List=mesh_5, Index=member_index_2.Index, Wrap=True)
list_indices = ListIndices(List=create_set.Set)
volume = Volume(Geometry=mesh_4)  # -> Volume, Centroid
project = Project(Geometry=volume.Centroid, Plane=PlaneXY(0, 0, 0))  # -> Geometry, Transform
lng = ListLength(List=random_2)
random_3 = Random(Range=Domain(0, 1), Number=Slider(5, range=0..100), Seed=Slider(4, range=0..10))
stream_filter_3 = StreamFilter(Gate=boolean_toggle_2, Stream1=mblur)
graft_tree_3 = GraftTree(Tree=list_indices, IncludeEmptyLists=True, IncludeNullItems=True)
area_3 = Area(Geometry=list_item_organised_meshes)  # -> Area, Centroid
pt = Point(project.Geometry)
rotate = Rotate(Geometry=plane, Angle=degrees(random_2), Plane=plane)  # -> Geometry, Transform
stream_filter_4 = StreamFilter(Gate=boolean_toggle, Stream1=curve_3)
x_plus_one = XPlusOne(NumberX=graft_tree_3)
curve_4 = Curve(join_curves_2)
stream_filter_5 = StreamFilter(Gate=boolean_toggle_7, Stream1=surface)
orient = Orient(Geometry=mesh_4, Source=pt, Target=rotate.Geometry)  # -> Geometry, Transform
curve_5 = Curve(interpolate.Curve)
stream_filter_6 = StreamFilter(Gate=boolean_toggle_3, Stream1=curve_4)
random_4 = Random(Range=Domain(0.5, 1), Number=lng, Seed=2)
evaluate_curve = EvaluateCurve(Curve=reparameterize(interpolate.Curve), Parameter=random_3)  # -> Point, Tangent, Angle
stream_filter_7 = StreamFilter(Gate=rh_in_paneltype, Stream0="Quad", Stream1="Triangular", Stream2="Diamond")
stream_filter_8 = StreamFilter(Gate=boolean_toggle_4, Stream1=curve_5)
curve_boundary = Curve(stream_filter_6)
c_script_2 = CSharpScript(face="Arial", bold=Toggle(False), size=Slider(0.781, range=0..11), content=x_plus_one, pl=area_3.Centroid)  # -> out, A; inputs face: String, bold: Boolean, italics: Boolean, size: Double, content: String, pl: Plane
# ---------- c_script_2: C# usings ----------
using System.IO;
using System.Linq;
using System.Data;
using System.Drawing;
using System.Reflection;
using System.Windows.Forms;
using System.Xml;
using System.Xml.Linq;
using System.Runtime.InteropServices;

using Rhino.DocObjects;
using Rhino.Collections;
using GH_IO;
using GH_IO.Serialization;
# ---------- c_script_2: C# ----------
    if(size == 0)
      size = 1;

    if(!string.IsNullOrEmpty(face) && size > 0 && !string.IsNullOrEmpty(content) &&
      pl.IsValid)
    {
      using (var doc = Rhino.RhinoDoc.CreateHeadless(null))
      {
        var te = doc.Objects.AddText(content, pl, size, face, bold, italics);
        var txt = doc.Objects.Find(te) as Rhino.DocObjects.TextObject;

        if(txt != null)
        {
          var tt = txt.Geometry as Rhino.Geometry.TextEntity;
          A = tt.Explode();
        }
      }
    }
# ---------- end c_script_2 ----------
deconstruct_brep_3 = DeconstructBrep(Brep=stream_filter_5)  # -> Faces, Edges, Vertices
stream_filter_9 = StreamFilter(Gate=rh_in_colourtype, Stream0="heat", Stream1="rainbow", Stream2="red")
stream_filter_10 = StreamFilter(Gate=rh_in_colourtype, Stream0="curvature", Stream1="x-axis", Stream2="scattered")
scale = Scale(Geometry=orient.Geometry, Center=rotate.Geometry, Factor=random_4)  # -> simplify(graft(Geometry)), Transform
area_4 = Area(Geometry=loft)  # -> Area, Centroid
offset_mesh = OffsetMesh(Mesh=graft_tree, Distance=Slider(0.2, range=0..1), BothSides=0, CreateSolid=True)
custom_preview = CustomPreview(Geometry=offset_mesh, Material=list_item_5)
list_length_2 = ListLength(List=evaluate_curve.Point)
demesh_2 = DeconstructMesh(Mesh=scale.Geometry)  # -> simplify(Vertices), Faces, Colours, Normals
length = Length(Curve=interpolate.Curve)
list_length_3 = ListLength(List=flatten(list_item_5))
stream_filter_11 = StreamFilter(Gate=rh_in_showgroupnumbers, Stream1=c_script_2.A)
pdecon = Deconstruct(Point=demesh_2.Vertices)  # -> XComponent, YComponent, ZComponent
integer = Integer(list_length_3)
integer_2 = Integer(flatten(length))
integer_3 = Integer(area_4.Area)
integer_4 = Integer(rh_in_paneltypenumber)
c_script_3 = CSharpScript(mesh=simplify(offset_mesh), color=list_item_5)  # -> out, A; inputs mesh: Mesh, color: Color
# ---------- c_script_3: C# ----------
    var c = color.R + "," + color.G + "," + color.B;
    mesh.SetUserString("color", c);
    A = mesh;
# ---------- end c_script_3 ----------
bnd_2 = Bounds(Numbers=pdecon.ZComponent)
remap_2 = RemapNumbers(Value=pdecon.ZComponent, Source=bnd_2, Target=Domain(0, 1))  # -> Mapped, Clipped
stream_filter_12 = StreamFilter(Gate=rh_in_showcolour, Stream1=c_script_3.A)
gradient_5 = Gradient(
    LowerLimit=0,
    UpperLimit=1,
    Parameter=remap_2.Mapped,
    stops=[0: RGB(132, 196, 29), 0.359: RGB(105, 214, 130), 0.789: RGB(164, 219, 101)])
mcol = MeshColours(Mesh=scale.Geometry, Colours=gradient_5)
mesh_6 = Mesh(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)
plane_2 = Plane(evaluate_curve.Point)
random_5 = Random(Range=Domain(0, 360), Number=list_length_2, Seed=Slider(42, range=0..100))

# ---- group: RH_OUT:sky_visibility_area
# DATA OUTPUT
data_2 = Data(flatten(integer_3))

# ---- group: RH_OUT:panel_type
data_3 = Data(flatten(stream_filter_7))

# ---- group: RH_OUT:central_path_length
data_4 = Data(flatten(integer_2))

# ---- group: RH_OUT:colour_gradient
data_5 = Data(flatten(stream_filter_9))

# ---- group: RH_OUT:panel_type_number
data_6 = Data(flatten(integer_4))

# ---- group: RH_OUT:grouping_type
data_7 = Data(flatten(stream_filter_10))

# ---- group: RH_OUT:panel_number
data_8 = Data(flatten(integer))

# ----
volume_2 = Volume(Geometry=mesh_6)  # -> Volume, Centroid
mblur_2 = BlurMesh(Mesh=mcol, Iterations=Slider(1, range=0..5))
sky_visibility_area = Panel(data_2)
central_path_length = Panel(data_4)
colour_gradient = Panel(data_5)
grouping_type = Panel(data_7)
panel_type = Panel(data_3)
panel_number = Panel(data_8)
panel_type_number = Panel(data_6)
project_2 = Project(Geometry=volume_2.Centroid, Plane=PlaneXY(0, 0, 0))  # -> Geometry, Transform
pt_2 = Point(project_2.Geometry)
rotate_2 = Rotate(Geometry=plane_2, Angle=degrees(random_5), Plane=plane_2)  # -> Geometry, Transform
stream_filter_13 = StreamFilter(Gate=boolean_toggle_6, Stream1=mblur_2)
orient_2 = Orient(Geometry=mesh_6, Source=pt_2, Target=rotate_2.Geometry)  # -> Geometry, Transform
lng_2 = ListLength(List=random_5)
random_6 = Random(Range=Domain(0.85, 1), Number=lng_2, Seed=2)
scale_2 = Scale(Geometry=orient_2.Geometry, Center=rotate_2.Geometry, Factor=random_6)  # -> Geometry, Transform
mesh_colours_2 = MeshColours(Mesh=scale_2.Geometry, Colours=ColourSwatch(SwatchColor=RGB(255, 255, 255)))
stream_filter_14 = StreamFilter(Gate=boolean_toggle_5, Stream1=mesh_colours_2)

# ---- group: RH_OUT:colour
# GEOMETRY OUTPUT
mesh_7 = Mesh(stream_filter_12)

# ---- group: RH_OUT:curve_arcs
curve_arcs = Curve(flatten(stream_filter_4))

# ---- group: RH_OUT:panel_group_numbers
curve_6 = Curve(stream_filter_11)

# ---- group: RH_OUT:terrain
mesh_8 = Mesh(flatten(stream_filter_3))

# ---- group: RH_OUT:curve_boundary
curve_7 = Curve(flatten(curve_boundary))

# ---- group: RH_OUT:people
geometry_people = Geometry(flatten(stream_filter_14))

# ---- group: RH_OUT:trees
geometry_trees = Geometry(flatten(stream_filter_13))

# ---- group: RH_OUT:curve_path
curve_path = Curve(flatten(stream_filter_8))

# ---- group: RH_OUT:edge_curves
# DATA
curve_8 = Curve(flatten(deconstruct_brep_3.Edges))
