# Grasshopper definition skyglazerSimple.gh (Grasshopper 1.0.7)

# ---- group: RH_IN:site_width
# SITE
site_width = Slider(15, range=0..20)

# ---- group: RH_IN:site_length
site_length = Slider(82, range=0..100)

# ----
rectangle = Rectangle(Plane=PlaneXY(0, 0, 0), XSize=site_width, YSize=site_length, Radius=0)  # -> Rectangle, Length
explode = Explode(Curve=rectangle.Rectangle, Recursive=True)  # -> Segments, Vertices
populate_2d = Populate2D(Region=rectangle.Rectangle, Count=Slider(4, range=0..10), Seed=1)
list_item = ListItem(List=explode.Segments, Index=1, Wrap=True)
curve_control_points = Point(populate_2d)
sort_along_curve = SortAlongCurve(Points=curve_control_points, Curve=list_item)  # -> Points, Indices
interpolate = Interpolate(Vertices=sort_along_curve.Points, Degree=3, Periodic=False, KnotStyle=1)  # -> Curve, Length, Domain
interpolate_2 = Interpolate(Vertices=sort_along_curve.Points, Degree=3, Periodic=False, KnotStyle=1)  # -> Curve, Length, Domain
curve_closest_point = CurveClosestPoint(Point=populate_2d, Curve=interpolate_2.Curve)  # -> Point, Parameter, Distance
perp_frame = PerpFrame(Curve=interpolate_2.Curve, Parameter=curve_closest_point.Parameter)
sort_along_curve_2 = SortAlongCurve(Points=perp_frame, Curve=interpolate_2.Curve)  # -> Points, Indices
merge = Merge(Data1=Slider(4, range=0..10), Data2=Slider(3, range=0..10), Data3=Slider(1, range=0..10), Data4=Slider(10, range=0..10))
deconstruct_plane = DeconstructPlane(Plane=sort_along_curve_2.Points)  # -> Origin, XAxis, YAxis, ZAxis
data = Data(merge)
negative = Negative(Value=data)
line_sdl = LineSDL(Start=sort_along_curve_2.Points, Direction=deconstruct_plane.XAxis, Length=data)  # -> flatten(Line)
line_sdl_2 = LineSDL(Start=sort_along_curve_2.Points, Direction=deconstruct_plane.XAxis, Length=negative)  # -> flatten(Line)
end_points = EndPoints(Curve=line_sdl)  # -> Start, End
# 10% increments
# 10% increments
end_points_2 = EndPoints(Curve=line_sdl_2)  # -> Start, End
join_curves = JoinCurves(Curves=[line_sdl_2, line_sdl], Preserve=False)
interpolate_3 = Interpolate(Vertices=end_points.End, Degree=3, Periodic=False, KnotStyle=1)  # -> Curve, Length, Domain
# 5% increments
interpolate_4 = Interpolate(Vertices=end_points_2.End, Degree=3, Periodic=False, KnotStyle=1)  # -> Curve, Length, Domain
plane = Plane(perp_frame)
end_points_3 = EndPoints(Curve=join_curves)  # -> Start, End
xz_plane = XZPlane(Origin=Point(0, 0, 0))
c_script = CSharpScript(plane=xz_plane, start=end_points_3.Start, end=end_points_3.End, radius=data)  # -> out, A, B, C, D; inputs plane: Plane, start: Point3d, end: Point3d, radius: Double
# ---------- c_script: C# ----------
    var line = new Line(start, end);
    var vec = Vector3d.CrossProduct(line.Direction, plane.ZAxis);
    vec.Unitize();
    var d = Math.Sqrt(Math.Pow(radius, 2.0) - Math.Pow(line.Length, 2.0) / 4.0);
    A = new Arc(start, line.PointAt(0.5) + vec * (radius - d), end);
    B = new Arc(start, line.PointAt(0.5) - vec * (radius - d), end);
    C = new Arc(start, line.PointAt(0.5) + vec * (radius + d), end);
    D = new Arc(start, line.PointAt(0.5) - vec * (radius + d), end);
# ---------- end c_script ----------
end_points_4 = EndPoints(Curve=c_script.B)  # -> Start, End
line = Line(StartPoint=end_points_4.Start, EndPoint=end_points_4.End)
curve_middle = CurveMiddle(Curve=line)
rotate_3d = Rotate3D(Geometry=c_script.B, Angle=expr("-x", degrees(Slider(0, range=0..100))), Center=curve_middle, Axis=plane)  # -> flatten(Geometry), Transform
clean_tree = CleanTree(RemoveNulls=True, RemoveInvalid=True, RemoveEmpty=False, Tree=rotate_3d.Geometry)
sweep2 = Sweep2(Rail1=interpolate_3.Curve, Rail2=interpolate_4.Curve, Sections=clean_tree, SameHeight=False)

# ---- group: RH_OUT:curve_outline
curve = Curve(sweep2)

# ---- group: RH_OUT:curve_path
curve_2 = Curve(interpolate.Curve)
