# Grasshopper definition sphereGrow.gh (Grasshopper 1.0.7)

number_slider = Slider(20, range=0..100)
rh_in_spheregrow = GetNumber(Slider(1, range=1..3), AtLeast=1, AtMost=1, Maximum=1.797693135e+308, Minimum=-1.797693135e+308)
series = Series(Start=number_slider, Step=number_slider, Count=rh_in_spheregrow)
mesh_sphere = MeshSphere(Base=PlaneXY(0, 0, 0), Radius=10, UCount=10, VCount=20)
unit_z = UnitZ(Factor=series)
move = Move(Geometry=mesh_sphere, Motion=unit_z)  # -> Geometry, Transform
context_bake = ContextBake(RH_OUTSphereGeo=move.Geometry)
