# Grasshopper definition street_node_v4.gh (Grasshopper 1.0.7)

number_slider = Slider(213, range=100..300)
number_slider_2 = Slider(65, range=50..150)

# ----
# Podium Height (m)
# Floor Height (m)
# Number of levels
rh_in_levelnumber = GetInteger(
    Slider(6, range=2..20),
    AtLeast=1,
    AtMost=1,
    Maximum=20,
    Minimum=2,
    Prompt="Enter Number of Floors (must be between 2 and 20)")
rh_in_floorheight = GetInteger(
    Slider(4, range=3..6),
    AtLeast=1,
    AtMost=1,
    Maximum=6,
    Minimum=3,
    Prompt="Enter Floor height (must be between 3m and 6m)")
# Width between Buildings (m)
rh_in_buildinggapwidth = GetInteger(
    Slider(11, range=4..15),
    AtLeast=1,
    AtMost=1,
    Maximum=15,
    Minimum=4,
    Prompt="Enter Gap size between buildings (must be between 4m and 15m)")
rh_in_podiumheight = GetInteger(
    Slider(10, range=3..12),
    AtLeast=1,
    AtMost=1,
    Maximum=12,
    Minimum=3,
    Prompt="Enter Podium height (must be between 3m and 12m)")

# ----
# Site Dimensions
# Street position
# Street angle
# Street width
# Building Depth
rh_in_sitelength = GetInteger(number_slider, AtLeast=1, AtMost=1, Maximum=300, Minimum=150, Prompt="Enter Site Length (between 150m and 300m)")
rh_in_streetangle = GetInteger(
    Slider(-35, range=-35..35),
    AtLeast=1,
    AtMost=1,
    Maximum=35,
    Minimum=-35,
    Prompt="Enter Street Angle (must be between -35 and 35 degrees)")
rh_in_sitewidth = GetInteger(number_slider_2, AtLeast=1, AtMost=1, Maximum=150, Minimum=50, Prompt="Enter Site Width (between 50m and 150m)")
rh_in_streetposition = GetInteger(
    Slider(9, range=-10..10),
    AtLeast=1,
    AtMost=1,
    Maximum=10,
    Minimum=-10,
    Prompt="Enter Street Position (Distance from centre from -10m to 10m)")
rh_in_buildingdepth = GetInteger(
    Slider(18, range=12..24),
    AtLeast=1,
    AtMost=1,
    Maximum=24,
    Minimum=12,
    Prompt="Enter Building depth (must be between 12m and 24m)")
rh_in_streetwidth = GetInteger(
    Slider(21, range=4..24),
    AtLeast=1,
    AtMost=1,
    Maximum=24,
    Minimum=4,
    Prompt="Enter Street Width (must be between 4m and 24m)")

# ----
# INPUT
panel = Panel("2")
division = Division(A=number_slider_2, B="2")
division_2 = Division(A=number_slider, B=panel)
pt = ConstructPoint(XCoordinate=expr("-x", division_2), YCoordinate=expr("-x", division), ZCoordinate=0)
rectangle = Rectangle(Plane=pt, XSize=rh_in_sitelength, YSize=rh_in_sitewidth, Radius=0)  # -> Rectangle, Length
area = Area(Geometry=rectangle.Rectangle)  # -> Area, Centroid
X = UnitX(Factor=rh_in_streetposition)
neg = Negative(Value=rh_in_sitewidth)
xz = XZPlane(Origin=Point(0, 0, 0))
move = Move(Geometry=area.Centroid, Motion=X)  # -> Geometry, Transform
pln = Plane(move.Geometry)
line = LineSDL(Start=pln, Direction=xz, Length=[rh_in_sitewidth, neg])
join = JoinCurves(Curves=line, Preserve=False)
rotate = Rotate(Geometry=join, Angle=degrees(rh_in_streetangle), Plane=pln)  # -> Geometry, Transform
multiplication = Multiplication(A=rh_in_streetwidth, B=0.5)
multiplication_2 = Multiplication(A=rh_in_streetwidth, B=-0.5)
# Position of Building Gap
number_slider_3 = Slider(0.5, range=0..1)
offset = OffsetCurve(Curve=rotate.Geometry, Distance=[multiplication_2, multiplication], Corners=1)
end = EndPoints(Curve=flatten(offset))  # -> Start, End
item = ListItem(List=end.End, Index=0, Wrap=True)  # -> Item, Item1
item_2 = ListItem(List=end.Start, Index=0, Wrap=True)  # -> Item, Item1
ln = Line(StartPoint=item.Item, EndPoint=item.Item1)
ln_2 = Line(StartPoint=item_2.Item, EndPoint=item_2.Item1)
join_2 = JoinCurves(Curves=flatten([offset, ln_2, ln]), Preserve=False)
rdiff = RegionDifference(CurvesA=rectangle.Rectangle, CurvesB=join_2)  # -> graft(Result)
offset_2 = OffsetCurve(Curve=rdiff, Distance=expr("-x", rh_in_buildingdepth), Corners=1)
pshift = ShiftPaths(Data=offset_2, Offset=-1)
explode = Explode(Curve=pshift, Recursive=True)  # -> Segments, Vertices
flip = FlipCurve(Curve=explode.Segments)  # -> Curve, Flag
crv = Curve(explode.Segments)
multiplication_3 = Multiplication(A=rh_in_buildinggapwidth, B=-0.5)
multiplication_4 = Multiplication(A=rh_in_buildinggapwidth, B=0.5)
eval = EvaluateLength(Curve=explode.Segments, Length=multiplication_4, Normalized=False)  # -> Point, Tangent, Parameter
eval_2 = EvaluateLength(Curve=flip.Curve, Length=multiplication_4, Normalized=False)  # -> Point, Tangent, Parameter
ln_3 = Line(StartPoint=eval.Point, EndPoint=eval_2.Point)
eval_3 = EvaluateCurve(Curve=reparameterize(ln_3), Parameter=number_slider_3)  # -> Point, Tangent, Angle
crv_cp = CurveClosestPoint(Point=eval_3.Point, Curve=crv)  # -> Point, Parameter, Distance
pframe = PerpFrame(Curve=crv, Parameter=crv_cp.Parameter)
deplane = DeconstructPlane(Plane=pframe)  # -> Origin, XAxis, YAxis, ZAxis
pl = ConstructPlane(Origin=deplane.Origin, XAxis=deplane.ZAxis, YAxis=deplane.XAxis)
line_2 = LineSDL(Start=pframe, Direction=pl, Length=expr("x+1", rh_in_buildingdepth))
number_slider_4 = Slider(1, range=0..1)
offset_3 = OffsetCurve(Curve=graft(line_2), Distance=flatten([multiplication_3, multiplication_4]), Corners=1)
ext = ExtendCurve(Curve=offset_3, Type=expr("0", 0), Start=number_slider_4, End=number_slider_4)
end_2 = EndPoints(Curve=simplify(offset_3))  # -> Start, End
flatten = FlattenTree(Tree=end_2.End, Path="{0}")
flatten_2 = FlattenTree(Tree=end_2.Start, Path="{0}")
partition = PartitionList(List=flatten, Size=2)
partition_2 = PartitionList(List=flatten_2, Size=2)
item_3 = ListItem(List=partition_2, Index=0, Wrap=True)  # -> Item, Item1
item_4 = ListItem(List=partition, Index=0, Wrap=True)  # -> Item, Item1
ln_4 = Line(StartPoint=item_3.Item, EndPoint=item_3.Item1)
ln_5 = Line(StartPoint=item_4.Item, EndPoint=item_4.Item1)
srf = Surface(rdiff)
loft = Loft(Curves=[pshift, rdiff], Options={Adjust=False, Closed=False, LoftEnds=0, LoftSimp=0, LoftType=0, Rebuild=10, Refit=0.01})  # -> graft(Loft)
edges = BrepEdges(Brep=loft)  # -> Naked, Interior, NonManifold
crv_2 = Curve(edges.Naked)
join_3 = JoinCurves(Curves=flatten([ln_4, ln_5, offset_3]), Preserve=False)
crv_3 = Curve(crv_2)
boundary = BoundarySurfaces(Edges=crv_3)
srfsplit = SurfaceSplit(Surface=boundary, Curves=join_3)  # -> simplify(Fragments)
sort = SortList(Keys=srfsplit, ValuesA=srfsplit)  # -> Keys, ValuesA
item_5 = ListItem(List=sort.ValuesA, Index=0, Wrap=True)
area_2 = Area(Geometry=srfsplit)  # -> Area, Centroid
area_3 = Area(Geometry=item_5)  # -> Area, Centroid
round = Round(Number=area_3.Area)  # -> Nearest, Floor, Ceiling
larger = LargerThan(FirstNumber=area_2.Area, SecondNumber=expr("x+1", round.Ceiling))  # -> LargerThan, OrEqualTo
cull = CullPattern(List=srfsplit, CullPattern=larger.LargerThan)
srf_2 = Surface(cull)
group = Group(Objects=srf_2)
graft = GraftTree(Tree=srf_2, IncludeEmptyLists=True, IncludeNullItems=True)
series = Series(Start=rh_in_podiumheight, Step=rh_in_floorheight, Count=rh_in_levelnumber)
crv_4 = Curve(graft)
Z = UnitZ(Factor=series)
repeat = RepeatData(Data=rh_in_floorheight, Length=rh_in_levelnumber)
move_2 = Move(Geometry=crv_4, Motion=Z)  # -> simplify(Geometry), Transform
crv_5 = Curve(flatten(srf_2))
addition = Addition(A=rh_in_podiumheight, B="0.1")
join_4 = JoinCurves(Curves=crv_5, Preserve=False)
lng = ListLength(List=move_2.Geometry)
Z_2 = UnitZ(Factor=addition)
series_2 = Series(Start=0, Step=1, Count=lng)
Z_3 = UnitZ(Factor=1)
move_3 = Move(Geometry=join_4, Motion=Z_2)  # -> Geometry, Transform
Z_4 = UnitZ(Factor=rh_in_podiumheight)
replace = ReplaceItems(List=move_2.Geometry, Item=repeat, Indices=series_2, Wrap=False)
crv_6 = Curve(simplify(flatten(rdiff)))
join_5 = JoinCurves(Curves=crv_6, Preserve=False)
move_4 = Move(Geometry=join_5, Motion=Z_2)  # -> Geometry, Transform
rdiff_2 = RegionDifference(CurvesA=move_4.Geometry, CurvesB=move_3.Geometry)
amp = Amplitude(Vector=Z_3, Amplitude=replace)  # -> simplify(Vector)
swatch = Red(SwatchColor=RGB(15, 150, 26))
extr = Extrude(Base=move_2.Geometry, Direction=amp)
srf_3 = Surface(rdiff_2)
pshift_2 = ShiftPaths(Data=extr, Offset=-1)
mesh_join = MeshJoin(Meshes=srf_3)
extr_2 = Extrude(Base=crv_6, Direction=Z_4)  # -> graft(Extrusion)
ins = InsertItems(List=pshift_2, Item=extr_2, Indices="0", Wrap=True)
cap = CapHoles(Brep=ins)
viewer = ParamViewer(ins)
bang = ExplodeTree(Data=cap)  # -> Branch0, Branch1
edges_2 = BrepEdges(Brep=cap)  # -> Naked, Interior, NonManifold
mcol = MeshColours(Mesh=bang.Branch0, Colours=ColourSwatch(SwatchColor=RGB(255, 0, 0)))
mcol_2 = MeshColours(Mesh=bang.Branch1, Colours=ColourSwatch(SwatchColor=RGB(0, 98, 255)))
mcol_3 = MeshColours(Mesh=mesh_join, Colours=swatch)
mesh_join_2 = MeshJoin(Meshes=mcol_2)
area_4 = Area(Geometry=move_2.Geometry)  # -> flatten(Area), Centroid
area_5 = Area(Geometry=srf_3)  # -> flatten(Area), Centroid
merge = Merge(Data2=mesh_join_2)  # -> flatten(Result)
area_6 = Area(Geometry=rdiff)  # -> flatten(Area), Centroid
mesh_join_3 = MeshJoin(Meshes=mcol)
mesh_join_4 = MeshJoin(Meshes=merge)
mass_addition = MassAddition(Input=area_5.Area)  # -> Result, PartialResults
mass_addition_2 = MassAddition(Input=area_6.Area)  # -> PodiumArea, PartialResults
mass_addition_3 = MassAddition(Input=area_4.Area)  # -> ApartmentArea, PartialResults
merge_2 = Merge(Data1=edges_2.Naked, Data2=edges_2.Interior)  # -> flatten(Result)

# ---- group: RH_OUT:apartmentArea
integer = Integer(flatten(mass_addition_3.ApartmentArea))

# ---- group: RH_OUT:podiumArea
integer_2 = Integer(flatten(mass_addition_2.PodiumArea))

# ---- group: RH_OUT:greenArea
# DATA OUTPUT
rh_out_greearea = Integer(flatten(mass_addition.Result))

# ----
context_bake = ContextBake(Geometry=merge_2)
# GEOMETRY OUTPUT
context_bake_2 = ContextBake(Mesh_buildings_1=mesh_join_3)
context_bake_3 = ContextBake(Mesh_buildings_2=mesh_join_4)
context_bake_4 = ContextBake(Mesh_terrace=mcol_3)
