# Grasshopper definition workstationv2.gh (Grasshopper 1.0.7)
# plug-ins: Pufferfish

hexagonal = Hexagonal(
    Plane=PlaneXY(0, 0, 0),
    Size=Slider(2000, range=0..2000),
    ExtentX=Slider(1, range=0..100),
    ExtentY=Slider(1, range=0..10))  # -> Cells, Points
explode = Explode(Curve=hexagonal.Cells, Recursive=True)  # -> Segments, Vertices
dispatch = Dispatch(List=explode.Segments, DispatchPattern=[True, False])  # -> ListA, ListB
curve = Curve(reparameterize(dispatch.ListA))
perp_frame = PerpFrame(Curve=curve, Parameter=".5")

# ---- group: RH_IN:level
number_slider = Slider(0, range=0..4)

# ----
deconstruct_plane = DeconstructPlane(Plane=perp_frame)  # -> Origin, XAxis, YAxis, ZAxis
construct_plane = ConstructPlane(Origin=deconstruct_plane.Origin, XAxis=deconstruct_plane.ZAxis, YAxis=deconstruct_plane.XAxis)
mirror = Mirror(Geometry=hexagonal.Cells, Plane=construct_plane)  # -> Geometry, Transform
stream_filter = StreamFilter(Gate=number_slider, Stream1=mirror.Geometry, Stream2=mirror.Geometry, Stream3=mirror.Geometry, Stream4=mirror.Geometry)
merge = Merge(Data1=hexagonal.Cells, Data2=stream_filter)  # -> flatten(Result)
explode_2 = Explode(Curve=merge, Recursive=True)  # -> simplify(Segments), Vertices
split_tree = SplitTree(Data=explode_2.Segments, Masks=flatten("{0}"))  # -> Positive, Negative
join_curves = JoinCurves(Curves=split_tree.Negative, Preserve=False)
curve_middle = CurveMiddle(Curve=split_tree.Negative)
join_curves_2 = JoinCurves(Curves=split_tree.Positive, Preserve=False)
curve_middle_2 = CurveMiddle(Curve=split_tree.Positive)
polygon_center = PolygonCenter(Polyline=join_curves)  # -> CenterV, CenterE, CenterA
shift_list = ShiftList(List=curve_middle, Shift=1, Wrap=True)
dispatch_2 = Dispatch(List=shift_list, DispatchPattern=invert([True, False]))  # -> ListA, ListB
polygon_center_2 = PolygonCenter(Polyline=join_curves_2)  # -> CenterV, CenterE, CenterA
dispatch_3 = Dispatch(List=curve_middle_2, DispatchPattern=[True, False])  # -> ListA, ListB
line = Line(StartPoint=dispatch_2.ListA, EndPoint=polygon_center.CenterV)
line_2 = Line(StartPoint=dispatch_3.ListA, EndPoint=polygon_center_2.CenterV)
number_slider_2 = Slider(500, range=0..500)
merge_2 = Merge(Data1=line_2, Data2=line)
negative = Negative(Value=number_slider_2)
offset_curve = OffsetCurve(Curve=merge_2, Plane=PlaneXY(0, 0, 0), Distance=number_slider_2, BothSides=negative, Kinks=0, CapType=1)
unflatten_tree = UnflattenTree(Tree=offset_curve, Guide=merge_2)
number_slider_3 = Slider(1000, range=0..1000)
region_union = RegionUnion(Curves=unflatten_tree)
fillet = Fillet(Curve=flatten(region_union), Radius=number_slider_3)  # -> simplify(Curve)
division = Division(A=number_slider_3, B="2")

# ---- group: Light gap
number_slider_4 = Slider(50, range=0..300)

# ----
number_slider_5 = Slider(50, range=0..300)
tree_branch = TreeBranch(Tree=fillet, Path="0", MaintainPaths=True)
insert_items = InsertItems(List=tree_branch, Item="0", Indices="0", Wrap=True)  # -> simplify(graft(List))
param_viewer = ParamViewer(insert_items)
tree_branch_2 = TreeBranch(Tree=insert_items, Path=Slider(0, range=0..100), MaintainPaths=True)
param_viewer_2 = ParamViewer(fillet)
unit_z = UnitZ(Factor=number_slider_4)
negative_2 = Negative(Value=number_slider_5)
# FLOOR HEIGHT
number_slider_6 = Slider(2500, range=0..3000)
# GROUND WALL
offset_curve_2 = OffsetCurve(Curve=insert_items, Distance=negative_2, Corners=1)
series = Series(Start=0, Step=number_slider_6, Count=Slider(1, range=0..10))
unit_z_2 = UnitZ(Factor=series)
move = Move(Geometry=insert_items, Motion=unit_z)  # -> Geometry, Transform
move_2 = Move(Geometry=move.Geometry, Motion=unit_z_2)  # -> Geometry, Transform
unit_z_3 = UnitZ(Factor=number_slider_6)
curve_2 = Curve(move.Geometry)
move_3 = Move(Geometry=curve_2, Motion=unit_z_3)  # -> Geometry, Transform
first_floor_workstation_top = Data(move_3.Geometry)
unit_z_4 = UnitZ(Factor=number_slider_4)
move_4 = Move(Geometry=first_floor_workstation_top, Motion=unit_z_4)  # -> Geometry, Transform
curve_3 = Curve(move.Geometry)
extrude = Extrude(Base=move_2.Geometry, Direction=unit_z_3)
divide_curve = DivideCurve(Curve=curve_3, Count=Slider(12, range=0..100), Kinks=False)  # -> Points, Tangents, Parameters
dispatch_4 = Dispatch(List=divide_curve.Points, DispatchPattern=[True, False])  # -> ListA, ListB
move_5 = Move(Geometry=extrude, Motion=Vector(0, 0, 10))  # -> Geometry, Transform
point = Point(dispatch_4.ListB)
curve_closest_point = CurveClosestPoint(Point=point, Curve=curve_3)  # -> Point, Parameter, Distance
shatter = Shatter(Curve=curve_3, Parameters=curve_closest_point.Parameter)
first_floor_level = Data(move_4.Geometry)
unit_z_5 = UnitZ(Factor=Slider(1000, range=0..1000))
dispatch_5 = Dispatch(List=shatter, DispatchPattern=[True, False])  # -> ListA, ListB
curve_4 = Curve(dispatch_5.ListA)
number_slider_7 = Slider(5, range=0..150)
move_6 = Move(Geometry=curve_4, Motion=unit_z_5)  # -> Geometry, Transform
extend_curve = ExtendCurve(Curve=move_6.Geometry, Type=0, Start=number_slider_7, End=number_slider_7)
close_curve = CloseCurve(Curve=extend_curve, CloseType=0, Bulge=0.5, Tolerance=0)  # -> Closed, ResultBoolean
ground_workstation = Data(offset_curve_2)
first_floor_level_2 = Data(first_floor_level)
addition = Addition(A=number_slider_6, B=number_slider_5, C=number_slider_5)
desk_curves = Data(close_curve.Closed)
first_floor_level_3 = Data(addition)
unit_z_6 = UnitZ(Factor=first_floor_level_3)
divide_domain² = DivideDomain²(Domain=move_5.Geometry, UCount="4", VCount="12")
isotrim = Isotrim(Surface=move_5.Geometry, Domain=divide_domain²)
panel = Panel("""True
False
False
True""")
dispatch_6 = Dispatch(List=isotrim, DispatchPattern=panel)  # -> ListA, ListB
curve_5 = Curve(dispatch_6.ListA)
divide_domain²_2 = DivideDomain²(Domain=move_5.Geometry, UCount="10", VCount="24")
isotrim_2 = Isotrim(Surface=move_5.Geometry, Domain=divide_domain²_2)
panel_2 = Panel("""True
True
False
False
False
False
True
True""")
dispatch_7 = Dispatch(List=isotrim_2, DispatchPattern=panel_2)  # -> ListA, ListB
panel_3 = Panel("""True
False
False
True""")
dispatch_8 = Dispatch(List=dispatch_7.ListB, DispatchPattern=panel_3)  # -> ListA, ListB
curved_mdle = Surface(dispatch_8.ListB)
straight_mdle = Surface(dispatch_8.ListA)
panel_4 = Panel("""30
31
32
33
34
35
36
37
38
39
40
41""")
list_item = ListItem(List=curved_mdle, Index=panel_4, Wrap=True)
list_item_2 = ListItem(List=straight_mdle, Index=panel_4, Wrap=True)
merge_3 = Merge(Data1=list_item, Data2=list_item_2)
surface = Surface(first_floor_level_2)
negative_3 = Negative(Value=number_slider_4)
curve_6 = Curve(move.Geometry)
extrude_2 = Extrude(Base=offset_curve_2, Direction=unit_z_6)
unit_z_7 = UnitZ(Factor=number_slider_6)
brep_join = BrepJoin(Breps=merge_3)  # -> Breps, Closed
extrude_3 = Extrude(Base=curve_6, Direction=unit_z_7)
offset_surface = OffsetSurface(Surface=surface, Distance=negative_3, BothSides=0, CreateSolid=True)
negative_4 = Negative(Value=Slider(100, range=0..100))
surface_2 = Surface(ground_workstation)
offset_surface_2 = OffsetSurface(Surface=brep_join.Breps, Distance=Slider(20, range=0..100), BothSides=0, CreateSolid=True)
negative_5 = Negative(Value=number_slider_4)
cap_holes = CapHoles(Brep=extrude_2)
offset_surface_3 = OffsetSurface(Surface=extrude_3, Distance=negative_4, BothSides=0, CreateSolid=True)
surface_3 = Surface(reparameterize(dispatch_6.ListA))
construct_domain² = ConstructDomain²(
    UMin=Slider(0.03, range=0..1),
    UMax=Slider(0.97, range=0..1),
    VMin=Slider(0.03, range=0..1),
    VMax=Slider(0.97, range=0..1))
offset_surface_4 = OffsetSurface(Surface=surface_2, Distance=negative_5, BothSides=0, CreateSolid=True)
surface_4 = Surface(desk_curves)
isotrim_3 = Isotrim(Surface=surface_3, Domain=construct_domain²)
offset_surface_5 = OffsetSurface(Surface=surface_4, Distance=Slider(25, range=0..100), BothSides=0, CreateSolid=True)
offset_surface_6 = OffsetSurface(Surface=isotrim_3, Distance=Slider(11, range=0..100), BothSides=0, CreateSolid=True)
ungroup = Ungroup()

# ---- group: RH:OUT:mesh
mesh_brep = MeshBrep(
    Brep=flatten([ungroup, offset_surface_2, offset_surface_5, offset_surface_6, offset_surface_3, cap_holes, offset_surface_4, offset_surface]),
    Settings={GridMaxCount=0, GridMinCount=16, JaggedSeams=False, MaxEdgeLength=0, MinEdgeLength=0.0001, MinTolerance=0, Refine=True, RefineAngle=0, RelativeTolerance=0.65, SimplePlanes=True, Tolerance=0})
