# Grasshopper definition workstationv6.gh (Grasshopper 1.0.7)
# plug-ins: Pufferfish

number_slider = Slider(2000, range=0..2000)
hexagonal = Hexagonal(Plane=PlaneXY(0, 0, 0), Size=Slider(2, range=0..10), ExtentX=Slider(1, range=0..100), ExtentY=Slider(1, range=0..10))  # -> Cells, Points
point = Point(hexagonal.Points)
explode = Explode(Curve=hexagonal.Cells, Recursive=True)  # -> Segments, Vertices

# ---- group: RH_IN:level
number_slider_2 = Slider(5, range=1..5)

# ----
dispatch = Dispatch(List=explode.Segments, DispatchPattern=[True, False])  # -> ListA, ListB
curve = Curve(reparameterize(dispatch.ListA))
perp_frame = PerpFrame(Curve=curve, Parameter=".5")
curve_2 = Curve(reparameterize(dispatch.ListB))
deconstruct_plane = DeconstructPlane(Plane=perp_frame)  # -> Origin, XAxis, YAxis, ZAxis
perp_frame_2 = PerpFrame(Curve=curve_2, Parameter=".5")
flip_curve = FlipCurve(Curve=hexagonal.Cells)  # -> Curve, Flag
construct_plane = ConstructPlane(Origin=deconstruct_plane.Origin, XAxis=deconstruct_plane.ZAxis, YAxis=deconstruct_plane.XAxis)
mirror = Mirror(Geometry=hexagonal.Cells, Plane=construct_plane)  # -> Geometry, Transform
deconstruct_plane_2 = DeconstructPlane(Plane=perp_frame_2)  # -> Origin, XAxis, YAxis, ZAxis
stream_filter = StreamFilter(
    Gate=number_slider_2,
    Stream1=mirror.Geometry,
    Stream2=mirror.Geometry,
    Stream3=mirror.Geometry,
    Stream4=mirror.Geometry,
    Stream5=mirror.Geometry)
construct_plane_2 = ConstructPlane(Origin=deconstruct_plane_2.Origin, XAxis=deconstruct_plane_2.ZAxis, YAxis=deconstruct_plane_2.XAxis)
merge = Merge(Data1=hexagonal.Cells, Data2=stream_filter)  # -> flatten(Result)
explode_2 = Explode(Curve=merge, Recursive=True)  # -> simplify(Segments), Vertices
mirror_2 = Mirror(Geometry=hexagonal.Cells, Plane=construct_plane_2)  # -> Geometry, Transform
curve_3 = Curve([mirror.Geometry, mirror_2.Geometry, flip_curve.Curve])
split_tree = SplitTree(Data=explode_2.Segments, Masks=flatten("{0}"))  # -> Positive, Negative
join_curves = JoinCurves(Curves=split_tree.Negative, Preserve=False)
curve_middle = CurveMiddle(Curve=split_tree.Negative)
explode_3 = Explode(Curve=[mirror_2.Geometry, mirror.Geometry], Recursive=True)  # -> Segments, Vertices
join_curves_2 = JoinCurves(Curves=split_tree.Positive, Preserve=False)
curve_middle_2 = CurveMiddle(Curve=split_tree.Positive)
polygon_center = PolygonCenter(Polyline=join_curves)  # -> CenterV, CenterE, CenterA
shift_list = ShiftList(List=curve_middle, Shift=1, Wrap=True)
curve_middle_3 = CurveMiddle(Curve=explode_3.Segments)
distance = Distance(PointA=point, PointB=curve_middle_3)
dispatch_2 = Dispatch(List=shift_list, DispatchPattern=invert([True, False]))  # -> ListA, ListB
polygon_center_2 = PolygonCenter(Polyline=join_curves_2)  # -> CenterV, CenterE, CenterA
dispatch_3 = Dispatch(List=curve_middle_2, DispatchPattern=[True, False])  # -> ListA, ListB
sort_list = SortList(Keys=distance, ValuesValuesA=explode_3.Segments)  # -> Keys, ValuesValuesA
line = Line(StartPoint=dispatch_2.ListA, EndPoint=polygon_center.CenterV)
curve_4 = Curve(sort_list.ValuesValuesA)
number_slider_3 = Slider(500, range=0..500)
line_2 = Line(StartPoint=dispatch_3.ListA, EndPoint=polygon_center_2.CenterV)
number_slider_4 = Slider(0.5, range=0..1)
merge_2 = Merge(Data1=line_2, Data2=line)
list_item = ListItem(List=curve_4, Index=[Slider(10, range=0..10), Slider(9, range=0..10)], Wrap=True)  # -> flatten(Item)
negative = Negative(Value=number_slider_4)
offset_curve = OffsetCurve(Curve=merge_2, Plane=PlaneXY(0, 0, 0), Distance=number_slider_4, BothSides=negative, Kinks=0, CapType=1)
join_curves_3 = JoinCurves(Curves=list_item, Preserve=False)
close_curve = CloseCurve(Curve=join_curves_3, CloseType=0, Bulge=0.5, Tolerance=0)  # -> Closed, ResultBoolean
flip_curve_2 = FlipCurve(Curve=close_curve.Closed)  # -> Curve, Flag
unflatten_tree = UnflattenTree(Tree=offset_curve, Guide=merge_2)
merge_3 = Merge(Data1=flip_curve_2.Curve, Data2=curve_3)  # -> flatten(Result)
number_slider_5 = Slider(1000, range=0..1000)
region_union = RegionUnion(Curves=unflatten_tree)
number_slider_6 = Slider(50, range=0..300)
fillet = Fillet(Curve=region_union, Radius=Slider(1, range=0..1))
number_slider_7 = Slider(0.05, range=0..0.1)
number_slider_8 = Slider(50, range=0..300)
number_slider_9 = Slider(0.02, range=0..0.1)
unit_z = UnitZ(Factor=number_slider_7)
# FLOOR HEIGHT
number_slider_10 = Slider(2.5, range=0..10)
number_slider_11 = Slider(2500, range=0..3000)
negative_2 = Negative(Value=number_slider_9)
offset_curve_2 = OffsetCurve(Curve=fillet, Distance=negative_2, Corners=1)
series = Series(Start=0, Step=number_slider_10, Count=Slider(1, range=0..10))
move = Move(Geometry=fillet, Motion=unit_z)  # -> Geometry, Transform
unit_z_2 = UnitZ(Factor=series)
move_2 = Move(Geometry=move.Geometry, Motion=unit_z_2)  # -> Geometry, Transform
unit_z_3 = UnitZ(Factor=number_slider_10)
curve_5 = Curve(move.Geometry)
move_3 = Move(Geometry=curve_5, Motion=unit_z_3)  # -> Geometry, Transform
first_floor_workstation_top = Data(move_3.Geometry)
unit_z_4 = UnitZ(Factor=number_slider_7)
move_4 = Move(Geometry=first_floor_workstation_top, Motion=unit_z_4)  # -> Geometry, Transform
addition = Addition(A=number_slider_9, B=number_slider_10)
curve_6 = Curve(move.Geometry)
# move up floors!
unit_z_5 = UnitZ(Factor=addition)
extrude = Extrude(Base=move_2.Geometry, Direction=unit_z_3)
divide_curve = DivideCurve(Curve=curve_6, Count=Slider(12, range=0..100), Kinks=False)  # -> Points, Tangents, Parameters
dispatch_4 = Dispatch(List=divide_curve.Points, DispatchPattern=[True, False])  # -> ListA, ListB
move_5 = Move(Geometry=extrude, Motion=Vector(0, 0, 10))  # -> Geometry, Transform
point_2 = Point(dispatch_4.ListB)
curve_closest_point = CurveClosestPoint(Point=point_2, Curve=curve_6)  # -> Point, Parameter, Distance
explode_4 = Explode(Curve=mirror_2.Geometry, Recursive=True)  # -> Segments, Vertices
shatter = Shatter(Curve=curve_6, Parameters=curve_closest_point.Parameter)
number_slider_12 = Slider(1000, range=0..1000)
number_slider_13 = Slider(500, range=0..1000)
first_floor_level = Data(move_4.Geometry)
curve_middle_4 = CurveMiddle(Curve=explode_4.Segments)
unit_z_6 = UnitZ(Factor=Slider(1, range=0..1))
dispatch_5 = Dispatch(List=shatter, DispatchPattern=[True, False])  # -> ListA, ListB
curve_7 = Curve(dispatch_5.ListA)
circle_fit = CircleFit(Points=curve_middle_4)  # -> Circle, Radius, Deviation
number_slider_14 = Slider(5, range=0..150)
negative_3 = Negative(Value=Slider(0.5, range=0..1))
number_slider_15 = Slider(0.013, range=0..0.1)
move_6 = Move(Geometry=curve_7, Motion=unit_z_6)  # -> Geometry, Transform
offset_curve_3 = OffsetCurve(Curve=circle_fit.Circle, Distance=negative_3, Corners=1)
ground_central_zone = Data(graft(merge_3))
extend_curve = ExtendCurve(Curve=move_6.Geometry, Type=0, Start=number_slider_15, End=number_slider_15)
unit_z_7 = UnitZ(Factor=Slider(1, range=0..1))
close_curve_2 = CloseCurve(Curve=extend_curve, CloseType=0, Bulge=0.5, Tolerance=0)  # -> Closed, ResultBoolean
move_7 = Move(Geometry=offset_curve_3, Motion=unit_z_7)  # -> Geometry, Transform
first_floor_level_2 = Data(first_floor_level)
# GROUND FLOOR
explode_5 = Explode(Curve=ground_central_zone, Recursive=True)  # -> Segments, Vertices
ground_workstation = Data(offset_curve_2)
addition_2 = Addition(A=number_slider_10, B=number_slider_9, C=number_slider_9)
panel = Panel(addition_2)
first_floor_level_3 = Data(addition_2)
crv = Curve(flatten(explode_5.Segments))
desk_curves = Data(simplify(close_curve_2.Closed))
explode_6 = Explode(Curve=desk_curves, Recursive=True)  # -> Segments, Vertices
list_item_2 = ListItem(List=explode_6.Segments, Index=0, Wrap=True)  # -> Item, Item1, Item2, Item3
discontinuity = Discontinuity(Curve=crv, Level=1)  # -> Points, Parameters
addition_3 = Addition(A=first_floor_level_3, B=Slider(0.06, range=0..0.1))
curve_8 = Curve(list_item_2.Item3)
end_points = EndPoints(Curve=curve_8)  # -> Start, End
panel_2 = Panel("First Floor")
vector_2pt = Vector2Pt(PointA=end_points.Start, PointB=end_points.End, Unitize=False)  # -> Vector, Length
join_curves_4 = JoinCurves(Curves=crv, Preserve=False)
curve_middle_5 = CurveMiddle(Curve=curve_8)
align_plane = AlignPlane(Plane=curve_middle_5, Direction=vector_2pt.Vector)  # -> Plane, Angle
offset_curve_4 = OffsetCurve(Curve=join_curves_4, Plane=PlaneXY(0, 0, 0), Distance=Slider(0.02, range=0..0.1), BothSides=0, Kinks=0, CapType="0")
deconstruct_plane_3 = DeconstructPlane(Plane=align_plane.Plane)  # -> Origin, XAxis, YAxis, ZAxis
construct_plane_3 = ConstructPlane(Origin=deconstruct_plane_3.Origin, XAxis=deconstruct_plane_3.XAxis, YAxis=deconstruct_plane_3.ZAxis)
unit_z_8 = UnitZ(Factor=addition_3)
shift_paths = ShiftPaths(Data=construct_plane_3, Offset=-1)
mirror_3 = Mirror(Geometry=desk_curves, Plane=shift_paths)  # -> Geometry, Transform
curve_9 = Curve(mirror_3.Geometry)
curve_10 = Curve(desk_curves)
merge_4 = Merge(Data1=curve_10, Data2=curve_9)  # -> flatten(Result)
region_union_2 = RegionUnion(Curves=merge_4)
divide_domain² = DivideDomain²(Domain=extrude, UCount="4", VCount="12")
cap_holes = CapHoles(Brep=extrude)
isotrim = Isotrim(Surface=extrude, Domain=divide_domain²)
panel_3 = Panel("""True
False
False
True""")
dispatch_6 = Dispatch(List=isotrim, DispatchPattern=panel_3)  # -> ListA, ListB
divide_domain²_2 = DivideDomain²(Domain=extrude, UCount="10", VCount="24")
isotrim_2 = Isotrim(Surface=extrude, Domain=divide_domain²_2)
panel_4 = Panel("""True
True
False
False
False
False
True
True""")
dispatch_7 = Dispatch(List=isotrim_2, DispatchPattern=panel_4)  # -> ListA, ListB
panel_5 = Panel("""True
False
False
True""")
dispatch_8 = Dispatch(List=dispatch_7.ListB, DispatchPattern=panel_5)  # -> ListA, ListB
curved_mdle = Surface(dispatch_8.ListB)
straight_mdle = Surface(dispatch_8.ListA)
surface = Surface(simplify(dispatch_7.ListB))
panel_6 = Panel("""30
31
32
33
34
35
36
37
38
39
40
41""")
series_2 = Series(Start="48", Step=1, Count="12")
series_3 = Series(Start="48", Step=1, Count="36")
list_item_3 = ListItem(List=surface, Index=series_2, Wrap=True)
cull_index = CullIndex(List=surface, Indices=series_3, Wrap=True)
surface_2 = Surface(cull_index)
list_item_4 = ListItem(List=straight_mdle, Index=panel_6, Wrap=True)
list_item_5 = ListItem(List=curved_mdle, Index=panel_6, Wrap=True)
surface_3 = Surface(reparameterize(dispatch_6.ListA))
construct_domain² = ConstructDomain²(
    UMin=Slider(0.03, range=0..1),
    UMax=Slider(0.97, range=0..1),
    VMin=Slider(0.03, range=0..1),
    VMax=Slider(0.97, range=0..1))
number_slider_16 = Slider(20, range=0..100)  # disabled
merge_5 = Merge(Data1=list_item_5, Data2=list_item_4)
surface_4 = Surface(list_item_3)
isotrim_3 = Isotrim(Surface=surface_3, Domain=construct_domain²)
number_slider_17 = Slider(11, range=0..100)
brep_join = BrepJoin(Breps=merge_5)  # -> simplify(Breps), Closed
construct_domain²_2 = ConstructDomain²(
    UMin=Slider(0.03, range=0..1),
    UMax=Slider(0.97, range=0..1),
    VMin=Slider(0.03, range=0..1),
    VMax=Slider(0.97, range=0..1))
surface_5 = Surface(reparameterize(surface_4))
offset_surface = OffsetSurface(Surface=brep_join.Breps, Distance=Slider(0.02, range=0..0.1), BothSides=0, CreateSolid=True)
number_slider_18 = Slider(10, range=0..100)
surface_6 = Surface(offset_curve_4)
offset_surface_2 = OffsetSurface(Surface=isotrim_3, Distance=Slider(0.01, range=0..0.01), BothSides=0, CreateSolid=True)
construct_domain²_3 = ConstructDomain²(
    UMin=Slider(0.03, range=0..1),
    UMax=Slider(0.97, range=0..1),
    VMin=Slider(0.03, range=0..1),
    VMax=Slider(0.97, range=0..1))
surface_7 = Surface(reparameterize(surface_2))
number_slider_19 = Slider(70, range=0..100)
isotrim_4 = Isotrim(Surface=surface_5, Domain=construct_domain²_2)
negative_4 = Negative(Value=Slider(0.01, range=0..0.05))
unit_z_9 = UnitZ(Factor=number_slider_10)
surface_8 = Surface(first_floor_level_2)
surface_9 = Surface(region_union_2)
offset_surface_3 = OffsetSurface(Surface=surface_6, Distance=negative_4, BothSides=Toggle(False), CreateSolid=True)
surface_10 = Surface(ground_central_zone)
curve_11 = Curve(move.Geometry)
negative_5 = Negative(Value=number_slider_7)
isotrim_5 = Isotrim(Surface=surface_7, Domain=construct_domain²_3)
split_brep = SplitBrep(Brep=flatten(surface_10), Cutter=flatten(offset_surface_3))
extrude_2 = Extrude(Base=offset_curve_2, Direction=unit_z_8)
number_slider_20 = Slider(25, range=0..100)
number_slider_21 = Slider(11, range=0..100)
offset_surface_4 = OffsetSurface(Surface=surface_8, Distance=negative_5, BothSides=0, CreateSolid=True)
extrude_3 = Extrude(Base=curve_11, Direction=unit_z_9)
negative_6 = Negative(Value=Slider(0.01, range=0..0.01))
offset_surface_5 = OffsetSurface(Surface=isotrim_4, Distance=Slider(0.01, range=0..0.01), BothSides=Toggle(False), CreateSolid=Toggle(True))
cap_holes_2 = CapHoles(Brep=extrude_2)
offset_surface_6 = OffsetSurface(Surface=surface_9, Distance=Slider(0.025, range=0..0.1), BothSides=0, CreateSolid=True)
offset_surface_7 = OffsetSurface(Surface=extrude_3, Distance=negative_6, BothSides=0, CreateSolid=True)
offset_surface_8 = OffsetSurface(Surface=isotrim_5, Distance=Slider(0.01, range=0..0.01), BothSides=0, CreateSolid=True)
# Tables
surface_11 = Surface(move_7.Geometry)
# Ground Floor
mesh_colours = MeshColours(Mesh=offset_surface_3, Colours=ColourSwatch(SwatchColor=RGB(209, 209, 209)))  # -> simplify(Mesh)
list_length = ListLength(List=flatten(offset_surface_5))  # -> flatten(Length)
list_length_2 = ListLength(List=flatten(offset_surface_8))  # -> flatten(Length)
# First Floor
mesh_colours_2 = MeshColours(Mesh=offset_surface_4, Colours=ColourSwatch(SwatchColor=RGB(102, 102, 102)))  # -> simplify(Mesh)
# MDLE
mesh_colours_3 = MeshColours(Mesh=offset_surface_8, Colours=ColourSwatch(SwatchColor=RGB(146, 160, 166)))  # -> simplify(Mesh)
# SCREEN
mesh_colours_4 = MeshColours(Mesh=offset_surface, Colours=ColourSwatch(SwatchColor=RGB(107, 120, 242)))  # -> simplify(Mesh)
# work space
mesh_colours_5 = MeshColours(Mesh=offset_surface_5, Colours=ColourSwatch(SwatchColor=RGB(135, 140, 135)))  # -> simplify(Mesh)
# Inner Walls
mesh_colours_6 = MeshColours(Mesh=cap_holes_2, Colours=ColourSwatch(SwatchColor=RGB(150, 150, 150)))  # -> simplify(Mesh)
panel_7 = Panel(list_length)
# Outer Walls
mesh_colours_7 = MeshColours(Mesh=offset_surface_7, Colours=ColourSwatch(SwatchColor=RGB(224, 224, 224)))  # -> simplify(Mesh)
list_length_3 = ListLength(List=flatten(offset_surface))  # -> flatten(Length)
# Lockers
colour_swatch = ColourSwatch(SwatchColor=RGB(112, 112, 112))
panel_8 = Panel(list_length_2)
list_length_4 = ListLength(List=flatten(offset_surface_2))  # -> flatten(Length)
colour_swatch_2 = ColourSwatch(SwatchColor=RGB(120, 68, 68))
mesh_colours_8 = MeshColours(Mesh=surface_11, Colours=colour_swatch_2)
list_length_5 = ListLength(List=flatten(offset_surface_6))  # -> flatten(Length)
shift_paths_2 = ShiftPaths(Data=mesh_colours_4, Offset=-1)
panel_9 = Panel(list_length_3)
shift_paths_3 = ShiftPaths(Data=mesh_colours_5, Offset=-1)
rh_out_workdrawers = Data(panel_7)
shift_paths_4 = ShiftPaths(Data=mesh_colours_3, Offset=-1)
panel_10 = Panel(list_length_4)
# DESK
mesh_colours_9 = MeshColours(Mesh=offset_surface_6, Colours=colour_swatch_2)  # -> simplify(Mesh)
rh_out_mdle = Data(panel_8)
panel_11 = Panel(list_length_5)
mesh_colours_10 = MeshColours(Mesh=offset_surface_2, Colours=colour_swatch)  # -> simplify(Mesh)
rh_out_screens = Data(panel_9)
rh_out_ctb = Data(panel_10)
rh_out_desk = Data(panel_11)
shift_paths_5 = ShiftPaths(Data=mesh_colours_10, Offset=-1)
merge_6 = Merge(
    Data1=mesh_colours_2,
    Data2=mesh_colours_6,
    Data3=mesh_colours_7,
    Data4=shift_paths_4,
    Data5=shift_paths_3,
    Data6=shift_paths_2,
    Data7=mesh_colours_9,
    Data8=shift_paths_5)
param_viewer = ParamViewer(merge_6)
data = Data(merge_6)
merge_7 = Merge(Data1=data, Data2=mesh_colours, Data3=mesh_colours_8)
data_2 = Data(merge_7)
number_slider_22 = Slider(2.6, range=0..10)
number_slider_23 = Slider(2600, range=0..10000)
subtraction = Subtraction(A=number_slider_2, B=Slider(1, range=0..1))
series_4 = Series(Start=number_slider_22, Step=number_slider_22, Count=subtraction)
tree_branch = TreeBranch(Tree=data, Path="0", MaintainPaths=True)
unit_z_10 = UnitZ(Factor=series_4)
group = Group(Objects=tree_branch)
move_8 = Move(Geometry=group, Motion=unit_z_10)  # -> Geometry, Transform
ungroup = Ungroup(Group=move_8.Geometry)
merge_8 = Merge(Data1=ungroup, Data2=data_2)

# ---- group: RH_OUT:mesh
mesh = Mesh(merge_8)
